# Dynamo graph This makes a line.dyn (Dynamo 2.12.0.5650)
# author: Dalton
# This makes a line.

code_block = CodeBlock { 0; }
byCoordinates = Point.ByCoordinates(x=code_block)
code_block_2 = CodeBlock { 5; }
byCoordinates_2 = Vector.ByCoordinates(x=code_block_2)
code_block_3 = CodeBlock { 10; }
byStartPointDirectionLength = Line.ByStartPointDirectionLength(startPoint=byCoordinates, direction=byCoordinates_2, length=code_block_3)
