# Dynamo graph Warren Spatial Truss (FormIt).dyn "Warren Spatial Truss" (Dynamo 2.10.1.3976)

number_slider = DoubleSlider(99, range=0..100 step 1)
number_slider_2 = DoubleSlider(57, range=-10..100 step 1)
end_support = Point.ByCoordinates(x=number_slider, y=number_slider_2)
number_slider_3 = DoubleSlider(-22, range=-100..0 step 1)
number_slider_4 = DoubleSlider(0, range=-10..100 step 1)
start_support = Point.ByCoordinates(x=number_slider_3, y=number_slider_4)
byStartPointEndPoint = Line.ByStartPointEndPoint(startPoint=start_support, endPoint=end_support)
code_block = CodeBlock { 1; }
pointsAtEqualChordLength = Curve.PointsAtEqualChordLength(curve=byStartPointEndPoint, divisions=code_block)
X = Point.X(point=pointsAtEqualChordLength)
firstItem = List.FirstItem(list=X)
Y = Point.Y(point=pointsAtEqualChordLength)
firstItem_2 = List.FirstItem(list=Y)
distanceTo = Geometry.DistanceTo(geometry=start_support, other=end_support)
truss_height_l = DoubleSlider(3.9, range=1..100 step 0.1)
code_block_2 = CodeBlock(dis=distanceTo, h=truss_height_l) { dis/h; }
byCoordinates = Point.ByCoordinates(x=firstItem, y=firstItem_2, z=code_block_2)
truss_depth_l = DoubleSlider(15, range=1..100 step 1)
code_block_3 = CodeBlock(dis=distanceTo, depth=truss_depth_l) { dis/depth; }
byCoordinates_2 = Vector.ByCoordinates(z=code_block_3)
translate = Geometry.Translate(geometry=byCoordinates, direction=byCoordinates_2)
byThreePoints = Plane.ByThreePoints(origin=end_support, planePoint=start_support, xAxisPoint=translate)
spans = DoubleSlider(20, range=2..20 step 2)
void_spans = DoubleSlider(3, range=1..20 step 1)
code_block_4 = CodeBlock(spans=spans, void_spans=void_spans) { spans - void_spans; }
list_create = List.Create(item0=start_support, item1=byCoordinates, item2=end_support)
byPoints = NurbsCurve.ByPoints(points=list_create)
pointsAtEqualSegmentLength = Curve.PointsAtEqualSegmentLength(curve=byPoints, divisions=spans)
dropItems = List.DropItems(list=pointsAtEqualSegmentLength, amount=void_spans)
code_block_5 = CodeBlock(x=void_spans) { -x; }
dropItems_2 = List.DropItems(list=dropItems, amount=code_block_5)
code_block_6 = CodeBlock { 2; }
code_block_7 = CodeBlock { 1; }
dropEveryNthItem = List.DropEveryNthItem(list=dropItems_2, n=code_block_6, offset=code_block_7)
list_create_2 = List.Create(item0=start_support, item1=translate, item2=end_support)
byBestFitThroughPoints = Plane.ByBestFitThroughPoints(points=list_create_2)
normal = Plane.Normal(plane=byBestFitThroughPoints)
reverse = Vector.Reverse(vector=normal)
truss_width_l = DoubleSlider(14, range=1..100 step 1)
code_block_8 = CodeBlock(dis=distanceTo, w=truss_width_l) { dis/w; }
code_block_9 = CodeBlock(w=code_block_8) { w / 2; }
byStartPointDirectionLength = Line.ByStartPointDirectionLength(startPoint=translate, direction=reverse, length=code_block_9)
endPoint = Curve.EndPoint(curve=byStartPointDirectionLength)
list_create_3 = List.Create(item0=start_support, item1=endPoint, item2=end_support)
byPoints_2 = NurbsCurve.ByPoints(points=list_create_3)
pointsAtEqualSegmentLength_2 = Curve.PointsAtEqualSegmentLength(curve=byPoints_2, divisions=spans)
dropItems_3 = List.DropItems(list=pointsAtEqualSegmentLength_2, amount=void_spans)
dropItems_4 = List.DropItems(list=dropItems_3, amount=code_block_5)
code_block_10 = CodeBlock { 2; }
dropEveryNthItem_2 = List.DropEveryNthItem(list=dropItems_4, n=code_block_10)
code_block_11 = CodeBlock { [1,-1]; }
dropItems_5 = List.DropItems(list=dropEveryNthItem_2, amount=code_block_11)
transpose = List.Transpose(lists=dropItems_5)
byStartPointEndPoint_2 = Line.ByStartPointEndPoint(startPoint=dropEveryNthItem, endPoint=transpose)
direction = Line.Direction(line=byStartPointEndPoint_2)
byOriginNormal = Plane.ByOriginNormal(origin=dropEveryNthItem, normal=direction)
number_slider_5 = DoubleSlider(0.5, range=0..100 step 0.1)
byPlaneRadius = Circle.ByPlaneRadius(plane=byOriginNormal, radius=number_slider_5)
bySweep = Solid.BySweep(profile=byPlaneRadius, path=byStartPointEndPoint_2)
byStartPointDirectionLength_2 = Line.ByStartPointDirectionLength(startPoint=translate, direction=normal, length=code_block_9)
endPoint_2 = Curve.EndPoint(curve=byStartPointDirectionLength_2)
list_create_4 = List.Create(item0=start_support, item1=endPoint_2, item2=end_support)
byPoints_3 = NurbsCurve.ByPoints(points=list_create_4)
pointsAtEqualSegmentLength_3 = Curve.PointsAtEqualSegmentLength(curve=byPoints_3, divisions=spans)
dropItems_6 = List.DropItems(list=pointsAtEqualSegmentLength_3, amount=void_spans)
dropItems_7 = List.DropItems(list=dropItems_6, amount=code_block_5)
code_block_12 = CodeBlock { 2; }
dropEveryNthItem_3 = List.DropEveryNthItem(list=dropItems_7, n=code_block_12)
code_block_13 = CodeBlock { [1,-1]; }
dropItems_8 = List.DropItems(list=dropEveryNthItem_3, amount=code_block_13)
transpose_2 = List.Transpose(lists=dropItems_8)
byStartPointEndPoint_3 = Line.ByStartPointEndPoint(startPoint=transpose, endPoint=transpose_2)
direction_2 = Line.Direction(line=byStartPointEndPoint_3)
byOriginNormal_2 = Plane.ByOriginNormal(origin=transpose, normal=direction_2)
byPlaneRadius_2 = Circle.ByPlaneRadius(plane=byOriginNormal_2, radius=number_slider_5)
bySweep_2 = Solid.BySweep(profile=byPlaneRadius_2, path=byStartPointEndPoint_3)
byStartPointEndPoint_4 = Line.ByStartPointEndPoint(startPoint=dropEveryNthItem, endPoint=transpose_2)
direction_3 = Line.Direction(line=byStartPointEndPoint_4)
byOriginNormal_3 = Plane.ByOriginNormal(origin=dropEveryNthItem, normal=direction_3)
byPlaneRadius_3 = Circle.ByPlaneRadius(plane=byOriginNormal_3, radius=number_slider_5)
bySweep_3 = Solid.BySweep(profile=byPlaneRadius_3, path=byStartPointEndPoint_4)
number_slider_6 = DoubleSlider(1, range=0..100 step 0.1)
byCenterPointRadius = Circle.ByCenterPointRadius(centerPoint=start_support, radius=number_slider_6)
bySweep_4 = Solid.BySweep(profile=byCenterPointRadius, path=byPoints)
bySweep_5 = Solid.BySweep(profile=byCenterPointRadius, path=byPoints_2)
bySweep_6 = Solid.BySweep(profile=byCenterPointRadius, path=byPoints_3)
join = List.Join(list0=bySweep, list1=bySweep_2, list2=bySweep_3, list3=bySweep_4, list4=bySweep_5, list5=bySweep_6)
flatten = List.Flatten(list=join)
byUnion = Solid.ByUnion(solids=flatten)
