# Dynamo graph Exploding Brick Wall.dyn (Dynamo 2.10.1.3976)

XY = Plane.XY()
code_block = CodeBlock { 0; }
NH = DoubleSlider(5, range=1..100 step 1)
length_in = DoubleSlider(8, range=1..10 step 0.1)
mortar_thickness_in = DoubleSlider(0.25, range=0..5 step 0.1)
code_block_2 = CodeBlock(l=length_in, m=mortar_thickness_in) { (l + m) / 12; }
sequence = Sequence(start=code_block, amount=NH, step=code_block_2)
byCoordinates = Vector.ByCoordinates(x=sequence)
translate = Geometry.Translate(geometry=XY, direction=byCoordinates)
NV = DoubleSlider(5, range=1..100 step 1)
height_in = DoubleSlider(2.25, range=1..5 step 0.1)
code_block_3 = CodeBlock(h=height_in, m=mortar_thickness_in) { (h + m) / 12; }
sequence_2 = Sequence(start=code_block, amount=NV, step=code_block_3)
code_block_4 = CodeBlock { 0; }
count = List.Count(list=sequence_2)
code_block_5 = CodeBlock { 2; }
slice = List.Slice(list=sequence_2, start=code_block_4, end=count, step=code_block_5)
byCoordinates_2 = Vector.ByCoordinates(z=slice)
translate_2 = Geometry.Translate(geometry=translate@L1, direction=byCoordinates_2)
number_slider = DoubleSlider(1.5, range=-10..10 step 0.1)
number_slider_2 = DoubleSlider(-1.3, range=-10..10 step 0.1)
byCoordinates_3 = Point.ByCoordinates(x=number_slider, y=number_slider_2)
origin = Plane.Origin(plane=translate_2)
byTwoPoints = Vector.ByTwoPoints(start=byCoordinates_3, end=origin)
number_slider_3 = DoubleSlider(2, range=0..100 step 0.1)
length = Vector.Length(vector=byTwoPoints)
code_block_6 = CodeBlock(x=length) { 1 / x; }
code_block_7 = CodeBlock(x=number_slider_3, y=code_block_6) { x * y; }
scale = Vector.Scale(vector=byTwoPoints, scale_factor=code_block_7)
translate_3 = Geometry.Translate(geometry=translate_2, direction=scale)
bed_width_in = DoubleSlider(3.125, range=0..5 step 0.1)
code_block_8 = CodeBlock(l=length_in, w=bed_width_in, h=height_in, m=mortar_thickness_in) { l; w; h; m; l / 12; w / 12; h / 12; }
byWidthLength = Rectangle.ByWidthLength(plane=translate_3, width=code_block_8.out4, length=code_block_8.out5)
extrudeAsSolid = Curve.ExtrudeAsSolid(curve=byWidthLength, distance=code_block_8.out6)
XY_2 = Plane.XY()
code_block_9 = CodeBlock(l=length_in) { -((l * 0.25) / 12); }
code_block_10 = CodeBlock(m=mortar_thickness_in) { m/12; }
code_block_11 = CodeBlock(l=code_block_9, m=code_block_10) { l - (m/2); }
code_block_12 = CodeBlock(l=length_in) { (l / 2) / 12; }
sequence_3 = Sequence(start=code_block_12, amount=NH, step=code_block_2)
join = List.Join(list0=code_block_11, list1=sequence_3)
code_block_13 = CodeBlock { -1; }
code_block_14 = CodeBlock(l=join, b=code_block_9) { l[-1] + b; }
replaceItemAtIndex = List.ReplaceItemAtIndex(list=join, index=code_block_13, item=code_block_14)
byCoordinates_4 = Vector.ByCoordinates(x=replaceItemAtIndex)
translate_4 = Geometry.Translate(geometry=XY_2, direction=byCoordinates_4)
code_block_15 = CodeBlock { 1; }
count_2 = List.Count(list=sequence_2)
code_block_16 = CodeBlock { 2; }
slice_2 = List.Slice(list=sequence_2, start=code_block_15, end=count_2, step=code_block_16)
byCoordinates_5 = Vector.ByCoordinates(z=slice_2)
translate_5 = Geometry.Translate(geometry=translate_4@L1, direction=byCoordinates_5)
translate_6 = Geometry.Translate(geometry=translate_5, direction=scale)
code_block_17 = CodeBlock(l=code_block_8.out4) { l / 2; }
code_block_18 = CodeBlock(m=mortar_thickness_in) { m/12; }
code_block_19 = CodeBlock(l=code_block_17, m=code_block_18) { l - m; }
ofRepeatedItem = List.OfRepeatedItem(item=code_block_8.out4, amount=NH)
join_2 = List.Join(list0=code_block_19, list1=ofRepeatedItem)
code_block_20 = CodeBlock { -1; }
replaceItemAtIndex_2 = List.ReplaceItemAtIndex(list=join_2, index=code_block_20, item=code_block_17)
byWidthLength_2 = Rectangle.ByWidthLength(plane=translate_6, width=replaceItemAtIndex_2, length=code_block_8.out5)
join_3 = List.Join(list0=byWidthLength, list1=byWidthLength_2)
list_create = List.Create()  # unwired: item0, item1
flatten = List.Flatten()  # unwired: list
number_slider_4 = DoubleSlider(-1.3, range=-10..10 step 0.1)
byCoordinates_6 = Point.ByCoordinates(x=number_slider, y=number_slider_4)
origin_2 = Plane.Origin(plane=translate_5)
byTwoPoints_2 = Vector.ByTwoPoints(start=byCoordinates_6, end=origin_2)
number_slider_5 = DoubleSlider(3, range=0..100 step 0.1)
scale_2 = Vector.Scale(vector=byTwoPoints_2, scale_factor=number_slider_5)
translate_7 = Geometry.Translate(geometry=translate_5, direction=scale_2)
extrudeAsSolid_2 = Curve.ExtrudeAsSolid(curve=byWidthLength_2, distance=code_block_8.out6)
