# Dynamo graph Facade Triangulation.dyn (Dynamo 2.10.1.3976)

code_block = CodeBlock { 12; }
code_block_2 = CodeBlock { 1; }
spans = DoubleSlider(16, range=1..50 step 1)
identity = Object.Identity(object=spans)
ofRepeatedItem = List.OfRepeatedItem(item=code_block_2, amount=identity)
select_model_element = DSModelElementSelection()  # 1 picked in the model
getLocation = Element.GetLocation(element=select_model_element)
startPoint = Curve.StartPoint(curve=getLocation)
pointsAtEqualSegmentLength = Curve.PointsAtEqualSegmentLength(curve=getLocation, divisions=spans)
endPoint = Curve.EndPoint(curve=getLocation)
join = List.Join(list0=startPoint, list1=pointsAtEqualSegmentLength, list2=endPoint)
code_block_3 = CodeBlock { -1; }
dropItems = List.DropItems(list=join, amount=code_block_3)
code_block_4 = CodeBlock { 1; }
dropItems_2 = List.DropItems(list=join, amount=code_block_4)
list_create = List.Create(item0=dropItems, item1=dropItems_2)
lastItem = List.LastItem(list=list_create)
firstItem = List.FirstItem(list=list_create)
byStartPointEndPoint = Line.ByStartPointEndPoint(startPoint=lastItem, endPoint=firstItem)
select_model_element_2 = DSModelElementSelection()  # 1 picked in the model
getLocation_2 = Element.GetLocation(element=select_model_element_2)
startPoint_2 = Curve.StartPoint(curve=getLocation_2)
pointsAtEqualSegmentLength_2 = Curve.PointsAtEqualSegmentLength(curve=getLocation_2, divisions=spans)
endPoint_2 = Curve.EndPoint(curve=getLocation_2)
join_2 = List.Join(list0=startPoint_2, list1=pointsAtEqualSegmentLength_2, list2=endPoint_2)
lastItem_2 = List.LastItem(list=join_2)
lastItem_3 = List.LastItem(list=join)
byStartPointEndPoint_2 = Line.ByStartPointEndPoint(startPoint=lastItem_2, endPoint=lastItem_3)
code_block_5 = CodeBlock { -1; }
dropItems_3 = List.DropItems(list=join_2, amount=code_block_5)
code_block_6 = CodeBlock { 1; }
dropItems_4 = List.DropItems(list=join_2, amount=code_block_6)
list_create_2 = List.Create(item0=dropItems_3, item1=dropItems_4)
transpose = List.Transpose(lists=list_create_2)
byStartPointEndPoint_3 = Line.ByStartPointEndPoint(startPoint=transpose@L2, endPoint=join@L1)
flatten = List.Flatten(list=byStartPointEndPoint_3)
addItemToEnd = List.AddItemToEnd(item=byStartPointEndPoint_2, list=flatten)
code_block_7 = CodeBlock { -1; }
dropItems_5 = List.DropItems(list=addItemToEnd, amount=code_block_7)
code_block_8 = CodeBlock { 1; }
dropItems_6 = List.DropItems(list=addItemToEnd, amount=code_block_8)
list_create_3 = List.Create(item0=dropItems_5, item1=dropItems_6)
transpose_2 = List.Transpose(lists=list_create_3)
code_block_9 = CodeBlock { 2; }
takeEveryNthItem = List.TakeEveryNthItem(list=transpose_2, n=code_block_9)
addItemToFront = List.AddItemToFront(item=byStartPointEndPoint@L1, list=takeEveryNthItem@L2)
byJoinedCurves = PolyCurve.ByJoinedCurves(curves=addItemToFront)
byPatch = Surface.ByPatch(closedCurve=byJoinedCurves)
curves = PolyCurve.Curves(polyCurve=byJoinedCurves)
startPoint_3 = Curve.StartPoint(curve=curves)
firstItem_2 = List.FirstItem(list=startPoint_3@L2)
lastItem_4 = List.LastItem(list=startPoint_3@L2)
code_block_10 = CodeBlock { 1; }
getItemAtIndex = List.GetItemAtIndex(list=startPoint_3@L2, index=code_block_10)
byThreePoints = Plane.ByThreePoints(origin=firstItem_2, planePoint=lastItem_4, xAxisPoint=getItemAtIndex)
contextCoordinateSystem = Geometry.ContextCoordinateSystem(geometry=byThreePoints)
XY = Plane.XY()
code_block_11 = CodeBlock { 1; }
byCoordinates = Vector.ByCoordinates(x=code_block_11)
code_block_12 = CodeBlock { 0; }
dis = DoubleSlider(15, range=6..100 step 1)
code_block_13 = CodeBlock(dis=dis, spans=identity) { dis * spans - dis; }
range = Range(start=code_block_12, end=code_block_13, step=dis)
translate = Geometry.Translate(geometry=XY, direction=byCoordinates, distance=range)
contextCoordinateSystem_2 = Geometry.ContextCoordinateSystem(geometry=translate)
transform = Geometry.Transform(geometry=byPatch, fromCoordinateSystem=contextCoordinateSystem, contextCoordinateSystem=contextCoordinateSystem_2)
transform_2 = Geometry.Transform()  # unwired: geometry, cs
lastItem_5 = List.LastItem(list=list_create_2)
firstItem_3 = List.FirstItem(list=list_create_2)
byStartPointEndPoint_4 = Line.ByStartPointEndPoint(startPoint=lastItem_5, endPoint=firstItem_3)
code_block_14 = CodeBlock { 2; }
code_block_15 = CodeBlock { 1; }
takeEveryNthItem_2 = List.TakeEveryNthItem(list=transpose_2, n=code_block_14, offset=code_block_15)
addItemToFront_2 = List.AddItemToFront(item=byStartPointEndPoint_4@L1, list=takeEveryNthItem_2@L2)
byJoinedCurves_2 = PolyCurve.ByJoinedCurves(curves=addItemToFront_2)
byPatch_2 = Surface.ByPatch(closedCurve=byJoinedCurves_2)
curves_2 = PolyCurve.Curves(polyCurve=byJoinedCurves_2)
startPoint_4 = Curve.StartPoint(curve=curves_2)
firstItem_4 = List.FirstItem(list=startPoint_4@L2)
lastItem_6 = List.LastItem(list=startPoint_4@L2)
code_block_16 = CodeBlock { 1; }
getItemAtIndex_2 = List.GetItemAtIndex(list=startPoint_4@L2, index=code_block_16)
byThreePoints_2 = Plane.ByThreePoints(origin=firstItem_4, planePoint=lastItem_6, xAxisPoint=getItemAtIndex_2)
contextCoordinateSystem_3 = Geometry.ContextCoordinateSystem(geometry=byThreePoints_2)
number_slider = DoubleSlider(20, range=0..100 step 0.1)
byCoordinates_2 = Point.ByCoordinates(y=number_slider)
code_block_17 = CodeBlock { 1; }
byCoordinates_3 = Vector.ByCoordinates(z=code_block_17)
byOriginNormal = Plane.ByOriginNormal(origin=byCoordinates_2, normal=byCoordinates_3)
code_block_18 = CodeBlock { 1; }
byCoordinates_4 = Vector.ByCoordinates(x=code_block_18)
translate_2 = Geometry.Translate(geometry=byOriginNormal, direction=byCoordinates_4, distance=range)
contextCoordinateSystem_4 = Geometry.ContextCoordinateSystem(geometry=translate_2)
transform_3 = Geometry.Transform(geometry=byPatch_2, fromCoordinateSystem=contextCoordinateSystem_3, contextCoordinateSystem=contextCoordinateSystem_4)
curves_3 = PolyCurve.Curves(polyCurve=byJoinedCurves)
join_3 = List.Join(list0=curves_3, list1=curves_2)
