# Dynamo graph Facade with Parametrically Optimized Windows.dyn (Dynamo 2.3.1.11775)
# packages: LunchBox for Dynamo 2018.7.6

select_model_element = DSModelElementSelection()  # 1 picked in the model
select_model_element_2 = DSModelElementSelection()  # 1 picked in the model
list_create = List.Create(item0=select_model_element, item1=select_model_element_2)
getLocation = Element.GetLocation(element=list_create)
byLoft = Surface.ByLoft(crossSections=getLocation)
surface_u_div = DoubleSlider(8, range=1..100 step 1)
surface_v_div = DoubleSlider(5, range=1..100 step 1)
divideSurfaceUV = Geometry.Surfaces.DivideSurfaceUV(surface=byLoft, UDivision=surface_u_div, VDivision=surface_v_div)
code_block = CodeBlock { 0; 1; }
PI = Math.PI()

# group: Sun
number_slider = DoubleSlider(-30.231, range=-100..100 step 1)
number_slider_2 = DoubleSlider(39.001, range=-100..100 step 1)
number_slider_3 = DoubleSlider(12.365, range=-9.868..100 step 1)
byCoordinates = Point.ByCoordinates(x=number_slider, y=number_slider_2, z=number_slider_3)

byTwoPoints = Vector.ByTwoPoints(start=divideSurfaceUV.Points, end=byCoordinates)
angleWithVector = Vector.AngleWithVector(vector=divideSurfaceUV.Normals, otherVector=byTwoPoints)
degreesToRadians = Math.DegreesToRadians(degrees=angleWithVector)
mapTo = Math.MapTo(rangeMin=code_block.out0, rangeMax=PI, inputValue=degreesToRadians, targetRangeMin=code_block.out0, targetRangeMax=code_block.out1)
circle_radius = DoubleSlider(1.7, range=0..10 step 0.1)
code_block_2 = CodeBlock(x=mapTo, n=circle_radius) { x*n; }
byPlaneRadius = Circle.ByPlaneRadius(plane=divideSurfaceUV.Planes, radius=code_block_2)
