# Dynamo graph Facade with Random Panels.dyn (Dynamo 2.10.1.3976)

select_model_element = DSModelElementSelection()  # 1 picked in the model
geometry = Element.Geometry(element=select_model_element)
explode = Geometry.Explode(geometry=geometry)
flatten = List.Flatten(list=explode)
code_block = CodeBlock { 0.5; }
pointAtParameter = Surface.PointAtParameter(surface=flatten, u=code_block, v=code_block)
normalAtPoint = Surface.NormalAtPoint(surface=flatten, point=pointAtParameter)
Y = Vector.Y(vector=normalAtPoint)
X = Vector.X(vector=normalAtPoint)
code_block_2 = CodeBlock(y=Y, x=X) { y > 0; x < 0; }
and_ = code_block_2.out0 && code_block_2.out1
filterByBoolMask = List.FilterByBoolMask(list=flatten, mask=and_)
watch = Watch(filterByBoolMask.in)
perimeterCurves = Surface.PerimeterCurves(surface=watch)
code_block_3 = CodeBlock { "Unconnected Height"; }
getParameterValueByName = Element.GetParameterValueByName(element=select_model_element, parameterName=code_block_3)
panel_row_amount = DoubleSlider(6, range=1..20 step 1)
vert_min_panel_range = DoubleSlider(2, range=0..10 step 1)
vert_max_panel_range = DoubleSlider(5, range=2..20 step 1)
seed = DoubleSlider(468.5, range=1..1000 step 0.1)
randomList = Math.RandomList(amount=panel_row_amount, value1=vert_min_panel_range, value2=vert_max_panel_range, seed=seed)
sum = Math.Sum(values=randomList)
code_block_4 = CodeBlock(h=getParameterValueByName, sum=sum) { (h / sum); }
code_block_5 = CodeBlock(x=code_block_4, y=randomList) { x * y; }
python_script = Python(IN[0]=code_block_5)  # CPython3
# ---------- python_script.python (8 lines) ----------
l = IN[0]
OUT = []
x = 1
for i in l:
    temp = l[0:x]
    temp[-1] = temp[-1]/2
    OUT.append(sum(temp[0:x]))
    x += 1
# ----------------------------------------
X_2 = Vector.X(vector=normalAtPoint)
Y_2 = Vector.Y(vector=normalAtPoint)
code_block_6 = CodeBlock(x=X_2, y=Y_2) { x > 0; y < 0; }
and_2 = code_block_6.out0 && code_block_6.out1
filterByBoolMask_2 = List.FilterByBoolMask(list=flatten, mask=and_2)
watch_2 = Watch(filterByBoolMask_2.in)
perimeterCurves_2 = Surface.PerimeterCurves(surface=watch_2)
flatten_2 = List.Flatten(list=perimeterCurves_2)
direction = Line.Direction(line=flatten_2)
Z = Vector.Z(vector=direction)
abs = Math.Abs(number=Z)
minimumItem = List.MinimumItem(list=abs)
eq = Z == minimumItem
filterByBoolMask_3 = List.FilterByBoolMask(list=flatten_2, mask=eq)
identity = Object.Identity(object=filterByBoolMask_3.in)
endPoint = Curve.EndPoint(curve=filterByBoolMask_3.in)
Z_2 = Point.Z(point=endPoint)
minimumItem_2 = List.MinimumItem(list=Z_2)
eq_2 = Z_2 == minimumItem_2
filterByBoolMask_4 = List.FilterByBoolMask(list=identity, mask=eq_2)
identity_2 = Object.Identity(object=filterByBoolMask_4.in)
length = Curve.Length(curve=identity_2)
panel_amount = DoubleSlider(8, range=1..20 step 1)
horz_min_panel_range = DoubleSlider(2, range=0..10 step 1)
horz_max_panel_range = DoubleSlider(7, range=2..20 step 1)
random_split_panels = Python(IN[0]=getParameterValueByName, IN[1]=vert_min_panel_range, IN[2]=vert_max_panel_range, IN[3]=seed)  # CPython3
# ---------- random_split_panels.python (14 lines) ----------
import random
seed = IN[3]
OUT = []
wall_height = IN[0]
ran_range_start = IN[1]
ran_range_end = IN[2]
while wall_height:
    rand_num = random.uniform(ran_range_start, ran_range_end)
    if rand_num + ran_range_start >= wall_height:
        OUT.append(wall_height)
        wall_height -= wall_height
    else:
        wall_height -= rand_num
        OUT.append(rand_num)
# ----------------------------------------
count = List.Count(list=random_split_panels)
code_block_7 = CodeBlock { -1000; 1000; }
seed_2 = DoubleSlider(468.5, range=1..1000 step 0.1)
randomList_2 = Math.RandomList(amount=count, value1=code_block_7.out0, value2=code_block_7.out1, seed=seed_2)
randomList_3 = Math.RandomList(amount=panel_amount, value1=horz_min_panel_range, value2=horz_max_panel_range, seed=randomList_2)
sum_2 = Math.Sum(values=randomList_3)
div = length / sum_2@L1
mul = div@L1 * randomList_3@L2
panel_dist = Python(IN[0]=mul)  # CPython3
# ---------- panel_dist.python (12 lines) ----------
lol = IN[0]
OUT = []

for l in lol:
    x = 1
    temp_1 = []
    for i in l:
        temp = l[0:x]
        temp[-1] = temp[-1]
        temp_1.append(sum(temp[0:x]))
        x += 1
    OUT.append(temp_1)
# ----------------------------------------
code_block_8 = CodeBlock { -1; }
dropItems = List.DropItems(list=panel_dist@L2, amount=code_block_8)
code_block_9 = CodeBlock { 2; }
code_block_10 = CodeBlock { 2; }
pointsAtEqualSegmentLength = Curve.PointsAtEqualSegmentLength(curve=identity_2, divisions=code_block_10)
flatten_3 = List.Flatten(list=pointsAtEqualSegmentLength)
lastItem = List.LastItem(list=endPoint)
firstItem = List.FirstItem(list=endPoint)
byThreePoints = Plane.ByThreePoints(origin=flatten_3, planePoint=lastItem, xAxisPoint=firstItem)
plane_dist = Python(IN[0]=random_split_panels)  # CPython3; same code as python_script
byCoordinates = Vector.ByCoordinates(z=plane_dist)
translate = Geometry.Translate(geometry=byThreePoints, direction=byCoordinates@L1)
flatten_4 = List.Flatten(list=translate)
byWidthLength = Rectangle.ByWidthLength(plane=flatten_4@L1, width=length, length=random_split_panels@L1)
code_block_11 = CodeBlock { 0; }
getItemAtIndex = List.GetItemAtIndex(list=byWidthLength@L2, index=code_block_11)
explode_2 = Geometry.Explode(geometry=getItemAtIndex)
code_block_12 = CodeBlock { 3; }
getItemAtIndex_2 = List.GetItemAtIndex(list=explode_2@L2, index=code_block_12)
firstItem_2 = List.FirstItem(list=length)
random_split_panels_2 = Python(IN[0]=firstItem_2, IN[1]=horz_min_panel_range, IN[2]=horz_max_panel_range, IN[3]=seed_2, IN[4]=count)  # CPython3
# ---------- random_split_panels_2.python (27 lines) ----------
import random
seed = IN[3]
rows = IN[4]
wall_height = IN[0]
ran_range_start = IN[1]
ran_range_end = IN[2]
OUT = [] 

def ran_pan ():
    seed = IN[3]
    rows = IN[4]
    wall_height = IN[0]
    ran_range_start = IN[1]
    ran_range_end = IN[2]
    temp = []
    while wall_height:
        rand_num = random.uniform(ran_range_start, ran_range_end)
        if rand_num + ran_range_start >= wall_height:
            temp.append(wall_height)
            wall_height -= wall_height
        else:
            wall_height -= rand_num
            temp.append(rand_num)
    return temp
    
for i in range(0,rows):
    OUT.append(ran_pan())
# ----------------------------------------
panel_dist_2 = Python(IN[0]=random_split_panels_2)  # CPython3
# ---------- panel_dist_2.python (12 lines) ----------
lol = IN[0]
OUT = []

for l in lol:
    x = 1
    temp_1 = []
    for i in l:
        temp = l[0:x]
        temp[-1] = temp[-1]/2
        temp_1.append(sum(temp[0:x]))
        x += 1
    OUT.append(temp_1)
# ----------------------------------------
pointAtSegmentLength = Curve.PointAtSegmentLength(curve=getItemAtIndex_2, segmentLength=panel_dist_2)
code_block_13 = CodeBlock(x=random_split_panels) { x / 2; }
byCoordinates_2 = Vector.ByCoordinates(z=code_block_13)
translate_2 = Geometry.Translate(geometry=pointAtSegmentLength, direction=byCoordinates_2)
byTwoPoints = Vector.ByTwoPoints(start=pointsAtEqualSegmentLength@L1, end=translate_2@L2, lacing=Longest)
translate_3 = Geometry.Translate(geometry=byThreePoints@L1, direction=byTwoPoints)
byWidthLength_2 = Rectangle.ByWidthLength(plane=translate_3@L2, width=random_split_panels_2@L2, length=random_split_panels@L1)
byPatch = Surface.ByPatch(closedCurve=byWidthLength_2)
