# Dynamo graph Free Form Roof with Circular Lanterns.dyn (Dynamo 2.10.1.3976)
# packages: LunchBox for Dynamo 2018.7.6, Ampersand 2019.12.31

UDivisions = DividedSurface.UDivisions()  # unwired: dividedSurface
byFaceAndUVDivisions = DividedSurface.ByFaceAndUVDivisions()  # unwired: elementFace, uDivs, vDivs
byPatch = Surface.ByPatch()  # unwired: closedCurve
byFaceUVDivisionsAndRotation = DividedSurface.ByFaceUVDivisionsAndRotation()  # unwired: surface, uDivs, vDivs, gridRotation
number_slider = DoubleSlider(1.6, range=1..10 step 0.1)
byCoordinates = Vector.ByCoordinates(z=number_slider)
number_slider_2 = DoubleSlider(30, range=0..100 step 0.1)
number_slider_3 = DoubleSlider(-10, range=-10..100 step 0.1)
number_slider_4 = DoubleSlider(1.5, range=0..100 step 0.1)
byCoordinates_2 = Point.ByCoordinates(x=number_slider_2, y=number_slider_3, z=number_slider_4)
number_slider_5 = DoubleSlider(0, range=0..100 step 0.1)
number_slider_6 = DoubleSlider(-10, range=-10..100 step 0.1)
number_slider_7 = DoubleSlider(1.5, range=0..100 step 0.1)
byCoordinates_3 = Point.ByCoordinates(x=number_slider_5, y=number_slider_6, z=number_slider_7)
byStartPointEndPoint = Line.ByStartPointEndPoint(startPoint=byCoordinates_2, endPoint=byCoordinates_3)
number_slider_8 = DoubleSlider(0, range=-1.079..100 step 0.1)
number_slider_9 = DoubleSlider(20, range=0..100 step 0.1)
byCoordinates_4 = Point.ByCoordinates(x=number_slider_8, y=number_slider_9)
number_slider_10 = DoubleSlider(30, range=-1.079..100 step 0.1)
number_slider_11 = DoubleSlider(20, range=0..100 step 0.1)
byCoordinates_5 = Point.ByCoordinates(x=number_slider_10, y=number_slider_11)
byStartPointEndPoint_2 = Line.ByStartPointEndPoint(startPoint=byCoordinates_4, endPoint=byCoordinates_5)
number_slider_12 = DoubleSlider(0, range=-1.079..100 step 0.1)
number_slider_13 = DoubleSlider(12.123, range=0..100 step 0.1)
number_slider_14 = DoubleSlider(1, range=0..100 step 0.1)
byCoordinates_6 = Point.ByCoordinates(x=number_slider_12, y=number_slider_13, z=number_slider_14)
number_slider_15 = DoubleSlider(7.053, range=0..100 step 0.1)
number_slider_16 = DoubleSlider(1.5, range=0..100 step 0.1)
byCoordinates_7 = Point.ByCoordinates(y=number_slider_15, z=number_slider_16)
number_slider_17 = DoubleSlider(0, range=0..100 step 0.1)
number_slider_18 = DoubleSlider(2, range=0..100 step 0.1)
byCoordinates_8 = Point.ByCoordinates(x=number_slider_17, y=number_slider_18)
list_create = List.Create(item0=byCoordinates_4, item1=byCoordinates_6, item2=byCoordinates_7, item3=byCoordinates_8, item4=byCoordinates_3)
byPoints = NurbsCurve.ByPoints(points=list_create)
number_slider_19 = DoubleSlider(30, range=-1.079..100 step 0.1)
number_slider_20 = DoubleSlider(12.123, range=0..100 step 0.1)
number_slider_21 = DoubleSlider(1, range=0..100 step 0.1)
byCoordinates_9 = Point.ByCoordinates(x=number_slider_19, y=number_slider_20, z=number_slider_21)
number_slider_22 = DoubleSlider(30, range=0..100 step 0.1)
number_slider_23 = DoubleSlider(7.053, range=0..100 step 0.1)
number_slider_24 = DoubleSlider(1.5, range=0..100 step 0.1)
byCoordinates_10 = Point.ByCoordinates(x=number_slider_22, y=number_slider_23, z=number_slider_24)
number_slider_25 = DoubleSlider(30, range=0..100 step 0.1)
number_slider_26 = DoubleSlider(-3, range=-3..100 step 0.1)
byCoordinates_11 = Point.ByCoordinates(x=number_slider_25, y=number_slider_26)
list_create_2 = List.Create(item0=byCoordinates_5, item1=byCoordinates_9, item2=byCoordinates_10, item3=byCoordinates_11, item4=byCoordinates_2)
byPoints_2 = NurbsCurve.ByPoints(points=list_create_2)
join = List.Join(list0=byStartPointEndPoint, list1=byStartPointEndPoint_2, list2=byPoints, list3=byPoints_2)
byJoinedCurves = PolyCurve.ByJoinedCurves(curves=join)
byPatch_2 = Surface.ByPatch(closedCurve=byJoinedCurves)
number_slider_27 = DoubleSlider(12, range=1..50 step 1)
number_slider_28 = DoubleSlider(9, range=1..50 step 1)
divideSurfaceUV = Geometry.Surfaces.DivideSurfaceUV(surface=byPatch_2, UDivision=number_slider_27, VDivision=number_slider_28)
doesIntersect = Geometry.DoesIntersect(geometry=byPatch_2, other=divideSurfaceUV.Points)
filterByBoolMask = List.FilterByBoolMask(list=divideSurfaceUV.Planes, mask=doesIntersect)
watch = Watch(filterByBoolMask.in)
number_slider_29 = DoubleSlider(1.7, range=0.1..4 step 0.1)
number_slider_30 = DoubleSlider(1.5, range=0.1..4 step 0.1)
byWidthLength = Rectangle.ByWidthLength(plane=watch, width=number_slider_29, length=number_slider_30)
code_block = CodeBlock { false; }
clean = List.Clean(list=byWidthLength, preserveIndices=code_block)
flatten = List.Flatten(list=clean)
filterByBoolMask_2 = List.FilterByBoolMask(list=divideSurfaceUV.Normals, mask=doesIntersect)
translate = Geometry.Translate(geometry=watch, direction=filterByBoolMask_2.in)
number_slider_31 = DoubleSlider(0.5, range=0.1..1 step 0.1)
byPlaneRadius = Circle.ByPlaneRadius(plane=translate, radius=number_slider_31)
code_block_2 = CodeBlock { false; }
clean_2 = List.Clean(list=byPlaneRadius, preserveIndices=code_block_2)
flatten_2 = List.Flatten(list=clean_2)
python_script = Python(IN[0]=flatten, IN[1]=flatten_2)  # CPython3
# ---------- python_script.python (7 lines) ----------
x = IN[0]
y = IN[1]

OUT = []
for i, j in zip(x, y):
    OUT.append([i,j])
    
# ----------------------------------------
byLoft = Solid.ByLoft(crossSections=python_script)
byLoft_2 = Solid.ByLoft(crossSections=byWidthLength)  # unwired: guideCurves
watch_2 = Watch()  # unwired: arg0
byGeometry = BoundingBox.ByGeometry(geom=byPatch_2, lacing=Shortest)
minPoint = BoundingBox.MinPoint(boundingBox=byGeometry)
XAxis = Vector.XAxis()
byOriginNormal = Plane.ByOriginNormal(origin=minPoint, normal=XAxis, lacing=Shortest)
toCuboid = BoundingBox.ToCuboid(boundingBox=byGeometry, lacing=Shortest)
width = Cuboid.Width(cuboid=toCuboid)
length = Cuboid.Length(cuboid=toCuboid)
code_block_3 = CodeBlock(w=width, l=length) { n = 5; 0..w..#n+2; 0..l..#n+2; }
count = List.Count(list=code_block_3.out2)
code_block_4 = CodeBlock(l=count) { [0,l-1]; }
removeItemAtIndex = List.RemoveItemAtIndex(list=code_block_3.out1, indices=code_block_4)
offset = Plane.Offset(plane=byOriginNormal, dist=removeItemAtIndex)
YAxis = Vector.YAxis()
byOriginNormal_2 = Plane.ByOriginNormal(origin=minPoint, normal=YAxis)
code_block_5 = CodeBlock(l=count) { [0,l-1]; }
removeItemAtIndex_2 = List.RemoveItemAtIndex(list=code_block_3.out2, indices=code_block_5)
offset_2 = Plane.Offset(plane=byOriginNormal_2, dist=removeItemAtIndex_2)
join_2 = List.Join(list0=offset, list1=offset_2)
geometry_splitbytools = Custom[[&] Geometry.SplitByTools](geometry=byPatch_2, tools=join_2)  # package Ampersand; Split one piece of geometry (other than a polysurface) by multiple tools
code_block_6 = CodeBlock { 0.5; }
pointAtParameter = Surface.PointAtParameter(surface=geometry_splitbytools, u=code_block_6, v=code_block_6)
normalAtPoint = Surface.NormalAtPoint(surface=geometry_splitbytools, point=pointAtParameter)
byOriginNormal_3 = Plane.ByOriginNormal(origin=pointAtParameter, normal=normalAtPoint)
number_slider_32 = DoubleSlider(4, range=1..10 step 1)
byStartPointDirectionLength = Line.ByStartPointDirectionLength(startPoint=pointAtParameter, direction=normalAtPoint, length=number_slider_32)
startPoint = Curve.StartPoint(curve=byStartPointDirectionLength)
endPoint = Curve.EndPoint(curve=byStartPointDirectionLength)
byTwoPoints = Vector.ByTwoPoints(start=startPoint, end=endPoint)
translate_2 = Geometry.Translate(geometry=byOriginNormal_3, direction=byTwoPoints)
number_slider_33 = DoubleSlider(1, range=0.1..1 step 0.1)
byPlaneRadius_2 = Circle.ByPlaneRadius(plane=translate_2, radius=number_slider_33)
perimeterCurves = Surface.PerimeterCurves(surface=geometry_splitbytools)
byJoinedCurves_2 = PolyCurve.ByJoinedCurves(curves=perimeterCurves)
python_script_2 = Python(IN[0]=byPlaneRadius_2, IN[1]=byJoinedCurves_2)  # CPython3; same code as python_script
byLoft_3 = Solid.ByLoft(crossSections=python_script_2)
