# Dynamo graph Intersections.dyn (Dynamo 2.10.1.3976)

# group: Cylinder
number_slider = DoubleSlider(3, range=-10..25 step 0.1)
byCoordinates = Point.ByCoordinates(z=number_slider)
number_slider_2 = DoubleSlider(2.1, range=1..10 step 0.1)
byCenterPointRadius = Circle.ByCenterPointRadius(centerPoint=byCoordinates, radius=number_slider_2)
byPatch = Surface.ByPatch(closedCurve=byCenterPointRadius)
number_slider_3 = DoubleSlider(10, range=1..20 step 0.1)
code_block = CodeBlock { false; }
thicken = Surface.Thicken(surface=byPatch, thickness=number_slider_3, both_sides=code_block)

number_slider_4 = DoubleSlider(8, range=-20..20 step 1)
number_slider_5 = DoubleSlider(10, range=-20..20 step 1)
number_slider_6 = DoubleSlider(11, range=-20..20 step 1)
byCoordinates_2 = Point.ByCoordinates(x=number_slider_4, y=number_slider_5, z=number_slider_6)
number_slider_7 = DoubleSlider(8, range=-20..20 step 1)
number_slider_8 = DoubleSlider(7, range=-20..20 step 1)
number_slider_9 = DoubleSlider(11, range=-20..20 step 1)
byCoordinates_3 = Point.ByCoordinates(x=number_slider_7, y=number_slider_8, z=number_slider_9)
number_slider_10 = DoubleSlider(-3, range=-20..20 step 1)
number_slider_11 = DoubleSlider(18, range=-20..20 step 1)
number_slider_12 = DoubleSlider(8, range=-20..20 step 1)
byCoordinates_4 = Point.ByCoordinates(x=number_slider_10, y=number_slider_11, z=number_slider_12)
byThreePoints = Plane.ByThreePoints(origin=byCoordinates_2, planePoint=byCoordinates_3, xAxisPoint=byCoordinates_4)
intersect = Geometry.Intersect(geometry=thicken, other=byThreePoints)

# group: Sphere
number_slider_13 = DoubleSlider(1, range=-20..20 step 0.1)
number_slider_14 = DoubleSlider(4.5, range=-20..20 step 0.1)
number_slider_15 = DoubleSlider(4.6, range=-20..20 step 0.1)
byCoordinates_5 = Point.ByCoordinates(x=number_slider_13, y=number_slider_14, z=number_slider_15)
number_slider_16 = DoubleSlider(4, range=1..10 step 0.1)
byCenterPointRadius_2 = Sphere.ByCenterPointRadius(centerPoint=byCoordinates_5, radius=number_slider_16)

split = Geometry.Split(geometry=thicken, other=byCenterPointRadius_2)
code_block_2 = CodeBlock { 1; }
getItemAtIndex = List.GetItemAtIndex(list=split, index=code_block_2)
watch = Watch(getItemAtIndex)
intersect_2 = Geometry.Intersect(geometry=thicken, other=byCenterPointRadius_2)
explode = Geometry.Explode(geometry=intersect_2)
flatten = List.Flatten(list=explode)
firstItem = List.FirstItem(list=flatten)
perimeterCurves = Surface.PerimeterCurves(surface=firstItem)

# group: Cuboid
number_slider_17 = DoubleSlider(1, range=-20..20 step 0.1)
number_slider_18 = DoubleSlider(1.6, range=-20..20 step 0.1)
byCoordinates_6 = Point.ByCoordinates(x=number_slider_17, y=number_slider_18)
number_slider_19 = DoubleSlider(3.1, range=1..10 step 0.1)
byCenterPointRadius_3 = Circle.ByCenterPointRadius(centerPoint=byCoordinates_6, radius=number_slider_19)
code_block_3 = CodeBlock { 4; }
regularPolygon = Polygon.RegularPolygon(circle=byCenterPointRadius_3, numberSides=code_block_3)
byPatch_2 = Surface.ByPatch(closedCurve=regularPolygon)
number_slider_20 = DoubleSlider(4.4, range=1..20 step 0.1)
code_block_4 = CodeBlock { false; }
thicken_2 = Surface.Thicken(surface=byPatch_2, thickness=number_slider_20, both_sides=code_block_4)

join = List.Join(list0=thicken, list1=byCenterPointRadius_2, list2=thicken_2)
byUnion = Solid.ByUnion(solids=join)
code_block_5 = CodeBlock { 15; }
byCoordinates_7 = Vector.ByCoordinates(x=code_block_5, y=code_block_5)
translate = Geometry.Translate(geometry=byUnion, direction=byCoordinates_7)
explode_2 = Geometry.Explode(geometry=translate)
difference = Solid.Difference(solid=byCenterPointRadius_2, other=thicken)
code_block_6 = CodeBlock { -15; }
byCoordinates_8 = Vector.ByCoordinates(x=code_block_6, y=code_block_6)
translate_2 = Geometry.Translate(geometry=difference, direction=byCoordinates_8)
select_model_elements = DSModelElementsSelection()  # 4 picked in the model
getLocation = Element.GetLocation(element=select_model_elements)
byJoinedCurves = PolyCurve.ByJoinedCurves(curves=getLocation)
byPatch_3 = Surface.ByPatch(closedCurve=byJoinedCurves)
select_model_elements_2 = DSModelElementsSelection()  # 4 picked in the model
getLocation_2 = Element.GetLocation(element=select_model_elements_2)
byJoinedCurves_2 = PolyCurve.ByJoinedCurves(curves=getLocation_2)
byPatch_4 = Surface.ByPatch(closedCurve=byJoinedCurves_2)
join_2 = List.Join(list0=byPatch_3, list1=byPatch_4)
byUnion_2 = Surface.ByUnion(surfaces=join_2)
perimeterCurves_2 = Surface.PerimeterCurves(surface=byUnion_2)
difference_2 = Surface.Difference(surface=byPatch_3, others=byPatch_4)
code_block_7 = CodeBlock { 20; }
byCoordinates_9 = Vector.ByCoordinates(x=code_block_7, y=code_block_7)
translate_3 = Geometry.Translate(geometry=difference_2, direction=byCoordinates_9)
