# Dynamo graph Landscape With Random Vegetation.dyn (Dynamo 2.10.1.3976)
# packages: spring nodes 204.1.0, Orchid 230.0.3.7536

select_model_element = DSModelElementSelection()  # 1 picked in the model
points = Topography.Points(topography=select_model_element)
X = Point.X()  # unwired: point
sortByFunction = List.SortByFunction(list=points, sortFunction=X)
all = Orchid.RevitProject.Elements.FamilyType.All()
name = Category.Name(category=all.Category)
code_block = CodeBlock { "Planting"; }
indexOf = List.IndexOf(list=name, element=code_block)
getItemAtIndex = List.GetItemAtIndex(list=all.FamilyType, index=indexOf)
identity = Object.Identity(object=getItemAtIndex)
density = DoubleSlider(191, range=100..1000 step 1)
mesh = Topography.Mesh(topography=select_model_element)
ꟿ_mesh_topolysurface = Custom[ꟿ Mesh.ToPolySurface](mesh=mesh)  # package spring nodes; Converts a Dynamo mesh to a polysurface. By default the node is single threaded, but if you specify a higher number of threads in the `NUMTHREAD` input, the node will run multi-threaded to speed up the conversion. *WARNING* Using multi-threaded code with Dynamo's geometry kernel may crash Revit in some cases.
byGeometry = BoundingBox.ByGeometry(geom=ꟿ_mesh_topolysurface)
minPoint = BoundingBox.MinPoint(boundingBox=byGeometry)
X_2 = Point.X(point=minPoint)
maxPoint = BoundingBox.MaxPoint(boundingBox=byGeometry)
X_3 = Point.X(point=maxPoint)
seed1 = DoubleSlider(161.3, range=-1000..1000 step 0.1)
randomList = Math.RandomList(amount=density, value1=X_2, value2=X_3, seed=seed1)
Y = Point.Y(point=minPoint)
Y_2 = Point.Y(point=maxPoint)
seed2 = DoubleSlider(766.2, range=-1000..1000 step 0.1)
randomList_2 = Math.RandomList(amount=density, value1=Y, value2=Y_2, seed=seed2)
Z = Point.Z(point=maxPoint)
byCoordinates = Point.ByCoordinates(x=randomList, y=randomList_2, z=Z)
flatten = List.Flatten(list=byCoordinates)
Z_2 = Point.Z(point=minPoint)
byCoordinates_2 = Point.ByCoordinates(x=randomList, y=randomList_2, z=Z_2)
flatten_2 = List.Flatten(list=byCoordinates_2)
byStartPointEndPoint = Line.ByStartPointEndPoint(startPoint=flatten, endPoint=flatten_2)
intersect = Geometry.Intersect(geometry=byStartPointEndPoint@L1, other=ꟿ_mesh_topolysurface)
code_block_2 = CodeBlock { false; }
clean = List.Clean(list=intersect, preserveIndices=code_block_2)
flatten_3 = List.Flatten(list=clean)
count = List.Count(list=flatten_3)
count_2 = List.Count(list=identity)
code_block_3 = CodeBlock(x=count, y=count_2) { x / y; }
ceiling = Math.Ceiling(number=code_block_3)
ofRepeatedItem = List.OfRepeatedItem(item=identity, amount=ceiling)
flatten_4 = List.Flatten(list=ofRepeatedItem)
shuffle = List.Shuffle(list=flatten_4)
byPoint = FamilyInstance.ByPoint(familyType=shuffle, point=flatten_3)
