# Dynamo graph Parametric Layout of Park Furniture.dyn (Dynamo 2.3.1.11775)

code_block = CodeBlock { "Parametric Layout of Park Furniture"; }
byName = Family.ByName(name=code_block)
types = Family.Types(family=byName)
select_model_element = DSModelElementSelection()  # 1 picked in the model
getLocation = Element.GetLocation(element=select_model_element)
length = Curve.Length(curve=getLocation)
boundingBox = Element.BoundingBox(element=types)
toCuboid = BoundingBox.ToCuboid(boundingBox=boundingBox)
width = Cuboid.Width(cuboid=toCuboid)
length_2 = Cuboid.Length(cuboid=toCuboid)
join = List.Join(list0=width, list1=length_2)
maximumItem = List.MaximumItem(list=join)
element_dis = DoubleSlider(2, range=0..10 step 1)
code_block_2 = CodeBlock(x=maximumItem, y=element_dis) { x+y; }
range = Range(end=length, step=code_block_2)
pointAtSegmentLength = Curve.PointAtSegmentLength(curve=getLocation, segmentLength=range)
X = Point.X(point=pointAtSegmentLength)
Y = Point.Y(point=pointAtSegmentLength)
Z = Point.Z(point=pointAtSegmentLength)
byCoordinates = FamilyInstance.ByCoordinates(familyType=types, x=X, y=Y, z=Z, lacing=Longest)
code_block_3 = CodeBlock { 0; }
number_slider = DoubleSlider(49, range=1..720 step 1)
count = List.Count(list=range)
code_block_4 = CodeBlock { 1; }
sub = count - code_block_4
div = number_slider / sub
range_2 = Range(start=code_block_3, end=number_slider, step=div)
radiansToDegrees = Math.RadiansToDegrees(radians=range_2)
setRotation = FamilyInstance.SetRotation(familyInstance=byCoordinates, degree=radiansToDegrees)
