# Dynamo graph Parametrically controlled Solar Panaels.dyn (Dynamo 2.10.1.3976)
# packages: LunchBox for Dynamo 2018.7.6

number_slider = DoubleSlider(1, range=0..100 step 0.1)
number_slider_2 = DoubleSlider(1, range=0..100 step 0.1)
number_slider_3 = DoubleSlider(1.8, range=0..100 step 0.1)
byCoordinates = Point.ByCoordinates(x=number_slider, y=number_slider_2, z=number_slider_3)
number_slider_4 = DoubleSlider(2.7, range=0..100 step 0.1)
number_slider_5 = DoubleSlider(4.4, range=0..100 step 0.1)
number_slider_6 = DoubleSlider(1, range=0..100 step 0.1)
byCoordinates_2 = Point.ByCoordinates(x=number_slider_4, y=number_slider_5, z=number_slider_6)
number_slider_7 = DoubleSlider(0, range=0..100 step 0.1)
number_slider_8 = DoubleSlider(11, range=0..100 step 0.1)
number_slider_9 = DoubleSlider(1.3, range=0..100 step 0.1)
byCoordinates_3 = Point.ByCoordinates(x=number_slider_7, y=number_slider_8, z=number_slider_9)
number_slider_10 = DoubleSlider(1.1, range=0..100 step 0.1)
number_slider_11 = DoubleSlider(30.9, range=0..100 step 0.1)
number_slider_12 = DoubleSlider(0, range=0..100 step 0.1)
byCoordinates_4 = Point.ByCoordinates(x=number_slider_10, y=number_slider_11, z=number_slider_12)
list_create = List.Create(item0=byCoordinates, item1=byCoordinates_2, item2=byCoordinates_3, item3=byCoordinates_4)
byControlPoints = NurbsCurve.ByControlPoints(points=list_create)
number_slider_13 = DoubleSlider(50.7, range=0..100 step 0.1)
number_slider_14 = DoubleSlider(1, range=0..100 step 0.1)
number_slider_15 = DoubleSlider(0, range=0..100 step 0.1)
byCoordinates_5 = Point.ByCoordinates(x=number_slider_13, y=number_slider_14, z=number_slider_15)
byStartPointEndPoint = Line.ByStartPointEndPoint(startPoint=byCoordinates, endPoint=byCoordinates_5)
number_slider_16 = DoubleSlider(30.7, range=0..100 step 0.1)
number_slider_17 = DoubleSlider(0, range=0..100 step 0.1)
byCoordinates_6 = Point.ByCoordinates(x=number_slider_13, y=number_slider_16, z=number_slider_17)
byStartPointEndPoint_2 = Line.ByStartPointEndPoint(startPoint=byCoordinates_4, endPoint=byCoordinates_6)
number_slider_18 = DoubleSlider(4.4, range=0..100 step 0.1)
number_slider_19 = DoubleSlider(1, range=0..100 step 0.1)
byCoordinates_7 = Point.ByCoordinates(x=number_slider_13, y=number_slider_18, z=number_slider_19)
number_slider_20 = DoubleSlider(11, range=0..100 step 0.1)
number_slider_21 = DoubleSlider(0.5, range=0..100 step 0.1)
byCoordinates_8 = Point.ByCoordinates(x=number_slider_13, y=number_slider_20, z=number_slider_21)
list_create_2 = List.Create(item0=byCoordinates_5, item1=byCoordinates_7, item2=byCoordinates_8, item3=byCoordinates_6)
code_block = CodeBlock { 2; }
byControlPoints_2 = NurbsCurve.ByControlPoints(points=list_create_2, degree=code_block)
list_create_3 = List.Create(item0=byControlPoints, item1=byStartPointEndPoint, item2=byStartPointEndPoint_2, item3=byControlPoints_2)
byJoinedCurves = PolyCurve.ByJoinedCurves(curves=list_create_3)
byPatch = Surface.ByPatch(closedCurve=byJoinedCurves)
number_slider_22 = DoubleSlider(5, range=1..100 step 1)
number_slider_23 = DoubleSlider(7, range=1..100 step 1)
divideSurfaceUV = Geometry.Surfaces.DivideSurfaceUV(surface=byPatch, UDivision=number_slider_22, VDivision=number_slider_23)
number_slider_24 = DoubleSlider(1, range=1..10 step 1)
byCoordinates_9 = Vector.ByCoordinates(z=number_slider_24)
number_slider_25 = DoubleSlider(2, range=1..10 step 1)
byStartPointDirectionLength = Line.ByStartPointDirectionLength(startPoint=divideSurfaceUV.Points, direction=byCoordinates_9, length=number_slider_25)
endPoint = Curve.EndPoint(curve=byStartPointDirectionLength)
code_block_2 = CodeBlock { 1; }
byCoordinates_10 = Vector.ByCoordinates(z=code_block_2)
number_slider_26 = DoubleSlider(0.913, range=-1.387..100 step 0.1)
number_slider_27 = DoubleSlider(48.611, range=-532.791..100 step 0.1)
number_slider_28 = DoubleSlider(29.333, range=0..100 step 0.1)
byCoordinates_11 = Point.ByCoordinates(x=number_slider_26, y=number_slider_27, z=number_slider_28)
byTwoPoints = Vector.ByTwoPoints(start=endPoint, end=byCoordinates_11)
byOriginXAxisYAxis = Plane.ByOriginXAxisYAxis(origin=endPoint, xAxis=byCoordinates_10, yAxis=byTwoPoints)
normal = Plane.Normal(plane=byOriginXAxisYAxis)
byOriginXAxisYAxis_2 = Plane.ByOriginXAxisYAxis(origin=endPoint, xAxis=normal, yAxis=byTwoPoints)
normal_2 = Plane.Normal(plane=byOriginXAxisYAxis_2)
byOriginXAxisYAxis_3 = Plane.ByOriginXAxisYAxis(origin=endPoint, xAxis=normal, yAxis=normal_2)
number_slider_29 = DoubleSlider(3.5, range=0..5 step 0.1)
number_slider_30 = DoubleSlider(2.1, range=0..5 step 0.1)
byWidthLength = Rectangle.ByWidthLength(plane=byOriginXAxisYAxis_3, width=number_slider_29, length=number_slider_30)
byPatch_2 = Surface.ByPatch(closedCurve=byWidthLength)
