# Dynamo graph Pratt Truss.dyn (Dynamo 2.10.1.3976)

number_slider = DoubleSlider(0, range=0..100 step 1)
byCoordinates = Point.ByCoordinates(x=number_slider)
number_slider_2 = DoubleSlider(2, range=0..100 step 1)
number_slider_3 = DoubleSlider(10, range=0..100 step 1)
byCoordinates_2 = Point.ByCoordinates(x=number_slider_2, y=number_slider_3)
join = List.Join(list0=byCoordinates, list1=byCoordinates_2)
number_slider_4 = DoubleSlider(27, range=0..100 step 1)
byCoordinates_3 = Point.ByCoordinates(x=number_slider_4)
number_slider_5 = DoubleSlider(25, range=0..100 step 1)
number_slider_6 = DoubleSlider(10, range=0..100 step 1)
byCoordinates_4 = Point.ByCoordinates(x=number_slider_5, y=number_slider_6)
join_2 = List.Join(list0=byCoordinates_3, list1=byCoordinates_4)
prattTruss = Custom[PrattTruss](points=join, points_2=join_2)  # Creats a pratt truss
