# Dynamo graph Randomness.dyn (Dynamo 2.10.1.3976)

number_slider = DoubleSlider(28, range=0..100 step 1)
number_slider_2 = DoubleSlider(0, range=0..100 step 1)
random = Math.Random(value1=number_slider, value2=number_slider_2)
random_2 = Math.Random()  # unwired: value1, value2, seed
number_slider_3 = DoubleSlider(28, range=0..100 step 1)
random_3 = Math.Random(seed=number_slider_3)
number_slider_4 = DoubleSlider(3, range=0..100 step 1)
randomList = Math.RandomList(amount=number_slider_4)
number_slider_5 = DoubleSlider(91, range=0..100 step 1)
number_slider_6 = DoubleSlider(0, range=0..100 step 1)
number_slider_7 = DoubleSlider(23, range=0..100 step 1)
number_slider_8 = DoubleSlider(15, range=0..100 step 1)
randomList_2 = Math.RandomList(amount=number_slider_5, value1=number_slider_6, value2=number_slider_7, seed=number_slider_8)
number_slider_9 = DoubleSlider(0, range=0..100 step 1)
number_slider_10 = DoubleSlider(23, range=0..100 step 1)
number_slider_11 = DoubleSlider(1, range=0..100 step 1)
randomList_3 = Math.RandomList(amount=number_slider_5, value1=number_slider_9, value2=number_slider_10, seed=number_slider_11)
byCoordinates = Point.ByCoordinates(x=randomList_2, y=randomList_3)
code_block = CodeBlock { 1000000; }
number_slider_12 = DoubleSlider(0, range=0..100 step 1)
number_slider_13 = DoubleSlider(10, range=0..1000000 step 1)
number_slider_14 = DoubleSlider(41, range=0..100 step 1)
randomList_4 = Math.RandomList(amount=code_block, value1=number_slider_12, value2=number_slider_13, seed=number_slider_14)
round = Math.Round(number=randomList_4)
code_block_2 = CodeBlock { 1; }
range = Range(start=number_slider_12, end=number_slider_13, step=code_block_2)
allIndicesOf = List.AllIndicesOf(list=round, item=range)
count = List.Count(list=allIndicesOf@L2)
floor = Math.Floor(number=randomList_4)
round_2 = Math.Round(number=floor)
allIndicesOf_2 = List.AllIndicesOf(list=round_2, item=range)
count_2 = List.Count(list=allIndicesOf_2@L2)
