# Dynamo graph Sectioning a Building Parametrically.dyn (Dynamo 2.10.1.3976)

code_block = CodeBlock { [0,0,6,17.5,11,15,9,14]; [0,3,2,2,14,5,9,-1]; }
byCoordinates = Point.ByCoordinates(x=code_block.out0, y=code_block.out1)
code_block_2 = CodeBlock { [3,1,4.5,1,3,4,5,3]; }
byCenterPointRadius = Sphere.ByCenterPointRadius(centerPoint=byCoordinates, radius=code_block_2)
XY = Plane.XY()
split = Geometry.Split(geometry=byCenterPointRadius, other=XY)
firstItem = List.FirstItem(list=split@L2)
byUnion = Solid.ByUnion(solids=firstItem)
centroid = Solid.Centroid(solid=byUnion)
X = Point.X(point=centroid)
byGeometry = BoundingBox.ByGeometry(geom=byUnion)
maxPoint = BoundingBox.MaxPoint(boundingBox=byGeometry)
Y = Point.Y(point=maxPoint)
byCoordinates_2 = Point.ByCoordinates(x=X, y=Y)
minPoint = BoundingBox.MinPoint(boundingBox=byGeometry)
Y_2 = Point.Y(point=minPoint)
byCoordinates_3 = Point.ByCoordinates(x=X, y=Y_2)
byStartPointEndPoint = Line.ByStartPointEndPoint(startPoint=byCoordinates_2, endPoint=byCoordinates_3)
sections = DoubleSlider(24, range=1..100 step 1)
pointsAtEqualChordLength = Curve.PointsAtEqualChordLength(curve=byStartPointEndPoint, divisions=sections)
code_block_3 = CodeBlock { -90; }
code_block_4 = CodeBlock { 1; }
byCoordinates_4 = Vector.ByCoordinates(y=code_block_3, z=code_block_4)
code_block_5 = CodeBlock { 1; }
byCoordinates_5 = Vector.ByCoordinates(x=code_block_5)
byOriginNormalXAxis = Plane.ByOriginNormalXAxis(origin=pointsAtEqualChordLength, normal=byCoordinates_4, xAxis=byCoordinates_5)
intersect = Geometry.Intersect(geometry=byUnion, other=byOriginNormalXAxis)
byJoinedSurfaces = PolySurface.ByJoinedSurfaces(surfaces=intersect@L2)
count = List.Count(list=byJoinedSurfaces)
Z = Point.Z(point=maxPoint)
code_block_6 = CodeBlock(z=Z) { z + 2; }
byPlane = CoordinateSystem.ByPlane(plane=byOriginNormalXAxis)
XY_2 = Plane.XY()
number_slider = DoubleSlider(27, range=0..100 step 1)
code_block_7 = CodeBlock { 0; }
byGeometry_2 = BoundingBox.ByGeometry(geom=byJoinedSurfaces@L1)
maxPoint_2 = BoundingBox.MaxPoint(boundingBox=byGeometry_2)
Z_2 = Point.Z(point=maxPoint_2)
count_2 = List.Count(list=Z_2)
code_block_8 = CodeBlock(x=count_2) { x - 1; }
range = Range(end=code_block_8)
chop = List.Chop(list=Z_2@L2, lengths=range@L1, lacing=Longest)
firstItem_2 = List.FirstItem(list=chop@L3)
code_block_9 = CodeBlock { 1; }
dropItems = List.DropItems(list=firstItem_2, amount=code_block_9)
count_3 = List.Count(list=dropItems@L2)
number_slider_2 = DoubleSlider(1, range=1..10 step 1)
code_block_10 = CodeBlock(x=count_3, dis=number_slider_2) { x * dis; }
sum = Math.Sum(values=dropItems@L2)
add = code_block_10 + sum
join = List.Join(list0=code_block_7, list1=add)
byCoordinates_6 = Point.ByCoordinates(x=number_slider, y=join)
X_2 = Point.X(point=byCoordinates_6)
Y_3 = Point.Y(point=byCoordinates_6)
translate = Geometry.Translate(geometry=XY_2, xTranslation=X_2, yTranslation=Y_3)
byPlane_2 = CoordinateSystem.ByPlane(plane=translate)
transform = Geometry.Transform(geometry=byJoinedSurfaces, fromCoordinateSystem=byPlane, contextCoordinateSystem=byPlane_2)
