# Dynamo graph Surface Triangulation.dyn (Dynamo 2.10.1.3976)
# packages: LunchBox for Dynamo 2018.7.6

code_block = CodeBlock { [0,12,24,36]; []; [-2,0,0,2]; }
byCoordinates = Point.ByCoordinates(x=code_block.out0, z=code_block.out2)
code_block_2 = CodeBlock { [0,12,24,36]; 18; [-1,0,0,-1]; }
byCoordinates_2 = Point.ByCoordinates(x=code_block_2.out0, y=code_block_2.out1, z=code_block_2.out2)
code_block_3 = CodeBlock { [0,12,24,36]; 36; [-2,0,0,-2]; }
byCoordinates_3 = Point.ByCoordinates(x=code_block_3.out0, y=code_block_3.out1, z=code_block_3.out2)
list_create = List.Create(item0=byCoordinates, item1=byCoordinates_2, item2=byCoordinates_3)
byPoints = NurbsSurface.ByPoints(points=list_create)
number_slider = DoubleSlider(8, range=0..30 step 1)
number_slider_2 = DoubleSlider(5, range=0..115 step 1)
divideSurfaceUV = Geometry.Surfaces.DivideSurfaceUV(surface=byPoints, UDivision=number_slider, VDivision=number_slider_2)
code_block_4 = CodeBlock { 1; }
dropItems = List.DropItems(list=divideSurfaceUV.Points, amount=code_block_4)
code_block_5 = CodeBlock { 1; }
dropItems_2 = List.DropItems(list=dropItems@L2, amount=code_block_5)
flatten = List.Flatten(list=dropItems_2)
code_block_6 = CodeBlock { -1; }
dropItems_3 = List.DropItems(list=divideSurfaceUV.Points, amount=code_block_6)
code_block_7 = CodeBlock { 1; }
dropItems_4 = List.DropItems(list=dropItems_3@L2, amount=code_block_7)
flatten_2 = List.Flatten(list=dropItems_4)
code_block_8 = CodeBlock { -1; }
dropItems_5 = List.DropItems(list=dropItems_3@L2, amount=code_block_8)
flatten_3 = List.Flatten(list=dropItems_5)
list_create_2 = List.Create(item0=flatten, item1=flatten_2, item2=flatten_3)
transpose = List.Transpose(lists=list_create_2)
byPoints_2 = Polygon.ByPoints(points=transpose)
byPatch = Surface.ByPatch(closedCurve=byPoints_2)
perimeterCurves = Surface.PerimeterCurves(surface=byPatch)
startPoint = Curve.StartPoint(curve=perimeterCurves)
firstItem = List.FirstItem(list=startPoint@L2)
lastItem = List.LastItem(list=startPoint@L2)
code_block_9 = CodeBlock { 1; }
getItemAtIndex = List.GetItemAtIndex(list=startPoint@L2, index=code_block_9)
byThreePoints = Plane.ByThreePoints(origin=firstItem, planePoint=lastItem, xAxisPoint=getItemAtIndex)
contextCoordinateSystem = Geometry.ContextCoordinateSystem(geometry=byThreePoints)
code_block_10 = CodeBlock { -1; }
dropItems_6 = List.DropItems(list=divideSurfaceUV.Points, amount=code_block_10)
code_block_11 = CodeBlock { -1; }
dropItems_7 = List.DropItems(list=dropItems_6@L2, amount=code_block_11)
flatten_4 = List.Flatten(list=dropItems_7)
code_block_12 = CodeBlock { 1; }
dropItems_8 = List.DropItems(list=divideSurfaceUV.Points, amount=code_block_12)
code_block_13 = CodeBlock { -1; }
dropItems_9 = List.DropItems(list=dropItems_8@L2, amount=code_block_13)
flatten_5 = List.Flatten(list=dropItems_9)
code_block_14 = CodeBlock { 1; }
dropItems_10 = List.DropItems(list=dropItems_8@L2, amount=code_block_14)
flatten_6 = List.Flatten(list=dropItems_10)
list_create_3 = List.Create(item0=flatten_4, item1=flatten_5, item2=flatten_6)
transpose_2 = List.Transpose(lists=list_create_3)
firstItem_2 = List.FirstItem(list=transpose_2@L2)
X = Point.X(point=firstItem_2)
Y = Point.Y(point=firstItem_2)
byCoordinates_4 = Point.ByCoordinates(x=X, y=Y)
X_2 = Point.X(point=divideSurfaceUV.Points)
flatten_7 = List.Flatten(list=X_2)
maximumItem = List.MaximumItem(list=flatten_7)
code_block_15 = CodeBlock(x=maximumItem) { x; }
code_block_16 = CodeBlock(p_x=X, x=code_block_15) { p_x - x; }
Y_2 = Point.Y(point=divideSurfaceUV.Points)
flatten_8 = List.Flatten(list=Y_2)
maximumItem_2 = List.MaximumItem(list=flatten_8)
code_block_17 = CodeBlock(y=maximumItem_2) { y + 20; }
code_block_18 = CodeBlock(y=code_block_17, p_y=Y) { y + p_y; }
translate = Geometry.Translate(geometry=byCoordinates_4, xTranslation=code_block_16, yTranslation=code_block_18)
code_block_19 = CodeBlock { 1; }
byCoordinates_5 = Vector.ByCoordinates(z=code_block_19)
byOriginNormal = Plane.ByOriginNormal(origin=translate, normal=byCoordinates_5)
contextCoordinateSystem_2 = Geometry.ContextCoordinateSystem(geometry=byOriginNormal)
transform = Geometry.Transform(geometry=byPatch, fromCoordinateSystem=contextCoordinateSystem, contextCoordinateSystem=contextCoordinateSystem_2)
byPoints_3 = Polygon.ByPoints(points=transpose_2)
byPatch_2 = Surface.ByPatch(closedCurve=byPoints_3)
perimeterCurves_2 = Surface.PerimeterCurves(surface=byPatch_2)
startPoint_2 = Curve.StartPoint(curve=perimeterCurves_2)
firstItem_3 = List.FirstItem(list=startPoint_2@L2)
lastItem_2 = List.LastItem(list=startPoint_2@L2)
code_block_20 = CodeBlock { 1; }
getItemAtIndex_2 = List.GetItemAtIndex(list=startPoint_2@L2, index=code_block_20)
byThreePoints_2 = Plane.ByThreePoints(origin=firstItem_3, planePoint=lastItem_2, xAxisPoint=getItemAtIndex_2)
contextCoordinateSystem_3 = Geometry.ContextCoordinateSystem(geometry=byThreePoints_2)
firstItem_4 = List.FirstItem(list=transpose_2@L2)
X_3 = Point.X(point=firstItem_4)
Y_3 = Point.Y(point=firstItem_4)
byCoordinates_6 = Point.ByCoordinates(x=X_3, y=Y_3)
X_4 = Point.X(point=divideSurfaceUV.Points)
flatten_9 = List.Flatten(list=X_4)
maximumItem_3 = List.MaximumItem(list=flatten_9)
code_block_21 = CodeBlock(x=maximumItem_3) { x + 50; }
code_block_22 = CodeBlock(x=code_block_21, p_x=X_3) { x + p_x; }
Y_4 = Point.Y(point=divideSurfaceUV.Points)
flatten_10 = List.Flatten(list=Y_4)
maximumItem_4 = List.MaximumItem(list=flatten_10)
code_block_23 = CodeBlock(y=maximumItem_4) { y + 20; }
code_block_24 = CodeBlock(y=code_block_23, p_y=Y_3) { y + p_y; }
translate_2 = Geometry.Translate(geometry=byCoordinates_6, xTranslation=code_block_22, yTranslation=code_block_24)
code_block_25 = CodeBlock { 1; }
byCoordinates_7 = Vector.ByCoordinates(z=code_block_25)
byOriginNormal_2 = Plane.ByOriginNormal(origin=translate_2, normal=byCoordinates_7)
contextCoordinateSystem_4 = Geometry.ContextCoordinateSystem(geometry=byOriginNormal_2)
transform_2 = Geometry.Transform(geometry=byPatch_2, fromCoordinateSystem=contextCoordinateSystem_3, contextCoordinateSystem=contextCoordinateSystem_4)
