# Dynamo graph Vierendeel Truss.dyn (Dynamo 2.10.1.3976)

byCoordinates = Point.ByCoordinates()
number_slider = DoubleSlider(28.1, range=0..100 step 0.1)
number_slider_2 = DoubleSlider(-0.017, range=-0.017..100 step 0.1)
byCoordinates_2 = Point.ByCoordinates(x=number_slider, y=number_slider_2)
byStartPointEndPoint = Line.ByStartPointEndPoint(startPoint=byCoordinates, endPoint=byCoordinates_2)
segments = DoubleSlider(5, range=1..100 step 1)
pointsAtEqualSegmentLength = Curve.PointsAtEqualSegmentLength(curve=byStartPointEndPoint, divisions=segments)
join = List.Join(list0=byCoordinates, list1=pointsAtEqualSegmentLength, list2=byCoordinates_2)
length = Curve.Length(curve=byStartPointEndPoint)
depth_factor = DoubleSlider(12, range=1..100 step 1)
code_block = CodeBlock(len=length, Factor=depth_factor) { -len/Factor; }
byCoordinates_3 = Vector.ByCoordinates(z=code_block)
translate = Geometry.Translate(geometry=join, direction=byCoordinates_3)
byStartPointEndPoint_2 = Line.ByStartPointEndPoint(startPoint=join, endPoint=translate)
python_script = Python(IN[0]=translate)  # CPython3
# ---------- python_script.python (10 lines) ----------
points = IN[0]

OUT = []
i = 1
for p in points:
    if i == len(points):
        break
    else:
        OUT.append([p,points[i]])
        i += 1
# ----------------------------------------
code_block_2 = CodeBlock { 0; }
getItemAtIndex = List.GetItemAtIndex(list=python_script@L2, index=code_block_2)
code_block_3 = CodeBlock { 1; }
getItemAtIndex_2 = List.GetItemAtIndex(list=python_script@L2, index=code_block_3)
byStartPointEndPoint_3 = Line.ByStartPointEndPoint(startPoint=getItemAtIndex, endPoint=getItemAtIndex_2)
code_block_4 = CodeBlock { 1; }
dropItems = List.DropItems(list=join, amount=code_block_4)
code_block_5 = CodeBlock { -1; }
dropItems_2 = List.DropItems(list=join, amount=code_block_5)
byStartPointEndPoint_4 = Line.ByStartPointEndPoint(startPoint=dropItems, endPoint=dropItems_2)
