# Dynamo graph Wind-Swept Grass Patch.dyn (Dynamo 2.10.1.3976)
# packages: spring nodes 204.1.0

count = DoubleSlider(302, range=0..1000 step 1)
select_model_element = DSModelElementSelection()  # 1 picked in the model
mesh = Topography.Mesh(topography=select_model_element)
ꟿ_mesh_topolysurface = Custom[ꟿ Mesh.ToPolySurface](mesh=mesh)  # package spring nodes; Converts a Dynamo mesh to a polysurface. By default the node is single threaded, but if you specify a higher number of threads in the `NUMTHREAD` input, the node will run multi-threaded to speed up the conversion. *WARNING* Using multi-threaded code with Dynamo's geometry kernel may crash Revit in some cases.
surfaces = PolySurface.Surfaces(polySurface=ꟿ_mesh_topolysurface)
flatten = List.Flatten(list=surfaces)
byGeometry = BoundingBox.ByGeometry(geom=flatten)
minPoint = BoundingBox.MinPoint(boundingBox=byGeometry)
X = Point.X(point=minPoint)
maxPoint = BoundingBox.MaxPoint(boundingBox=byGeometry)
X_2 = Point.X(point=maxPoint)
random_seed = DoubleSlider(83, range=-1000..1000 step 1)
randomList = Math.RandomList(amount=count, value1=X, value2=X_2, seed=random_seed)
Y = Point.Y(point=minPoint)
Y_2 = Point.Y(point=maxPoint)
code_block = CodeBlock(x=random_seed) { x + 2; }
randomList_2 = Math.RandomList(amount=count, value1=Y, value2=Y_2, seed=code_block)
Z = Point.Z(point=minPoint)
byCoordinates = Point.ByCoordinates(x=randomList, y=randomList_2, z=Z)
code_block_2 = CodeBlock { 1; }
byCoordinates_2 = Vector.ByCoordinates(z=code_block_2)
project = Point.Project(point=byCoordinates@L1, baseGeometry=ꟿ_mesh_topolysurface, projectionDirection=byCoordinates_2)
flatten_2 = List.Flatten(list=project)
surfaces_2 = PolySurface.Surfaces(polySurface=ꟿ_mesh_topolysurface)
perimeterCurves = Surface.PerimeterCurves(surface=surfaces_2)
endPoint = Curve.EndPoint(curve=perimeterCurves)
X_3 = Point.X(point=endPoint)
Y_3 = Point.Y(point=endPoint)
byCoordinates_3 = Point.ByCoordinates(x=X_3, y=Y_3)
byPoints = Polygon.ByPoints(points=byCoordinates_3)
flatten_3 = List.Flatten(list=byPoints)
X_4 = Point.X(point=flatten_2)
Y_4 = Point.Y(point=flatten_2)
byCoordinates_4 = Point.ByCoordinates(x=X_4, y=Y_4)
containmentTest = Polygon.ContainmentTest(polygon=flatten_3@L1, point=byCoordinates_4)
filterByBoolMask = List.FilterByBoolMask(list=flatten_2, mask=containmentTest@L2)
watch = Watch(filterByBoolMask.in)
flatten_4 = List.Flatten(list=watch)
identity = Object.Identity(object=surfaces_2)
normalAtPoint = Surface.NormalAtPoint(surface=identity@L1, point=watch@L2)
flatten_5 = List.Flatten(list=normalAtPoint)
root_tangency = DoubleSlider(0.186, range=0..1 step 0.001)
translate = Geometry.Translate(geometry=flatten_4, direction=flatten_5, distance=root_tangency)
code_block_3 = CodeBlock { 1; }
byCoordinates_5 = Vector.ByCoordinates(z=code_block_3)
grass_base_height = DoubleSlider(1, range=0.001..1 step 0.01)
code_block_4 = CodeBlock(root=root_tangency, grass_base=grass_base_height) { root - grass_base; }
code_block_5 = CodeBlock(x=code_block_4) { x * -1; }
grass_random_variation = DoubleSlider(0.206, range=0..1 step 0.001)
code_block_6 = CodeBlock(x=grass_random_variation) { x; }
code_block_7 = CodeBlock(x=code_block_6) { -0.5 * x; }
number_slider = DoubleSlider(8.4, range=0..100 step 0.1)
randomList_3 = Math.RandomList(amount=count, value1=code_block_7, value2=code_block_6, seed=number_slider)
code_block_8 = CodeBlock(x=code_block_5, y=randomList_3) { x + y; }
translate_2 = Geometry.Translate(geometry=translate, direction=byCoordinates_5, distance=code_block_8)
code_block_9 = CodeBlock { 1; }
byCoordinates_6 = Vector.ByCoordinates(y=code_block_9)
time = DoubleSlider(62.8, range=0..100 step 0.1)
number_slider_2 = DoubleSlider(161.124, range=0..162.323 step 0.1)
number_slider_3 = DoubleSlider(81.55, range=0..100 step 0.1)
number_slider_4 = DoubleSlider(4.639, range=0..100 step 0.1)
byCoordinates_7 = Point.ByCoordinates(x=number_slider_2, y=number_slider_3, z=number_slider_4)
byTwoPoints = Vector.ByTwoPoints(start=byCoordinates_7, end=translate_2)
length = Vector.Length(vector=byTwoPoints)
code_block_10 = CodeBlock(x=time, y=length) { x + y; }
python_script = Python(IN[0]=code_block_10)  # CPython3
# ---------- python_script.python (8 lines) ----------
import math

time = IN[0]

OUT = []
for t in time:

    OUT.append(math.sin(t))
# ----------------------------------------
code_block_11 = CodeBlock(x=python_script) { x * 0.2; }
translate_3 = Geometry.Translate(geometry=translate_2, direction=byCoordinates_6, distance=code_block_11)
list_create = List.Create(item0=flatten_4, item1=flatten_4, item2=translate, item3=translate_3)
transpose = List.Transpose(lists=list_create)
byControlPoints = NurbsCurve.ByControlPoints(points=transpose)
code_block_12 = CodeBlock { 2; }
byControlPoints_2 = NurbsCurve.ByControlPoints(points=transpose, degree=code_block_12)
identity_2 = Object.Identity(object=code_block_5)
byStartPointEndPoint = Line.ByStartPointEndPoint(startPoint=byCoordinates_7, endPoint=translate_2)
