# Dynamo graph Window Example.dyn (Dynamo 2.10.1.3976)
# packages: GenerativeDesign 1.7.3.0

code_block = CodeBlock { 5; }
randomList = Math.RandomList(amount=code_block)
byCoordinates = Vector.ByCoordinates(x=randomList)
ZAxis = Vector.ZAxis()
code_block_2 = CodeBlock(n=code_block, a=code_block) { 0..360..#n+1; a*50; }
rotate = Vector.Rotate(vector=byCoordinates, axis=ZAxis, degrees=code_block_2.out0)
scale = Vector.Scale(vector=rotate, scale_factor=code_block_2.out1)
asPoint = Vector.AsPoint(vector=scale)
byPoints = Polygon.ByPoints(points=asPoint)
code_block_3 = CodeBlock { 200; }
extrudeAsSolid = Curve.ExtrudeAsSolid(curve=byPoints, distance=code_block_3)
faces = Topology.Faces(topology=extrudeAsSolid)
surfaceGeometry = Face.SurfaceGeometry(face=faces)
normalAtParameter = Surface.NormalAtParameter(surface=surfaceGeometry)
Z = Vector.Z(vector=normalAtParameter)
code_block_4 = CodeBlock(a=Z) { a==0; }
filterByBoolMask = List.FilterByBoolMask(list=surfaceGeometry, mask=code_block_4)
remember = Data.Remember()  # unwired: arg0
identity = Object.Identity(object=remember)
code_block_5 = CodeBlock { 1; }
identity_2 = Object.Identity(object=code_block_5)
byWidthLength = Rectangle.ByWidthLength(width=identity_2, length=identity_2)
byPatch = Surface.ByPatch(closedCurve=byWidthLength)
identity_3 = Object.Identity(object=byPatch)
code_block_6 = CodeBlock { 0..1; }
byIsoCurveOnSurface = Curve.ByIsoCurveOnSurface(baseSurface=identity, direction=code_block_6@L1, parameter=code_block_6@L1)
length = Curve.Length(curve=byIsoCurveOnSurface)
v_spacing = DoubleSlider(7.25, range=0..20 step 0.1)
code_block_7 = CodeBlock(a=length, s=v_spacing) { 0..1..#DSCore.Math.Ceiling(a[0]/s); }
code_block_8 = CodeBlock { 1; }
shiftIndices = List.ShiftIndices(list=code_block_7@L2, amount=code_block_8)
code_block_9 = CodeBlock { 2; }
dropItems = List.DropItems(list=shiftIndices@L2, amount=code_block_9)
code_block_10 = CodeBlock(a=byIsoCurveOnSurface) { a[1][0]; }
code_block_11 = CodeBlock(n=length) { 4 + (0..n[1][0]..12); }
parameterAtSegmentLength = Curve.ParameterAtSegmentLength(curve=code_block_10, segmentLength=code_block_11)
coordinateSystemAtParameter = Surface.CoordinateSystemAtParameter(surface=identity@L2, u=dropItems@@L3, v=parameterAtSegmentLength@L1, lacing=Longest)
identity_4 = Object.Identity(object=coordinateSystemAtParameter)
transpose = List.Transpose(lists=identity_4)
flatten = List.Flatten(list=transpose@L3)
XYPlane = CoordinateSystem.XYPlane(coordinateSystem=flatten)
width = DoubleSlider(0.6, range=0..1 step 0.1)
height = DoubleSlider(5, range=0..12 step 0.1)
code_block_12 = CodeBlock(a=v_spacing, b=width, c=height) { a*b; c; }
scale_2 = CoordinateSystem.Scale(coordinateSystem=flatten, plane=XYPlane, xamount=code_block_12.out0, yamount=code_block_12.c)
transform = Geometry.Transform(geometry=identity_3, cs=scale_2)
byUnion = Surface.ByUnion(surfaces=transform)
difference = Surface.Difference(surface=identity, others=byUnion)
code_block_13 = CodeBlock { Color.ByARGB(200,200,120,120); }
byGeometryColor = Modifiers.GeometryColor.ByGeometryColor(geometry=difference, color=code_block_13)
area = Surface.Area(surface=byUnion)
area_2 = Surface.Area(surface=difference)
code_block_14 = CodeBlock(a=area, b=area_2) { DSCore.Math.Round(DSCore.Math.Sum(a)/DSCore.Math.Sum(b),3); }
