# Dynamo graph quadrilateral-parallelogram.dyn (Dynamo 2.10.1.3976)
# packages: spring nodes 204.1.0

code_block = CodeBlock { [2,2,2,2]; 0; 100; [3,1,7,4]; }
number_slider = DoubleSlider(11, range=0..100 step 1)
python_script = Python(IN[0]=number_slider)  # CPython3
# ---------- python_script.python (15 lines) ----------
from random import randint
max_v = IN[0]
def four_rand_nums (max_v=4):
    if max_v < 4: max_v = 4
    x = False    
    while x == False:
        p1 = randint(0,max_v)
        p2 = randint(0,max_v)
        p3 = randint(0,max_v)
        p4 = randint(0,max_v)

        if len(set([p1,p2,p3,p4])) == 4:
            x = True
            return [p1,p2,p3,p4]
OUT = four_rand_nums(int(max_v))
# ----------------------------------------
randomList = Math.RandomList(amount=code_block.out0, value1=code_block.out1, value2=code_block.out2, seed=python_script)
firstItem = List.FirstItem(list=randomList@L2)
lastItem = List.LastItem(list=randomList@L2)
byCoordinates = Point.ByCoordinates(x=firstItem, y=lastItem)
byPoints = Polygon.ByPoints(points=byCoordinates)
selfIntersections = Polygon.SelfIntersections(polygon=byPoints)
isEmpty = List.IsEmpty(list=selfIntersections)
ꟿ_points_convexhull2d = Custom[ꟿ Points.ConvexHull2D](points=byCoordinates)  # package spring nodes; Computes the XY convex hull of a given set of points based on the monotone chain algorithm.
byPoints_2 = Polygon.ByPoints(points=ꟿ_points_convexhull2d)
if_ = If(test=isEmpty, true=byPoints, false=byPoints_2)
explode = Geometry.Explode(geometry=if_)
code_block_2 = CodeBlock { 1; }
pointsAtEqualChordLength = Curve.PointsAtEqualChordLength(curve=explode, divisions=code_block_2)
flatten = List.Flatten(list=pointsAtEqualChordLength)
byPoints_3 = Polygon.ByPoints(points=flatten)
explode_2 = Geometry.Explode(geometry=byPoints_3)
length = Curve.Length(curve=explode_2)
code_block_3 = CodeBlock(x=length) { [x[0] == x[2], x[1] == x[3]]; }
direction = Line.Direction(line=explode_2)
X = Vector.X(vector=direction)
abs = Math.Abs(number=X)
Y = Vector.Y(vector=direction)
abs_2 = Math.Abs(number=Y)
Z = Vector.Z(vector=direction)
abs_3 = Math.Abs(number=Z)
list_create = List.Create(item0=abs, item1=abs_2, item2=abs_3)
transpose = List.Transpose(lists=list_create)
code_block_4 = CodeBlock(x=transpose) { [x[0] == x[2], x[1] == x[3]]; }
