# Dynamo graph Dynamo Cookie 2022.dyn "Dynamo Cookie" (Dynamo 2.13.1.3887)

byControlPoints = NurbsCurve.ByControlPoints()  # unwired: points
byControlPoints_2 = NurbsCurve.ByControlPoints()  # unwired: points
host_point = Point.ByCoordinates()
number_slider = DoubleSlider(11.7, range=0..100 step 0.1)
byCenterPointRadius = Circle.ByCenterPointRadius(centerPoint=host_point, radius=number_slider)
cookie_shap_control_points_count = DoubleSlider(16, range=5..50 step 1)
pointsAtEqualChordLength = Curve.PointsAtEqualChordLength(curve=byCenterPointRadius, divisions=cookie_shap_control_points_count)
X = Point.X(point=pointsAtEqualChordLength)
Y = Point.Y(point=pointsAtEqualChordLength)
list_create = List.Create(item0=X, item1=Y)
transpose = List.Transpose(lists=list_create)
code_block = CodeBlock { 0; }
code_block_2 = CodeBlock { 1; }
randomList = Math.RandomList(amount=cookie_shap_control_points_count, value1=code_block, value2=code_block_2, seed=cookie_shap_control_points_count)
round = Math.Round(number=randomList)
getItemAtIndex = List.GetItemAtIndex(list=transpose@L2, index=round@L1)
code_block_3 = CodeBlock { -1; 2; }
randomList_2 = Math.RandomList(amount=cookie_shap_control_points_count)
random = Math.Random(value1=code_block_3.out0, value2=code_block_3.out1, seed=randomList_2)
code_block_4 = CodeBlock(points=getItemAtIndex, dif=random) { points + dif; }
replaceItemAtIndex = List.ReplaceItemAtIndex(list=transpose@L2, index=round@L1, item=code_block_4@L1)
firstItem = List.FirstItem(list=replaceItemAtIndex@L2)
lastItem = List.LastItem(list=replaceItemAtIndex@L2)
byCoordinates = Point.ByCoordinates(x=firstItem, y=lastItem)
cookie_curve_degree_at_control = DoubleSlider(2, range=1..10 step 0.5)  # "Cookie Curve Degree at Control Points"
code_block_5 = CodeBlock { 1; }
byControlPoints_3 = NurbsCurve.ByControlPoints(points=byCoordinates, degree=cookie_curve_degree_at_control, closeCurve=code_block_5)
pointsAtEqualChordLength_2 = Curve.PointsAtEqualChordLength(curve=byControlPoints_3, divisions=cookie_shap_control_points_count)
code_block_6 = CodeBlock { 1; }
chop = List.Chop(list=pointsAtEqualChordLength_2, lengths=code_block_6)
cookie_upper_pitch = DoubleSlider(5.5, range=1..6 step 0.5)
code_block_7 = CodeBlock(z=cookie_upper_pitch) { z/2; z; }
byCoordinates_2 = Point.ByCoordinates(z=code_block_7.z)
code_block_8 = CodeBlock { 1; }
insert = List.Insert(list=chop@L2, element=byCoordinates_2, index=code_block_8)
byPoints = NurbsCurve.ByPoints(points=insert)
code_block_9 = CodeBlock { 1; }
pointsAtEqualChordLength_3 = Curve.PointsAtEqualChordLength(curve=byPoints, divisions=code_block_9)
X_2 = Point.X(point=pointsAtEqualChordLength_3)
Y_2 = Point.Y(point=pointsAtEqualChordLength_3)
Z = Point.Z(point=pointsAtEqualChordLength_3)
code_block_10 = CodeBlock(z1=code_block_7.out0, z2=Z) { z1+z2; }
byCoordinates_3 = Point.ByCoordinates(x=X_2, y=Y_2, z=code_block_10)
code_block_11 = CodeBlock { 1; }
insert_2 = List.Insert(list=insert@L2, element=byCoordinates_3@L1, index=code_block_11)
byTwoPoints = Vector.ByTwoPoints(start=pointsAtEqualChordLength_2, end=byCoordinates_2)
cookie_lower_pitch_location = DoubleSlider(1.5, range=1..6 step 0.5)
translate = Geometry.Translate(geometry=pointsAtEqualChordLength_2, direction=byTwoPoints, distance=cookie_lower_pitch_location)
X_3 = Point.X(point=translate)
Y_3 = Point.Y(point=translate)
Z_2 = Point.Z(point=translate)
cookie_lower_pitch = DoubleSlider(4, range=1..6 step 0.5)
code_block_12 = CodeBlock(z=Z_2, h=cookie_lower_pitch) { z+h; }
byCoordinates_4 = Point.ByCoordinates(x=X_3, y=Y_3, z=code_block_12)
code_block_13 = CodeBlock { 1; }
insert_3 = List.Insert(list=insert_2@L2, element=byCoordinates_4@L1, index=code_block_13)
byControlPoints_4 = NurbsCurve.ByControlPoints(points=insert_3)
cookie_shap_control_points_count_2 = DoubleSlider(8, range=1..15 step 1)
pointsAtEqualChordLength_4 = Curve.PointsAtEqualChordLength(curve=byControlPoints_4, divisions=cookie_shap_control_points_count_2)
Z_3 = Point.Z(point=pointsAtEqualChordLength_4)
cookie_body_deff_seed = DoubleSlider(0, range=0..100 step 0.1)
shuffle = List.Shuffle(list=Z_3@L2, seed=cookie_body_deff_seed)
X_4 = Point.X(point=pointsAtEqualChordLength_4)
Y_4 = Point.Y(point=pointsAtEqualChordLength_4)
code_block_14 = CodeBlock { -0.25; 0.5; }
randomList_3 = Math.RandomList(amount=cookie_shap_control_points_count_2)
random_2 = Math.Random(value1=code_block_14.out0, value2=code_block_14.out1, seed=randomList_3)
add = Z_3@L2 + random_2
byCoordinates_5 = Point.ByCoordinates(x=X_4, y=Y_4, z=add)
code_block_15 = CodeBlock { 0; }
insert_4 = List.Insert(list=byCoordinates_5@L2, element=pointsAtEqualChordLength_2@L1, index=code_block_15)
code_block_16 = CodeBlock(x=byCoordinates_2) { x; }
code_block_17 = CodeBlock(x=byCoordinates_5) { x[0]; }
count = List.Count(list=code_block_17)
code_block_18 = CodeBlock(x=count) { x+1; }
insert_5 = List.Insert(list=insert_4@L2, element=code_block_16, index=code_block_18)
byControlPoints_5 = NurbsCurve.ByControlPoints(points=insert_5)
byLoft = Surface.ByLoft(crossSections=byControlPoints_5)
code_block_19 = CodeBlock(x=byControlPoints_5) { [x[0], x[-1]]; }
byLoft_2 = Surface.ByLoft(crossSections=code_block_19)
