# Dynamo graph Easter 2022.dyn (Dynamo 2.19.3.6394)
# packages: spring nodes 204.1.0

byCoordinates = Point.ByCoordinates()
number_slider = DoubleSlider(3.8, range=0..4 step 0.1)
code_block = CodeBlock { 4; }
byCoordinates_2 = Point.ByCoordinates(x=number_slider, z=code_block)
number_slider_2 = DoubleSlider(3.7, range=0..4 step 0.1)
code_block_2 = CodeBlock { 5; }
byCoordinates_3 = Point.ByCoordinates(x=number_slider_2, z=code_block_2)
number_slider_3 = DoubleSlider(2.5, range=0..4 step 0.1)
code_block_3 = CodeBlock { 8; }
byCoordinates_4 = Point.ByCoordinates(x=number_slider_3, z=code_block_3)
code_block_4 = CodeBlock { 10; }
byCoordinates_5 = Point.ByCoordinates(z=code_block_4)
join = List.Join(list0=byCoordinates, list1=byCoordinates_2, list2=byCoordinates_3, list3=byCoordinates_4, list4=byCoordinates_5)
byPoints = NurbsCurve.ByPoints(points=join)
code_block_5 = CodeBlock { 360; }
byRevolve = Surface.ByRevolve(profile=byPoints, sweepAngle=code_block_5)
number_slider_4 = DoubleSlider(2.7, range=0..10 step 0.1)
byCoordinates_6 = Point.ByCoordinates(z=number_slider_4)
byOriginNormal = Plane.ByOriginNormal(origin=byCoordinates_6)
split = Geometry.Split(geometry=byRevolve, other=byOriginNormal)
code_block_6 = CodeBlock(x=split) { x[0]; }
identity = Object.Identity(object=code_block_6)
number_slider_5 = DoubleSlider(5, range=0..10 step 0.1)
byCoordinates_7 = Point.ByCoordinates(z=number_slider_5)
byOriginNormal_2 = Plane.ByOriginNormal(origin=byCoordinates_7)
split_2 = Geometry.Split(geometry=identity, other=byOriginNormal_2)
identity_2 = Object.Identity(object=split_2)
code_block_7 = CodeBlock(x=split) { x[1]; }
join_2 = List.Join(list0=identity_2, list1=code_block_7)
color_palette = ColorPalette({R: 233, G: 150, B: 122, A: 255})
color_palette_2 = ColorPalette({R: 211, G: 211, B: 211, A: 255})
color_palette_3 = ColorPalette({R: 216, G: 191, B: 216, A: 255})
join_3 = List.Join(list0=color_palette, list1=color_palette_2, list2=color_palette_3)
bySurfaceColors = Modifiers.GeometryColor.BySurfaceColors(surface=join_2, colors=join_3)
code_block_8 = CodeBlock { 2; }
byControlPoints = NurbsCurve.ByControlPoints(degree=code_block_8)  # unwired: points
code_block_9 = CodeBlock { 10; }
code_block_10 = CodeBlock { -25; }
code_block_11 = CodeBlock { 25; }
randomList = Math.RandomList(amount=code_block_9, value1=code_block_10, value2=code_block_11, seed=code_block_9)
code_block_12 = CodeBlock { 1; }
randomList_2 = Math.RandomList(amount=code_block_9, value1=code_block_10, value2=code_block_11, seed=code_block_12)
byCoordinates_8 = Point.ByCoordinates(x=randomList, y=randomList_2)
byPoints_2 = Topography.ByPoints(points=byCoordinates_8)
mesh = Topography.Mesh(topography=byPoints_2)
ꟿ_mesh_topolysurface = Custom[ꟿ Mesh.ToPolySurface](mesh=mesh)  # package spring nodes
surfaces = PolySurface.Surfaces(polySurface=ꟿ_mesh_topolysurface)
identity_3 = Object.Identity(object=surfaces)
flatten = List.Flatten(list=identity_3)
byUnion = Surface.ByUnion(surfaces=flatten)
color_palette_4 = ColorPalette({R: 160, G: 82, B: 45, A: 255})
color_palette_5 = ColorPalette({R: 222, G: 184, B: 135, A: 255})
join_4 = List.Join(list0=color_palette_4, list1=color_palette_5)
bySurfaceColors_2 = Modifiers.GeometryColor.BySurfaceColors(surface=byUnion, colors=join_4)
count = DoubleSlider(3874, range=0..5000 step 1)
surfaces_2 = PolySurface.Surfaces(polySurface=ꟿ_mesh_topolysurface)
flatten_2 = List.Flatten(list=surfaces_2)
byGeometry = BoundingBox.ByGeometry(geom=flatten_2)
minPoint = BoundingBox.MinPoint(boundingBox=byGeometry)
X = Point.X(point=minPoint)
maxPoint = BoundingBox.MaxPoint(boundingBox=byGeometry)
X_2 = Point.X(point=maxPoint)
random_seed = DoubleSlider(83, range=-1000..1000 step 1)
randomList_3 = Math.RandomList(amount=count, value1=X, value2=X_2, seed=random_seed)
Y = Point.Y(point=minPoint)
Y_2 = Point.Y(point=maxPoint)
code_block_13 = CodeBlock(x=random_seed) { x + 2; }
randomList_4 = Math.RandomList(amount=count, value1=Y, value2=Y_2, seed=code_block_13)
Z = Point.Z(point=minPoint)
byCoordinates_9 = Point.ByCoordinates(x=randomList_3, y=randomList_4, z=Z)
code_block_14 = CodeBlock { 1; }
byCoordinates_10 = Vector.ByCoordinates(z=code_block_14)
project = Point.Project(point=byCoordinates_9@L1, baseGeometry=ꟿ_mesh_topolysurface, projectionDirection=byCoordinates_10)
flatten_3 = List.Flatten(list=project)
perimeterCurves = Surface.PerimeterCurves(surface=surfaces)
endPoint = Curve.EndPoint(curve=perimeterCurves)
X_3 = Point.X(point=endPoint)
Y_3 = Point.Y(point=endPoint)
byCoordinates_11 = Point.ByCoordinates(x=X_3, y=Y_3)
byPoints_3 = Polygon.ByPoints(points=byCoordinates_11)
flatten_4 = List.Flatten(list=byPoints_3)
X_4 = Point.X(point=flatten_3)
Y_4 = Point.Y(point=flatten_3)
byCoordinates_12 = Point.ByCoordinates(x=X_4, y=Y_4)
containmentTest = Polygon.ContainmentTest(polygon=flatten_4@L1, point=byCoordinates_12)
filterByBoolMask = List.FilterByBoolMask(list=flatten_3, mask=containmentTest@L2)
watch = Watch(filterByBoolMask.in)
flatten_5 = List.Flatten(list=watch)
normalAtPoint = Surface.NormalAtPoint(surface=identity_3@L1, point=watch@L2)
flatten_6 = List.Flatten(list=normalAtPoint)
root_tangency = DoubleSlider(0.186, range=0..1 step 0.001)
translate = Geometry.Translate(geometry=flatten_5, direction=flatten_6, distance=root_tangency)
code_block_15 = CodeBlock { 1; }
byCoordinates_13 = Vector.ByCoordinates(z=code_block_15)
grass_base_height = DoubleSlider(2, range=0.001..2 step 0.01)
code_block_16 = CodeBlock(root=root_tangency, grass_base=grass_base_height) { root - grass_base; }
code_block_17 = CodeBlock(x=code_block_16) { x * -1; }
grass_random_variation = DoubleSlider(0.796, range=0..1 step 0.001)
code_block_18 = CodeBlock(x=grass_random_variation) { x; }
code_block_19 = CodeBlock(x=code_block_18) { -0.5 * x; }
number_slider_6 = DoubleSlider(8.4, range=0..100 step 0.1)
randomList_5 = Math.RandomList(amount=count, value1=code_block_19, value2=code_block_18, seed=number_slider_6)
code_block_20 = CodeBlock(x=code_block_17, y=randomList_5) { x + y; }
translate_2 = Geometry.Translate(geometry=translate, direction=byCoordinates_13, distance=code_block_20)
code_block_21 = CodeBlock { 1; }
byCoordinates_14 = Vector.ByCoordinates(y=code_block_21)
time = DoubleSlider(62.8, range=0..100 step 0.1)
number_slider_7 = DoubleSlider(161.124, range=0..162.323 step 0.1)
number_slider_8 = DoubleSlider(107, range=0..200 step 0.1)
number_slider_9 = DoubleSlider(4.639, range=0..100 step 0.1)
byCoordinates_15 = Point.ByCoordinates(x=number_slider_7, y=number_slider_8, z=number_slider_9)
byTwoPoints = Vector.ByTwoPoints(start=byCoordinates_15, end=translate_2)
length = Vector.Length(vector=byTwoPoints)
code_block_22 = CodeBlock(x=time, y=length) { x + y; }
python_script = Python(IN[0]=code_block_22)  # CPython3
# ---------- python_script.python (8 lines) ----------
import math

time = IN[0]

OUT = []
for t in time:

    OUT.append(math.sin(t))
# ----------------------------------------
code_block_23 = CodeBlock(x=python_script) { x * 0.2; }
translate_3 = Geometry.Translate(geometry=translate_2, direction=byCoordinates_14, distance=code_block_23)
list_create = List.Create(item0=flatten_5, item1=flatten_5, item2=translate, item3=translate_3)
transpose = List.Transpose(lists=list_create)
byControlPoints_2 = NurbsCurve.ByControlPoints(points=transpose)
count_2 = List.Count(list=byControlPoints_2)
python_script_2 = Python(IN[0]=count_2)  # IronPython2
# ---------- python_script_2.python (35 lines) ----------
"""
Dynamo Core Assemblies: 
https://www.nuget.org/packages/DynamoVisualProgramming.Core/2.13.1.3887

Revit API: 
https://www.revitapidocs.com/2020/d4648875-d41a-783b-d5f4-638df39ee413.htm
"""

"""
C:\Program Files\Autodesk\Revit 2022\AddIns\DynamoForRevit

C:\Program Files\Autodesk\Revit 2022\AddIns\DynamoForRevit\Revit

"""
import clr
#clr.AddReference('GeometryColor')
#import Modifiers

clr.AddReference('DSCoreNodes')
from DSCore import Color 

from random import randint

cnt = IN[0]
randint(0, 5)

g1 = Color.ByARGB(255,0,128,0)
g2 = Color.ByARGB(255,154,205,50)

OUT = []
for i in range(cnt):
	if randint(0, 5) < 5:
		OUT.append(g1)
	else:
		OUT.append(g2)
# ----------------------------------------
byGeometryColor = Modifiers.GeometryColor.ByGeometryColor(geometry=byControlPoints_2, color=python_script_2)
code_block_24 = CodeBlock { 7; }
code_block_25 = CodeBlock { 1.1; }
translate_4 = Geometry.Translate(geometry=join_2, xTranslation=code_block_24, zTranslation=code_block_25)
byCoordinates_16 = Point.ByCoordinates()
code_block_26 = CodeBlock { 1; }
byCoordinates_17 = Vector.ByCoordinates(y=code_block_26)
code_block_27 = CodeBlock { 9; }
rotate = Geometry.Rotate(geometry=translate_4, origin=byCoordinates_16, axis=byCoordinates_17, degrees=code_block_27)
color_palette_6 = ColorPalette({R: 0, G: 255, B: 255, A: 255})
color_palette_7 = ColorPalette({R: 255, G: 250, B: 240, A: 255})
color_palette_8 = ColorPalette({R: 0, G: 0, B: 255, A: 255})
join_5 = List.Join(list0=color_palette_6, list1=color_palette_7, list2=color_palette_8)
bySurfaceColors_3 = Modifiers.GeometryColor.BySurfaceColors(surface=rotate, colors=join_5)
code_block_28 = CodeBlock { -5; }
code_block_29 = CodeBlock { 4; }
code_block_30 = CodeBlock { 0.8; }
translate_5 = Geometry.Translate(geometry=join_2, xTranslation=code_block_28, yTranslation=code_block_29, zTranslation=code_block_30)
byCoordinates_18 = Point.ByCoordinates()
code_block_31 = CodeBlock { 1; }
byCoordinates_19 = Vector.ByCoordinates(y=code_block_31)
code_block_32 = CodeBlock { -9; }
rotate_2 = Geometry.Rotate(geometry=translate_5, origin=byCoordinates_18, axis=byCoordinates_19, degrees=code_block_32)
color_palette_9 = ColorPalette({R: 255, G: 140, B: 0, A: 255})
color_palette_10 = ColorPalette({R: 178, G: 34, B: 34, A: 255})
color_palette_11 = ColorPalette({R: 199, G: 21, B: 133, A: 255})
join_6 = List.Join(list0=color_palette_9, list1=color_palette_10, list2=color_palette_11)
bySurfaceColors_4 = Modifiers.GeometryColor.BySurfaceColors(surface=rotate_2, colors=join_6)
mesh_2 = Topography.Mesh()  # unwired: topography
