# Dynamo graph Get Room from Element.dyn (Dynamo 2.12.0.5650)

select_phase = RevitPhases("New Construction")
select_model_elements_by = DSModelElementsByCategorySelection(index=258)  # "Select Model Elements By Category"; 5 picked in the model
# note: If phase is not plugged in it will default to the last phase. IN[1]
python_script = Python(IN[0]=select_model_elements_by)  # IronPython2; unwired: IN[1]
# ---------- python_script.python (46 lines) ----------
import sys
sys.path.append("C:\\Users\\dalto\\anaconda3\\envs\\Dynamo_210\\Lib")
sys.path.append("C:\\Users\\dalto\\OneDrive\\My Stuff\\GitHub\\All-Sorts-of-Dynamo-Scripts\\Python Module")

import clr

clr.AddReference('RevitAPI')
from Autodesk.Revit.DB import *
from Autodesk.Revit.DB.Structure import *

clr.AddReference('RevitAPIUI')
from Autodesk.Revit.UI import *

clr.AddReference('System')
from System.Collections.Generic import List

clr.AddReference('RevitNodes')
import Revit
clr.ImportExtensions(Revit.GeometryConversion)
clr.ImportExtensions(Revit.Elements)

clr.AddReference('RevitServices')
import RevitServices
from RevitServices.Persistence import DocumentManager
from RevitServices.Transactions import TransactionManager

doc = DocumentManager.Instance.CurrentDBDocument
uidoc=DocumentManager.Instance.CurrentUIApplication.ActiveUIDocument

#check to see if element is not list and if so return list

def check_list(elements):
    if not isinstance(elements, list):
        elements = [elements]
    return elements

elements = check_list(IN[0])
elements = UnwrapElement(elements)
phase = UnwrapElement(IN[1])

if phase == None:
	phase = list(doc.Phases)[-1]

OUT = []
for element in elements:
    OUT.append(element.Room[phase])
# ----------------------------------------
code_block = CodeBlock { "Name"; }
getParameterValueByName = Element.GetParameterValueByName(element=python_script, parameterName=code_block)
