# Dynamo graph Halloween 2022.dyn (Dynamo 2.13.1.3887)

number_slider = DoubleSlider(4, range=0..100 step 0.1)
byCoordinates = Point.ByCoordinates(z=number_slider)

# group: Rib and Rind(Skin) Depth
number_slider_2 = DoubleSlider(5, range=5..8 step 1)

byCenterPointRadius = Circle.ByCenterPointRadius(centerPoint=byCoordinates, radius=number_slider_2)

# group: Divisions (Ribs)
number_slider_3 = DoubleSlider(28, range=22..34 step 2)

pointsAtEqualSegmentLength = Curve.PointsAtEqualSegmentLength(curve=byCenterPointRadius, divisions=number_slider_3)
code_block = CodeBlock { 2; }
chop = List.Chop(list=pointsAtEqualSegmentLength, lengths=code_block)
code_block_2 = CodeBlock { 0; }
getItemAtIndex = List.GetItemAtIndex(list=chop@L2, index=code_block_2)
number_slider_4 = DoubleSlider(4, range=0..100 step 0.1)
byCoordinates_2 = Point.ByCoordinates(z=number_slider_4)
code_block_3 = CodeBlock(rind=number_slider_2) { rind - 0.5; }
byCenterPointRadius_2 = Circle.ByCenterPointRadius(centerPoint=byCoordinates_2, radius=code_block_3)
pointsAtEqualSegmentLength_2 = Curve.PointsAtEqualSegmentLength(curve=byCenterPointRadius_2, divisions=number_slider_3)
code_block_4 = CodeBlock { 2; }
chop_2 = List.Chop(list=pointsAtEqualSegmentLength_2, lengths=code_block_4)
code_block_5 = CodeBlock { 1; }
getItemAtIndex_2 = List.GetItemAtIndex(list=chop_2@L2, index=code_block_5)
number_slider_5 = DoubleSlider(8, range=0..100 step 0.1)
byCoordinates_3 = Point.ByCoordinates(z=number_slider_5)

# group: Top Radius
number_slider_6 = DoubleSlider(11, range=2..11 step 1)

byCenterPointRadius_3 = Circle.ByCenterPointRadius(centerPoint=byCoordinates_3, radius=number_slider_6)
pointsAtEqualSegmentLength_3 = Curve.PointsAtEqualSegmentLength(curve=byCenterPointRadius_3, divisions=number_slider_3)
code_block_6 = CodeBlock { 2; }
chop_3 = List.Chop(list=pointsAtEqualSegmentLength_3, lengths=code_block_6)
code_block_7 = CodeBlock { 0; }
getItemAtIndex_3 = List.GetItemAtIndex(list=chop_3@L2, index=code_block_7)
code_block_8 = CodeBlock { 0; }
getItemAtIndex_4 = List.GetItemAtIndex(list=chop_2@L2, index=code_block_8)

# group: Bottom Radius
number_slider_7 = DoubleSlider(11, range=2..11 step 1)

byCenterPointRadius_4 = Circle.ByCenterPointRadius(radius=number_slider_7)
pointsAtEqualSegmentLength_4 = Curve.PointsAtEqualSegmentLength(curve=byCenterPointRadius_4, divisions=number_slider_3)
code_block_9 = CodeBlock { 2; }
chop_4 = List.Chop(list=pointsAtEqualSegmentLength_4, lengths=code_block_9)
code_block_10 = CodeBlock { 0; }
getItemAtIndex_5 = List.GetItemAtIndex(list=chop_4@L2, index=code_block_10)
list_create = List.Create(item0=getItemAtIndex_3, item1=getItemAtIndex_4, item2=getItemAtIndex_5)
transpose = List.Transpose(lists=list_create)
byPoints = NurbsCurve.ByPoints(points=transpose)
code_block_11 = CodeBlock { 1; }
dropItems = List.DropItems(list=byPoints, amount=code_block_11)
code_block_12 = CodeBlock { -1; }
dropItems_2 = List.DropItems(list=byPoints, amount=code_block_12)
list_create_2 = List.Create(item0=dropItems, item1=dropItems_2)
transpose_2 = List.Transpose(lists=list_create_2)
code_block_13 = CodeBlock { 1; }
getItemAtIndex_6 = List.GetItemAtIndex(list=chop_3@L2, index=code_block_13)
code_block_14 = CodeBlock { 1; }
getItemAtIndex_7 = List.GetItemAtIndex(list=chop@L2, index=code_block_14)
code_block_15 = CodeBlock { 1; }
getItemAtIndex_8 = List.GetItemAtIndex(list=chop_4@L2, index=code_block_15)
list_create_3 = List.Create(item0=getItemAtIndex_6, item1=getItemAtIndex_7, item2=getItemAtIndex_8)
transpose_3 = List.Transpose(lists=list_create_3)
byPoints_2 = NurbsCurve.ByPoints(points=transpose_3)
code_block_16 = CodeBlock { 1; }
insert = List.Insert(list=transpose_2@L2, element=byPoints_2@L1, index=code_block_16)
code_block_17 = CodeBlock(x=insert) { x[0]; x[-1]; }
code_block_18 = CodeBlock { 2; }
getItemAtIndex_9 = List.GetItemAtIndex(list=code_block_17.out0, index=code_block_18)
code_block_19 = CodeBlock { 0; }
getItemAtIndex_10 = List.GetItemAtIndex(list=code_block_17.out1, index=code_block_19)
join = List.Join(list0=getItemAtIndex_9, list1=getItemAtIndex_10)
code_block_20 = CodeBlock(x=join) { [x]; }
join_2 = List.Join(list0=code_block_20, list1=insert)
byLoft = Surface.ByLoft(crossSections=join_2)
code_block_21 = CodeBlock { 0.5; }
code_block_22 = CodeBlock { 0; }
thicken = Surface.Thicken(surface=byLoft, thickness=code_block_21, both_sides=code_block_22)
byUnion = Solid.ByUnion(solids=thicken)
code_block_23 = CodeBlock { [-0.5, -2, -2]; }
code_block_24 = CodeBlock { [-10, -10, -10]; }
number_slider_8 = DoubleSlider(4.4, range=0..10 step 0.1)
code_block_25 = CodeBlock(z=number_slider_8) { [z+0, z+0, z+1]; }
byCoordinates_4 = Point.ByCoordinates(x=code_block_23, y=code_block_24, z=code_block_25)
code_block_26 = CodeBlock { 1; }
byPoints_3 = PolyCurve.ByPoints(points=byCoordinates_4, connectLastToFirst=code_block_26)
byPatch = Surface.ByPatch(closedCurve=byPoints_3)
code_block_27 = CodeBlock { 10; }
code_block_28 = CodeBlock { 0; }
thicken_2 = Surface.Thicken(surface=byPatch, thickness=code_block_27, both_sides=code_block_28)
split = Geometry.Split(geometry=byUnion, other=thicken_2)
code_block_29 = CodeBlock(x=split) { x[0]; }
identity = Object.Identity(object=code_block_29)
code_block_30 = CodeBlock { [2, 2, 0.5]; }
code_block_31 = CodeBlock { [-10, -10, -10]; }
number_slider_9 = DoubleSlider(4.4, range=0..10 step 0.1)
code_block_32 = CodeBlock(z=number_slider_9) { [z+1, z+0, z+0]; }
byCoordinates_5 = Point.ByCoordinates(x=code_block_30, y=code_block_31, z=code_block_32)
code_block_33 = CodeBlock { 1; }
byPoints_4 = PolyCurve.ByPoints(points=byCoordinates_5, connectLastToFirst=code_block_33)
byPatch_2 = Surface.ByPatch(closedCurve=byPoints_4)
code_block_34 = CodeBlock { 10; }
code_block_35 = CodeBlock { 0; }
thicken_3 = Surface.Thicken(surface=byPatch_2, thickness=code_block_34, both_sides=code_block_35)
split_2 = Geometry.Split(geometry=identity, other=thicken_3)
code_block_36 = CodeBlock(x=split_2) { x[0]; }
identity_2 = Object.Identity(object=code_block_36)
code_block_37 = CodeBlock { [-2.5, -2, -1, 0, 1, 2, 2.5]; }
code_block_38 = CodeBlock { [-10, -10, -10, -10, -10, -10, -10]; }
number_slider_10 = DoubleSlider(1.2, range=0..10 step 0.1)
code_block_39 = CodeBlock(x=number_slider_10) { [x+1, x+0.5, x+0, x+0, x+0, x+0.5, x+1]; }
byCoordinates_6 = Point.ByCoordinates(x=code_block_37, y=code_block_38, z=code_block_39)
code_block_40 = CodeBlock { 1; }
byPoints_5 = PolyCurve.ByPoints(points=byCoordinates_6, connectLastToFirst=code_block_40)
byPatch_3 = Surface.ByPatch(closedCurve=byPoints_5)
code_block_41 = CodeBlock { -10; }
code_block_42 = CodeBlock { 0; }
thicken_4 = Surface.Thicken(surface=byPatch_3, thickness=code_block_41, both_sides=code_block_42)
split_3 = Geometry.Split(geometry=identity_2, other=thicken_4)
code_block_43 = CodeBlock(x=split_3) { x[0]; }
identity_3 = Object.Identity(object=code_block_43)
color_palette = ColorPalette({R: 255, G: 140, B: 0, A: 255})
byGeometryColor = Modifiers.GeometryColor.ByGeometryColor(geometry=identity_3, color=color_palette)
code_block_44 = CodeBlock {  }
