# Dynamo graph Parametric Stairs.dyn (Dynamo 2.13.0.3485)

byGroupedCurves = PolyCurve.ByGroupedCurves()  # unwired: curves
byCoordinates = Point.ByCoordinates()
code_block = CodeBlock { 1; }
byCoordinates_2 = Vector.ByCoordinates(z=code_block)
start = DoubleSlider(5, range=1..15 step 1)
code_block_2 = CodeBlock(x=start) { x + 4; }
join = List.Join(list0=start, list1=code_block_2)
byCoordinates_3 = Point.ByCoordinates(x=join)
pitch = DoubleSlider(6, range=1..15 step 1)
turns = DoubleSlider(2000, range=90..2000 step 90)
byAxis = Helix.ByAxis(axisPoint=byCoordinates, axisDirection=byCoordinates_2, startPoint=byCoordinates_3, pitch=pitch, angleTurns=turns)
number_slider = DoubleSlider(77, range=1..100 step 1)
pointsAtEqualSegmentLength = Curve.PointsAtEqualSegmentLength(curve=byAxis, divisions=number_slider)
code_block_3 = CodeBlock(x=pointsAtEqualSegmentLength) { x[0]; x[1]; }
byStartPointEndPoint = Line.ByStartPointEndPoint(startPoint=code_block_3.out0, endPoint=code_block_3.out1)
code_block_4 = CodeBlock { 0.5; }
pointAtParameter = Curve.PointAtParameter(curve=byStartPointEndPoint, param=code_block_4)
splitByPoints = Curve.SplitByPoints(curve=byAxis, points=pointAtParameter)
startPoint = Curve.StartPoint(curve=splitByPoints)
flatten = List.Flatten(list=startPoint)
code_block_5 = CodeBlock { 0.5; }
pointAtParameter_2 = Curve.PointAtParameter(curve=splitByPoints, param=code_block_5)
X = Point.X(point=pointAtParameter_2)
Y = Point.Y(point=pointAtParameter_2)
Z = Point.Z(point=startPoint)
byCoordinates_4 = Point.ByCoordinates(x=X, y=Y, z=Z)
flatten_2 = List.Flatten(list=byCoordinates_4)
endPoint = Curve.EndPoint(curve=splitByPoints)
X_2 = Point.X(point=endPoint)
Y_2 = Point.Y(point=endPoint)
Z_2 = Point.Z(point=startPoint)
byCoordinates_5 = Point.ByCoordinates(x=X_2, y=Y_2, z=Z_2)
flatten_3 = List.Flatten(list=byCoordinates_5)
list_create = List.Create(item0=flatten, item1=flatten_2, item2=flatten_3)
transpose = List.Transpose(lists=list_create)
byPoints = NurbsCurve.ByPoints(points=transpose)
count = List.Count(list=byPoints)
code_block_6 = CodeBlock(x=count) { x/2; }
chop = List.Chop(list=byPoints, lengths=code_block_6)
startPoint_2 = Curve.StartPoint(curve=chop)
code_block_7 = CodeBlock(x=startPoint_2) { x[0]; x[1]; }
byStartPointEndPoint_2 = Line.ByStartPointEndPoint(startPoint=code_block_7.out0, endPoint=code_block_7.out1)
endPoint_2 = Curve.EndPoint(curve=chop)
code_block_8 = CodeBlock(x=endPoint_2) { x[0]; x[1]; }
byStartPointEndPoint_3 = Line.ByStartPointEndPoint(startPoint=code_block_8.out0, endPoint=code_block_8.out1)
code_block_9 = CodeBlock(x=chop) { x[0]; x[1]; }
list_create_2 = List.Create(item0=byStartPointEndPoint_2, item1=byStartPointEndPoint_3, item2=code_block_9.out0, item3=code_block_9.out1)
transpose_2 = List.Transpose(lists=list_create_2)
byJoinedCurves = PolyCurve.ByJoinedCurves(curves=transpose_2)
byPatch = Surface.ByPatch(closedCurve=byJoinedCurves)
step_thickness = DoubleSlider(0.7, range=0.1..1 step 0.1)
code_block_10 = CodeBlock { 0; }
thicken = Surface.Thicken(surface=byPatch, thickness=step_thickness, both_sides=code_block_10)
color_palette = ColorPalette({R: 255, G: 218, B: 185, A: 255})
byGeometryColor = Modifiers.GeometryColor.ByGeometryColor(geometry=thicken, color=color_palette)
railing_height = DoubleSlider(2.5, range=1..5 step 0.5)
byCoordinates_6 = Vector.ByCoordinates(z=railing_height)
extrude = Curve.Extrude(curve=byAxis, direction=byCoordinates_6)
code_block_11 = CodeBlock(x=extrude) { x[0]; x[1]; }
railing_thickness = DoubleSlider(0.7, range=0.1..1 step 0.1)
code_block_12 = CodeBlock(x=railing_thickness) { -x; }
code_block_13 = CodeBlock { false; }
thicken_2 = Surface.Thicken(surface=code_block_11.out0, thickness=code_block_12, both_sides=code_block_13)
thicken_3 = Surface.Thicken(surface=code_block_11.out1, thickness=railing_thickness, both_sides=code_block_13)
join_2 = List.Join(list0=thicken_2, list1=thicken_3)
color_palette_2 = ColorPalette({R: 95, G: 158, B: 160, A: 255})
byGeometryColor_2 = Modifiers.GeometryColor.ByGeometryColor(geometry=join_2, color=color_palette_2)
