# Dynamo graph Thanksgiving2023.dyn "ThanksGiving2023" (Dynamo 2.19.3.6394)
# packages: spring nodes 204.1.0

code_block = CodeBlock { 10; }
byCoordinates = Point.ByCoordinates()
code_block_2 = CodeBlock { 0.2; }
byCoordinates_2 = Point.ByCoordinates(z=code_block_2)

# group: Inputs
# These inputs will adjust the leaf
base_length = DoubleSlider(10, range=1..25 step 1)
base_width = DoubleSlider(5, range=1..25 step 1)
random_factor = DoubleSlider(0.18, range=0..1 step 0.01)
leaf_vein_color = ColorPalette({R: 58, G: 76, B: 2, A: 255})
color_palette = ColorPalette({R: 255, G: 127, B: 1, A: 255})
color_palette_2 = ColorPalette({R: 255, G: 192, B: 0, A: 255})
color_palette_3 = ColorPalette({R: 205, G: 204, B: 0, A: 255})
leaf_color = List.Create(item0=color_palette, item1=color_palette_2, item2=color_palette_3)

python_script = Python(IN[0]=base_length, IN[1]=base_width, IN[2]=random_factor)  # CPython3
# ---------- python_script.python (37 lines) ----------
import sys
import clr
clr.AddReference('ProtoGeometry')
from Autodesk.DesignScript.Geometry import *
import random

def create_half_leaf(base_length, base_width):
    # Define control points for half of the leaf shape
    points = [
        Point.ByCoordinates(0, 0), 
        Point.ByCoordinates(base_width / 2, base_length / 4),
        Point.ByCoordinates(base_width / 2, base_length / 2),
        Point.ByCoordinates(0, base_length)
    ]
    
    # Create spline for half of the leaf
    half_spline = NurbsCurve.ByPoints(points)
    
    return half_spline

def randomize_half_leaf(base_length, base_width, random_factor):
    # Randomize dimensions
    new_length = base_length + random.uniform(-random_factor, random_factor) * base_length
    new_width = base_width + random.uniform(-random_factor, random_factor) * base_width
    
    return create_half_leaf(new_length, new_width)

# Base dimensions of the leaf
base_length = IN[0] # Example value, adjust as needed
base_width = IN[1]   # Example value, adjust as needed
random_factor = IN[2] # Adjust the factor to increase/decrease randomness

# Generate half of a random leaf
random_half_leaf = randomize_half_leaf(base_length, base_width, random_factor)

# Return the half leaf geometry to Dynamo
OUT = random_half_leaf
# ----------------------------------------
code_block_3 = CodeBlock { 1; }
byCoordinates_3 = Vector.ByCoordinates(x=code_block_3)
code_block_4 = CodeBlock { 90; }
rotate = Geometry.Rotate(geometry=python_script, origin=byCoordinates, axis=byCoordinates_3, degrees=code_block_4)
byOriginNormal = Plane.ByOriginNormal(normal=byCoordinates_3)
mirror = Geometry.Mirror(geometry=rotate, mirrorPlane=byOriginNormal)
join = Curve.Join(curve=rotate, curves=mirror)
code_block_5 = CodeBlock { 1; }
byCoordinates_4 = Vector.ByCoordinates(z=code_block_5)
project = Point.Project(point=byCoordinates_2, baseGeometry=join, projectionDirection=byCoordinates_4)
byStartPointEndPoint = Line.ByStartPointEndPoint(startPoint=byCoordinates, endPoint=project)
Z = Point.Z(point=project)
ceiling = Math.Ceiling(number=Z)
code_block_6 = CodeBlock { 2; }
div = ceiling / code_block_6
pointsAtEqualSegmentLength = Curve.PointsAtEqualSegmentLength(curve=byStartPointEndPoint, divisions=div)
flatten = List.Flatten(list=pointsAtEqualSegmentLength)
code_block_7 = CodeBlock { 3; }
byCoordinates_5 = Vector.ByCoordinates(x=base_length, z=code_block_7)
project_2 = Point.Project(point=flatten@L1, baseGeometry=join, projectionDirection=byCoordinates_5)
byStartPointEndPoint_2 = Line.ByStartPointEndPoint(startPoint=project_2, endPoint=flatten)
code_block_8 = CodeBlock(x=base_length) { -x; }
byCoordinates_6 = Vector.ByCoordinates(x=code_block_8, z=code_block_7)
project_3 = Point.Project(point=flatten@L1, baseGeometry=join, projectionDirection=byCoordinates_6)
byStartPointEndPoint_3 = Line.ByStartPointEndPoint(startPoint=project_3, endPoint=flatten)
join_2 = List.Join(list0=byStartPointEndPoint, list1=join, list2=byStartPointEndPoint_2, list3=byStartPointEndPoint_3)
byGeometryColor = Modifiers.GeometryColor.ByGeometryColor(geometry=join_2, color=leaf_vein_color)
byPatch = Surface.ByPatch(closedCurve=join)
bySurfaceColors = Modifiers.GeometryColor.BySurfaceColors(surface=byPatch, colors=leaf_color)
code_block_9 = CodeBlock { 2; }
byControlPoints = NurbsCurve.ByControlPoints(degree=code_block_9)  # unwired: points
count = DoubleSlider(3874, range=0..5000 step 1)
code_block_10 = CodeBlock { 15; }
code_block_11 = CodeBlock { 15; }
code_block_12 = CodeBlock { -15; }
randomList = Math.RandomList(amount=code_block_10, value1=code_block_11, value2=code_block_12, seed=code_block_10)
code_block_13 = CodeBlock { 1; }
randomList_2 = Math.RandomList(amount=code_block_10, value1=code_block_11, value2=code_block_12, seed=code_block_13)
byCoordinates_7 = Point.ByCoordinates(x=randomList, y=randomList_2)
byPoints = Topography.ByPoints(points=byCoordinates_7)  # frozen
mesh = Topography.Mesh(topography=byPoints)
ꟿ_mesh_topolysurface = Custom[ꟿ Mesh.ToPolySurface](mesh=mesh)  # package spring nodes; Converts a Dynamo mesh to a polysurface. By default the node is single threaded, but if you specify a higher number of threads in the `NUMTHREAD` input, the node will run multi-threaded to speed up the conversion. *WARNING* Using multi-threaded code with Dynamo's geometry kernel may crash Revit in some cases.
surfaces = PolySurface.Surfaces(polySurface=ꟿ_mesh_topolysurface)
flatten_2 = List.Flatten(list=surfaces)
byGeometry = BoundingBox.ByGeometry(geom=flatten_2)
minPoint = BoundingBox.MinPoint(boundingBox=byGeometry)
X = Point.X(point=minPoint)
maxPoint = BoundingBox.MaxPoint(boundingBox=byGeometry)
X_2 = Point.X(point=maxPoint)
random_seed = DoubleSlider(83, range=-1000..1000 step 1)
randomList_3 = Math.RandomList(amount=count, value1=X, value2=X_2, seed=random_seed)
Y = Point.Y(point=minPoint)
Y_2 = Point.Y(point=maxPoint)
code_block_14 = CodeBlock(x=random_seed) { x + 2; }
randomList_4 = Math.RandomList(amount=count, value1=Y, value2=Y_2, seed=code_block_14)
Z_2 = Point.Z(point=minPoint)
byCoordinates_8 = Point.ByCoordinates(x=randomList_3, y=randomList_4, z=Z_2)
code_block_15 = CodeBlock { 1; }
byCoordinates_9 = Vector.ByCoordinates(z=code_block_15)
project_4 = Point.Project(point=byCoordinates_8@L1, baseGeometry=ꟿ_mesh_topolysurface, projectionDirection=byCoordinates_9)
flatten_3 = List.Flatten(list=project_4)
surfaces_2 = PolySurface.Surfaces(polySurface=ꟿ_mesh_topolysurface)
perimeterCurves = Surface.PerimeterCurves(surface=surfaces_2)
endPoint = Curve.EndPoint(curve=perimeterCurves)
X_3 = Point.X(point=endPoint)
Y_3 = Point.Y(point=endPoint)
byCoordinates_10 = Point.ByCoordinates(x=X_3, y=Y_3)
byPoints_2 = Polygon.ByPoints(points=byCoordinates_10)
flatten_4 = List.Flatten(list=byPoints_2)
X_4 = Point.X(point=flatten_3)
Y_4 = Point.Y(point=flatten_3)
byCoordinates_11 = Point.ByCoordinates(x=X_4, y=Y_4)
containmentTest = Polygon.ContainmentTest(polygon=flatten_4@L1, point=byCoordinates_11)
filterByBoolMask = List.FilterByBoolMask(list=flatten_3, mask=containmentTest@L2)
watch = Watch(filterByBoolMask.in)
flatten_5 = List.Flatten(list=watch)
identity = Object.Identity(object=surfaces_2)
normalAtPoint = Surface.NormalAtPoint(surface=identity@L1, point=watch@L2)
flatten_6 = List.Flatten(list=normalAtPoint)
root_tangency = DoubleSlider(0.186, range=0..1 step 0.001)
translate = Geometry.Translate(geometry=flatten_5, direction=flatten_6, distance=root_tangency)
code_block_16 = CodeBlock { 1; }
byCoordinates_12 = Vector.ByCoordinates(z=code_block_16)
grass_base_height = DoubleSlider(2, range=0.001..2 step 0.01)
code_block_17 = CodeBlock(root=root_tangency, grass_base=grass_base_height) { root - grass_base; }
code_block_18 = CodeBlock(x=code_block_17) { x * -1; }
grass_random_variation = DoubleSlider(0.796, range=0..1 step 0.001)
code_block_19 = CodeBlock(x=grass_random_variation) { x; }
code_block_20 = CodeBlock(x=code_block_19) { -0.5 * x; }
number_slider = DoubleSlider(8.4, range=0..100 step 0.1)
randomList_5 = Math.RandomList(amount=count, value1=code_block_20, value2=code_block_19, seed=number_slider)
code_block_21 = CodeBlock(x=code_block_18, y=randomList_5) { x + y; }
translate_2 = Geometry.Translate(geometry=translate, direction=byCoordinates_12, distance=code_block_21)
code_block_22 = CodeBlock { 1; }
byCoordinates_13 = Vector.ByCoordinates(y=code_block_22)
time = DoubleSlider(62.8, range=0..100 step 0.1)
number_slider_2 = DoubleSlider(161.124, range=0..162.323 step 0.1)
number_slider_3 = DoubleSlider(107, range=0..200 step 0.1)
number_slider_4 = DoubleSlider(4.639, range=0..100 step 0.1)
byCoordinates_14 = Point.ByCoordinates(x=number_slider_2, y=number_slider_3, z=number_slider_4)
byTwoPoints = Vector.ByTwoPoints(start=byCoordinates_14, end=translate_2)
length = Vector.Length(vector=byTwoPoints)
code_block_23 = CodeBlock(x=time, y=length) { x + y; }
python_script_2 = Python(IN[0]=code_block_23)  # CPython3
# ---------- python_script_2.python (8 lines) ----------
import math

time = IN[0]

OUT = []
for t in time:

    OUT.append(math.sin(t))
# ----------------------------------------
code_block_24 = CodeBlock(x=python_script_2) { x * 0.2; }
translate_3 = Geometry.Translate(geometry=translate_2, direction=byCoordinates_13, distance=code_block_24)
list_create = List.Create(item0=flatten_5, item1=flatten_5, item2=translate, item3=translate_3)
transpose = List.Transpose(lists=list_create)
byControlPoints_2 = NurbsCurve.ByControlPoints(points=transpose)
count_2 = List.Count(list=byControlPoints_2)
python_script_3 = Python(IN[0]=count_2)  # IronPython2
# ---------- python_script_3.python (35 lines) ----------
"""
Dynamo Core Assemblies: 
https://www.nuget.org/packages/DynamoVisualProgramming.Core/2.13.1.3887

Revit API: 
https://www.revitapidocs.com/2020/d4648875-d41a-783b-d5f4-638df39ee413.htm
"""

"""
C:\Program Files\Autodesk\Revit 2022\AddIns\DynamoForRevit

C:\Program Files\Autodesk\Revit 2022\AddIns\DynamoForRevit\Revit

"""
import clr
#clr.AddReference('GeometryColor')
#import Modifiers

clr.AddReference('DSCoreNodes')
from DSCore import Color 

from random import randint

cnt = IN[0]
randint(0, 5)

g1 = Color.ByARGB(255,0,128,0)
g2 = Color.ByARGB(255,154,205,50)

OUT = []
for i in range(cnt):
	if randint(0, 5) < 5:
		OUT.append(g1)
	else:
		OUT.append(g2)
# ----------------------------------------
byGeometryColor_2 = Modifiers.GeometryColor.ByGeometryColor(geometry=byControlPoints_2, color=python_script_3)
flatten_7 = List.Flatten(list=identity)
byUnion = Surface.ByUnion(surfaces=flatten_7)
color_palette_4 = ColorPalette({R: 160, G: 82, B: 45, A: 255})
color_palette_5 = ColorPalette({R: 222, G: 184, B: 135, A: 255})
join_3 = List.Join(list0=color_palette_4, list1=color_palette_5)
bySurfaceColors_2 = Modifiers.GeometryColor.BySurfaceColors(surface=byUnion, colors=join_3)
