# Dynamo graph Closest Pair of Points.dyn (Dynamo 2.10.1.3976)
# packages: Orchid 230.0.3.7536

# note: Point in polygon:
# https://en.wikipedia.org/wiki/Point_in_polygon
# Winding number:
# https://en.wikipedia.org/wiki/Winding_number
# Even-odd rule:
# https://en.wikipedia.org/wiki/Even%E2%80%93odd_rule
# Semi-infinite:
# https://en.wikipedia.org/wiki/Semi-infinite
# Computational Geometry in Python:
# https://www.toptal.com/python/computational-geometry-in-python-from-theory-to-implementation
code_block = CodeBlock { 1000; }
code_block_2 = CodeBlock { -10; }
code_block_3 = CodeBlock { 10; }
number_slider = DoubleSlider(1, range=0..100 step 0.1)
randomList = Math.RandomList(amount=code_block, value1=code_block_2, value2=code_block_3, seed=number_slider)
code_block_4 = CodeBlock(x=number_slider) { x + 100; x - 100; }
randomList_2 = Math.RandomList(amount=code_block, value1=code_block_2, value2=code_block_3, seed=code_block_4.out0)
randomList_3 = Math.RandomList(amount=code_block, value1=code_block_2, value2=code_block_3, seed=code_block_4.out1)
byCoordinates = Point.ByCoordinates(x=randomList, y=randomList_2, z=randomList_3)
python_script = Python()  # IronPython2; unwired: IN[0], IN[1]
# ---------- python_script.python (57 lines) ----------
# Load the Python Standard and DesignScript Libraries
import sys
import clr
clr.AddReference('ProtoGeometry')
from Autodesk.DesignScript.Geometry import *

dyn_points = IN[0]
points = []
text = IN[1]


for p in dyn_points:
    points.append((p.X,p.Y))    

def dist(p1, p2):
    x1, y1 = p1
    x2, y2 = p2
    dis = ((x1-x2)**2 + (y1-y2)**2)**0.5
    return dis

def offices_to_merge(points):
    current_minimum = float('inf')
    min_p1 = -1
    min_p2 = -1
    for i in range(len(points)):
        for j in range(i+1, len(points)):
            dis = dist(points[i], points[j])
            if dis < current_minimum:
                min_p1 = i
                min_p2 = j
                current_minimum = dis
    return (min_p1, min_p2)
    
text_pair = offices_to_merge(points)
 
 
def pair_text(text,points):
    paired_text = []
    text_pair = offices_to_merge(points)
    
    paired_text.append(text.pop(text_pair[0]))
    paired_text.append(text.pop(text_pair[1]-1))
    
    points.pop(text_pair[0])
    points.pop(text_pair[1]-1)
    
    
    return paired_text

OUT = []
x = True
while x:
    if len(points) > 1:
        OUT.append(pair_text(text, points))
    else:
        x = False
        break
# ----------------------------------------
globalParameters = Orchid.RevitProject.Common.Document.GlobalParameters()
sharedParameters = Orchid.RevitProject.Common.Document.SharedParameters()
shared_parameters = SharedParameter("A")
parameters = Element.Parameters(element=shared_parameters)
code_block_5 = CodeBlock { RevitProject.SharedParameter.GetFile; }
add = Orchid.RevitFamily.SharedParameter.Add()  # unwired: parameterName, groupName, type, group
