# Dynamo graph Delaunay.dyn "The Shortest Path Problem" (Dynamo 2.12.0.5650)

code_block = CodeBlock { 0..20; }
code_block_2 = CodeBlock { [1,2,3]; }
shuffle = List.Shuffle(list=code_block, seed=code_block_2)
code_block_3 = CodeBlock(x=shuffle) { x[0]; x[1]; x[2]; }
byCoordinates = Point.ByCoordinates(x=code_block_3.out0, y=code_block_3.out1, z=code_block_3.out2)
byPoints = Tessellation.Delaunay.ByPoints(points=byCoordinates)
