# Dynamo graph Point in Polygon - ChatGPT.dyn (Dynamo 2.15.2.6417)
# packages: spring nodes 121.1.1

code_block = CodeBlock { [2,2,2,2]; 0; 100; [3,1,7,4]; }
number_slider = DoubleSlider(54, range=0..100 step 1)
python_script = Python(IN[0]=number_slider)  # CPython3
# ---------- python_script.python (15 lines) ----------
from random import randint
max_v = IN[0]
def four_rand_nums (max_v=4):
    if max_v < 4: max_v = 4
    x = False    
    while x == False:
        p1 = randint(0,max_v)
        p2 = randint(0,max_v)
        p3 = randint(0,max_v)
        p4 = randint(0,max_v)

        if len(set([p1,p2,p3,p4])) == 4:
            x = True
            return [p1,p2,p3,p4]
OUT = four_rand_nums(int(max_v))
# ----------------------------------------
randomList = Math.RandomList(amount=code_block.out0, value1=code_block.out1, value2=code_block.out2, seed=python_script)
firstItem = List.FirstItem(list=randomList@L2)
lastItem = List.LastItem(list=randomList@L2)
byCoordinates = Point.ByCoordinates(x=firstItem, y=lastItem)
X = Point.X(point=byCoordinates)
Y = Point.Y(point=byCoordinates)
join = List.Join(list0=X, list1=Y)
minimumItem = List.MinimumItem(list=join)
maximumItem = List.MaximumItem(list=join)
number_slider_2 = DoubleSlider(46.5, range=0..100 step 0.1)
code_block_2 = CodeBlock(y=number_slider_2) { [0-y, 100+y]; }
code_block_3 = CodeBlock(x=code_block_2) { x[0]; x[1]; }
code_block_4 = CodeBlock(l=minimumItem, h=maximumItem, x=code_block_3.out0, y=code_block_3.out1) { l; h; [x, y]; }
random = Math.Random(value1=code_block_4.l, value2=code_block_4.h, seed=code_block_4.out2)
code_block_5 = CodeBlock(x=random) { x[0]; x[1]; }
byCoordinates_2 = Point.ByCoordinates(x=code_block_5.out0, y=code_block_5.out1)
byPoints = Polygon.ByPoints(points=byCoordinates)
selfIntersections = Polygon.SelfIntersections(polygon=byPoints)
isEmpty = List.IsEmpty(list=selfIntersections)
convexHull2D = Custom[Springs.Points.ConvexHull2D](points=byCoordinates)  # package spring nodes
byPoints_2 = Polygon.ByPoints(points=convexHull2D)
if_ = RefactoredIf(test=isEmpty, true=byPoints, false=byPoints_2)
center = Polygon.Center(polygon=if_)
byTwoPoints = Vector.ByTwoPoints(start=byCoordinates_2, end=center)
code_block_6 = CodeBlock { 200; }
byStartPointDirectionLength = Line.ByStartPointDirectionLength(startPoint=byCoordinates_2, direction=byTwoPoints, length=code_block_6)
intersect = Geometry.Intersect(geometry=byStartPointDirectionLength, other=if_)
count = List.Count(list=intersect)
code_block_7 = CodeBlock { 2; }
mod = count % code_block_7
code_block_8 = CodeBlock { "Inside Polygon!"; "Outside Polygon!"; }
if_2 = RefactoredIf(test=mod, true=code_block_8.out0, false=code_block_8.out1)
polygon = Object.Identity(object=if_)
points = Polygon.Points(polygon=polygon)
X_2 = Point.X(point=points)
Y_2 = Point.Y(point=points)
list_create = List.Create(item0=X_2, item1=Y_2)
transpose = List.Transpose(lists=list_create)
point = Object.Identity(object=byCoordinates_2)
X_3 = Point.X(point=point)
Y_3 = Point.Y(point=point)
join_2 = List.Join(list0=X_3, list1=Y_3)
python_script_2 = Python(IN[0]=transpose, IN[1]=join_2)  # CPython3
# ---------- python_script_2.python (69 lines) ----------
# Load the Python Standard and DesignScript Libraries
import sys
import clr
clr.AddReference('ProtoGeometry')
from Autodesk.DesignScript.Geometry import *



# The inputs to this node will be stored as a list in the IN variables.
polygon = IN[0]
point = IN[1]

# Below code was generated by ChatGPT https://chat.openai.com/

import math

def is_point_in_polygon(polygon, point):
    # check if the point is a vertex
    if point in polygon:
        return True

    # check if the point is on the boundary
    for i in range(len(polygon)):
        p1 = None
        p2 = None
        if i == 0:
            p1 = polygon[0]
            p2 = polygon[1]
        else:
            p1 = polygon[i-1]
            p2 = polygon[i]
        if point_on_line_segment(point, p1, p2):
            return True
    
    # check if the point is inside the polygon
    n = len(polygon)
    inside = False
    p1x, p1y = polygon[0]
    for i in range(n+1):
        p2x, p2y = polygon[i % n]
        if point[1] > min(p1y,p2y):
            if point[1] <= max(p1y,p2y):
                if point[0] <= max(p1x,p2x):
                    if p1y != p2y:
                        xinters = (point[1]-p1y)*(p2x-p1x)/(p2y-p1y)+p1x
                    if p1x == p2x or point[0] <= xinters:
                        inside = not inside
        p1x,p1y = p2x,p2y
    return inside

def point_on_line_segment(point, p1, p2):
    x, y = point
    x1, y1 = p1
    x2, y2 = p2
    if x < min(x1, x2) or x > max(x1, x2):
        return False
    if y < min(y1, y2) or y > max(y1, y2):
        return False
    if x1 == x2:
        return x == x1
    if y1 == y2:
        return y == y1
    slope = (y2 - y1) / (x2 - x1)
    y_intercept = y1 - slope * x1
    return y == slope * x + y_intercept

# test the function

OUT = is_point_in_polygon(polygon, point)
# ----------------------------------------
