# Dynamo graph Point in Polygon.dyn "Point in Poloygon" (Dynamo 2.12.0.5650)
# packages: spring nodes 121.1.1

code_block = CodeBlock { [2,2,2,2]; 0; 100; [3,1,7,4]; }
number_slider = DoubleSlider(8, range=0..100 step 1)
python_script = Python(IN[0]=number_slider)  # CPython3
# ---------- python_script.python (15 lines) ----------
from random import randint
max_v = IN[0]
def four_rand_nums (max_v=4):
    if max_v < 4: max_v = 4
    x = False    
    while x == False:
        p1 = randint(0,max_v)
        p2 = randint(0,max_v)
        p3 = randint(0,max_v)
        p4 = randint(0,max_v)

        if len(set([p1,p2,p3,p4])) == 4:
            x = True
            return [p1,p2,p3,p4]
OUT = four_rand_nums(int(max_v))
# ----------------------------------------
randomList = Math.RandomList(amount=code_block.out0, value1=code_block.out1, value2=code_block.out2, seed=python_script)
firstItem = List.FirstItem(list=randomList@L2)
lastItem = List.LastItem(list=randomList@L2)
byCoordinates = Point.ByCoordinates(x=firstItem, y=lastItem)
byPoints = Polygon.ByPoints(points=byCoordinates)
selfIntersections = Polygon.SelfIntersections(polygon=byPoints)
isEmpty = List.IsEmpty(list=selfIntersections)
ꟿ_points_convexhull2d = Custom[ꟿ Points.ConvexHull2D](points=byCoordinates)  # package spring nodes; Computes the XY convex hull of a given set of points based on the monotone chain algorithm.
byPoints_2 = Polygon.ByPoints(points=ꟿ_points_convexhull2d)
if_ = RefactoredIf(test=isEmpty, true=byPoints, false=byPoints_2)
X = Point.X(point=byCoordinates)
Y = Point.Y(point=byCoordinates)
join = List.Join(list0=X, list1=Y)
minimumItem = List.MinimumItem(list=join)
maximumItem = List.MaximumItem(list=join)
number_slider_2 = DoubleSlider(48.8, range=0..100 step 0.1)
code_block_2 = CodeBlock(y=number_slider_2) { [0-y, 100+y]; }
code_block_3 = CodeBlock(x=code_block_2) { x[0]; x[1]; }
code_block_4 = CodeBlock(l=minimumItem, h=maximumItem, x=code_block_3.out0, y=code_block_3.out1) { l; h; [x, y]; }
random = Math.Random(value1=code_block_4.l, value2=code_block_4.h, seed=code_block_4.out2)
code_block_5 = CodeBlock(x=random) { x[0]; x[1]; }
byCoordinates_2 = Point.ByCoordinates(x=code_block_5.out0, y=code_block_5.out1)
containmentTest = Polygon.ContainmentTest(polygon=if_, point=byCoordinates_2)
byCoordinates_3 = Vector.ByCoordinates()
center = Polygon.Center(polygon=if_)
byTwoPoints = Vector.ByTwoPoints(start=byCoordinates_2, end=center)
code_block_6 = CodeBlock { 200; }
byStartPointDirectionLength = Line.ByStartPointDirectionLength(startPoint=byCoordinates_2, direction=byTwoPoints, length=code_block_6)
intersect = Geometry.Intersect(geometry=byStartPointDirectionLength, other=if_)
count = List.Count(list=intersect)
code_block_7 = CodeBlock { 2; }
mod = count % code_block_7
code_block_8 = CodeBlock { "Inside Polygon!"; "Outside Polygon!"; }
if_2 = RefactoredIf(test=mod, true=code_block_8.out0, false=code_block_8.out1)
