# Dynamo graph Sine.dyn (Dynamo 2.10.1.3976)

number_slider = DoubleSlider(9.4, range=0..100 step 0.1)
integer_slider = IntegerSlider(54, range=-5..100 step 1)
python_script = Python(IN[0]=number_slider, IN[1]=integer_slider)  # CPython3
# ---------- python_script.python (29 lines) ----------
# Load the Python Standard and DesignScript Libraries
import sys
import clr
clr.AddReference('ProtoGeometry')
from Autodesk.DesignScript.Geometry import *
from math import sin
# The inputs to this node will be stored as a list in the IN variables.
freq = IN[0]
length = IN[1]

# Place your code below this line
def sine(freq = 0, length = 2):
    """
    This is a simple function for visualizing the sine equation using dynamo objects.
    """
    points = []

    if length <= 1:
        return "The length must be greater than 1."
    else:    
        for i in range(length):
            x = 5 * i
            z = freq * sin(i)
            points.append(Point.ByCoordinates(x,0,z))
        curve = NurbsCurve.ByPoints(points)
        return curve

# Assign your output to the OUT variable.
OUT = sine(freq, length)
# ----------------------------------------
number_slider_2 = DoubleSlider(18.6, range=0..100 step 0.1)
integer_slider_2 = IntegerSlider(37, range=-5..100 step 1)
python_script_2 = Python(IN[0]=number_slider_2, IN[1]=integer_slider_2)  # CPython3
# ---------- python_script_2.python (18 lines) ----------
# Load the Python Standard and DesignScript Libraries
import sys
import clr
clr.AddReference('ProtoGeometry')
from Autodesk.DesignScript.Geometry import *
# custom ve for Dynamo
sys.path.append(r"C:\Users\dgoodwin\Anaconda3\envs\Dynamo_2022\Lib")
# custom py module 
sys.path.append(r"C:\Users\dgoodwin\Documents\GitHub\Intro-to-Parametric-Modeling-Dynamo-Scripts\Python Module")
from MyModule import dynamoSine
# The inputs to this node will be stored as a list in the IN variables.
f = IN[0]
l = IN[1]
# Place your code below this line

OUT = dynamoSine(f, l)
#OUT = mm.hellowWorld()
#OUT = mm.dynamoSine(freq, length)
# ----------------------------------------
number_slider_3 = DoubleSlider(30.2, range=0..100 step 0.1)
integer_slider_3 = IntegerSlider(46, range=-5..100 step 1)
python_script_3 = Python(IN[0]=number_slider_3, IN[1]=integer_slider_3)  # CPython3
# ---------- python_script_3.python (33 lines) ----------
# Load the Python Standard and DesignScript Libraries
import sys
import clr
clr.AddReference('ProtoGeometry')
from Autodesk.DesignScript.Geometry import *
# custom ve for Dynamo
sys.path.append(r"C:\Users\dgoodwin\Anaconda3\envs\Dynamo_2022\Lib")
# custom py module 
sys.path.append(r"C:\Users\dgoodwin\Documents\GitHub\Intro-to-Parametric-Modeling-Dynamo-Scripts\Python Module")

from math import sin
# The inputs to this node will be stored as a list in the IN variables.
freq = IN[0]
length = IN[1]

# Place your code below this line
def dynamoSine(freq = 0, length = 2):
    """
    This is a simple function for visualizing the sine equation using dynamo objects.
    """
    points = [] 
    
    if length < 2:
        return "The length must be greater than 1."
        
    else:
        for i in range(length):
            x = 5 * i
            z = freq * sin(i)
            points.append(Point.ByCoordinates(x,0,z))
        curve = NurbsCurve.ByPoints(points)
        return curve
OUT = dynamoSine(freq, length)
# ----------------------------------------
