# Dynamo graph Some fancy ceiling.dyn (Dynamo 2.10.1.3976)
# packages: LunchBox for Dynamo 2018.7.6

surfaces = PolySurface.Surfaces()  # unwired: polySurface
XY = Plane.XY()
integer_slider = IntegerSlider(0, range=0..100 step 1)
integer_slider_2 = IntegerSlider(0, range=0..100 step 1)
translate = Geometry.Translate(geometry=XY, xTranslation=integer_slider, yTranslation=integer_slider_2)
panel_size_wxl = IntegerSlider(2, range=0..100 step 1)
byWidthLength = Rectangle.ByWidthLength(plane=translate, width=panel_size_wxl, length=panel_size_wxl)
byPatch = Surface.ByPatch(closedCurve=byWidthLength)
width = IntegerSlider(8, range=0..100 step 1)
code_block = CodeBlock(width=width) { 0..width..4; }
length = IntegerSlider(8, range=0..100 step 1)
code_block_2 = CodeBlock(length=length) { 2..length..4; }
translate_2 = Geometry.Translate(geometry=byPatch, xTranslation=code_block, yTranslation=code_block_2, lacing=CrossProduct)
code_block_3 = CodeBlock { 2; }
transform = Geometry.Transform()  # unwired: geometry, cs
panel_size_wxl_2 = IntegerSlider(2, range=0..100 step 1)
byWidthLength_2 = Rectangle.ByWidthLength(plane=translate, width=panel_size_wxl_2, length=panel_size_wxl_2)
byPatch_2 = Surface.ByPatch(closedCurve=byWidthLength_2)
code_block_4 = CodeBlock { [1,2]; }
divideSurfaceUV = Geometry.Surfaces.DivideSurfaceUV(surface=byPatch_2, UDivision=code_block_4, VDivision=code_block_4)
identity = Object.Identity(object=divideSurfaceUV.Points)
code_block_5 = CodeBlock(x=identity) { x[1]; }
code_block_6 = CodeBlock(x=code_block_5) { x[1][1]; }
number_slider = DoubleSlider(-0.3, range=-0.5..0.5 step 0.1)
number_slider_2 = DoubleSlider(-0.5, range=-0.5..0.5 step 0.1)
number_slider_3 = DoubleSlider(0.8, range=0.1..1 step 0.1)
byCoordinates = Vector.ByCoordinates(x=number_slider, y=number_slider_2, z=number_slider_3)
translate_3 = Geometry.Translate(geometry=code_block_6, direction=byCoordinates)
python_script = Python(IN[0]=code_block_5, IN[1]=translate_3)  # CPython3
# ---------- python_script.python (6 lines) ----------
l = IN[0]
new_point = IN[1]

l[1][1] = new_point

OUT = l
# ----------------------------------------
code_block_7 = CodeBlock { [0,1]; }
getItemAtIndex = List.GetItemAtIndex(list=python_script, index=code_block_7)
code_block_8 = CodeBlock { [0,1]; }
getItemAtIndex_2 = List.GetItemAtIndex(list=getItemAtIndex@L2, index=code_block_8)
code_block_9 = CodeBlock(x=getItemAtIndex_2) { x[0]; x[1]; }
reverse = List.Reverse(list=code_block_9.out1)
code_block_10 = CodeBlock(x=code_block_9.out0, y=reverse) { [x,y]; }
flatten = List.Flatten(list=code_block_10)
code_block_11 = CodeBlock { 1; }
byPoints = PolyCurve.ByPoints(points=flatten, connectLastToFirst=code_block_11)
byPatch_3 = Surface.ByPatch(closedCurve=byPoints)
code_block_12 = CodeBlock { [1,2]; }
getItemAtIndex_3 = List.GetItemAtIndex(list=python_script, index=code_block_12)
code_block_13 = CodeBlock { [0,1]; }
getItemAtIndex_4 = List.GetItemAtIndex(list=getItemAtIndex_3@L2, index=code_block_13)
code_block_14 = CodeBlock(x=getItemAtIndex_4) { x[0]; x[1]; }
reverse_2 = List.Reverse(list=code_block_14.out1)
code_block_15 = CodeBlock(x=code_block_14.out0, y=reverse_2) { [x,y]; }
flatten_2 = List.Flatten(list=code_block_15)
code_block_16 = CodeBlock { 1; }
byPoints_2 = PolyCurve.ByPoints(points=flatten_2, connectLastToFirst=code_block_16)
byPatch_4 = Surface.ByPatch(closedCurve=byPoints_2)
code_block_17 = CodeBlock { [0,1]; }
getItemAtIndex_5 = List.GetItemAtIndex(list=python_script, index=code_block_17)
code_block_18 = CodeBlock { [1,2]; }
getItemAtIndex_6 = List.GetItemAtIndex(list=getItemAtIndex_5@L2, index=code_block_18)
code_block_19 = CodeBlock(x=getItemAtIndex_6) { x[0]; x[1]; }
reverse_3 = List.Reverse(list=code_block_19.out1)
code_block_20 = CodeBlock(x=code_block_19.out0, y=reverse_3) { [x,y]; }
flatten_3 = List.Flatten(list=code_block_20)
code_block_21 = CodeBlock { 1; }
byPoints_3 = PolyCurve.ByPoints(points=flatten_3, connectLastToFirst=code_block_21)
byPatch_5 = Surface.ByPatch(closedCurve=byPoints_3)
code_block_22 = CodeBlock { [1,2]; }
getItemAtIndex_7 = List.GetItemAtIndex(list=python_script, index=code_block_22)
code_block_23 = CodeBlock { [1,2]; }
getItemAtIndex_8 = List.GetItemAtIndex(list=getItemAtIndex_7@L2, index=code_block_23)
code_block_24 = CodeBlock(x=getItemAtIndex_8) { x[0]; x[1]; }
reverse_4 = List.Reverse(list=code_block_24.out1)
code_block_25 = CodeBlock(x=code_block_24.out0, y=reverse_4) { [x,y]; }
flatten_4 = List.Flatten(list=code_block_25)
code_block_26 = CodeBlock { 1; }
byPoints_4 = PolyCurve.ByPoints(points=flatten_4, connectLastToFirst=code_block_26)
byPatch_6 = Surface.ByPatch(closedCurve=byPoints_4)
list_create = List.Create(item0=byPatch_3, item1=byPatch_4, item2=byPatch_5, item3=byPatch_6)
byJoinedSurfaces = PolySurface.ByJoinedSurfaces(surfaces=list_create)
code_block_27 = CodeBlock(width=width) { 0..width..4; }
code_block_28 = CodeBlock(length=length) { 0..length..4; }
translate_4 = Geometry.Translate(geometry=byJoinedSurfaces, xTranslation=code_block_27, yTranslation=code_block_28, lacing=CrossProduct)
code_block_29 = CodeBlock(width=width) { 2..width..4; }
code_block_30 = CodeBlock(length=length) { 2..length..4; }
translate_5 = Geometry.Translate(geometry=byJoinedSurfaces, xTranslation=code_block_29, yTranslation=code_block_30, lacing=CrossProduct)
code_block_31 = CodeBlock(width=width) { 2..width..4; }
code_block_32 = CodeBlock(length=length) { 0..length..4; }
translate_6 = Geometry.Translate(geometry=byPatch, xTranslation=code_block_31, yTranslation=code_block_32, lacing=CrossProduct)
