# Dynamo graph The Art of PI.dyn "Pi_Art" (Dynamo 2.12.0.5650)

code_block = CodeBlock { "3.1415926535897932384626433832795028841971693993751058209749445923078164062862089986280348253421170679821480865132823066470938446095505822317253594081284811174502841027019385211055596446229489549303819644288109756659334461284756482337"; }
length = String.Length(string=code_block)
code_block_2 = CodeBlock { [0,2,4,6]; }
columns = DoubleSlider(10, range=2..1000 step 1)
surface_size_l_and_w = DoubleSlider(2, range=2..20 step 1)
code_block_3 = CodeBlock(x=columns, y=surface_size_l_and_w) { x * y; }
range = Range(end=code_block_3, step=surface_size_l_and_w)
code_block_4 = CodeBlock { -1; }
dropItems = List.DropItems(list=range, amount=code_block_4)
number_of_digits = DoubleSlider(100, range=2..1000 step 1)
div = number_of_digits / columns
code_block_5 = CodeBlock(sec=div, size=surface_size_l_and_w) { (sec * size) - size; }
range_2 = Range(end=code_block_5, step=surface_size_l_and_w)
byCoordinates = Point.ByCoordinates(x=dropItems, y=range_2, lacing=CrossProduct)
byOriginNormalXAxis = Plane.ByOriginNormalXAxis(origin=byCoordinates)
byWidthLength = Rectangle.ByWidthLength(plane=byOriginNormalXAxis, width=surface_size_l_and_w, length=surface_size_l_and_w)
byPatch = Surface.ByPatch(closedCurve=byWidthLength)
flatten = List.Flatten(list=byPatch)
pi = Python(IN[0]=number_of_digits)  # CPython3
# ---------- pi.python (20 lines) ----------
# https://stackoverflow.com/questions/9004789/1000-digits-of-pi-in-python

DIGITS = IN[0]


def pi_digits(x):
    """Generate x digits of Pi."""
    k,a,b,a1,b1 = 2,4,1,12,4
    while x > 0:
        p,q,k = k * k, 2 * k + 1, k + 1
        a,b,a1,b1 = a1, b1, p*a + q*a1, p*b + q*b1
        d,d1 = a/b, a1/b1
        while d == d1 and x > 0:
            yield int(d)
            x -= 1
            a,a1 = 10*(a % b), 10*(a1 % b1)
            d,d1 = a/b, a1/b1

digits = [str(n) for n in list(pi_digits(DIGITS))]
OUT = ("%s.%s" % (digits.pop(0), "".join(digits)))
# ----------------------------------------
python_script = Python(IN[0]=pi)  # IronPython2
# ---------- python_script.python (12 lines) ----------
pi = IN[0]

OUT = [[],[]]
for n in pi:
    if n == ".":
        pass
    elif int(n) % 2 == 0:
        OUT[0].append(True)
        OUT[1].append(int(n))
    else:
        OUT[0].append(False)
        OUT[1].append(int(n))
# ----------------------------------------
code_block_6 = CodeBlock(n=python_script) { n[0]; }
color_palette = ColorPalette({R: 0, G: 255, B: 255, A: 255})
color_palette_2 = ColorPalette({R: 173, G: 255, B: 47, A: 255})
if_ = RefactoredIf(test=code_block_6, true=color_palette, false=color_palette_2)
byGeometryColor = Modifiers.GeometryColor.ByGeometryColor(geometry=flatten, color=if_)
code_block_7 = CodeBlock { 0; }
code_block_8 = CodeBlock { 255; }
code_block_9 = CodeBlock(n=python_script) { n[1]; }
random = Math.Random(value1=code_block_7, value2=code_block_8, seed=code_block_9)
byARGB = Color.ByARGB(blue=random)
byGeometryColor_2 = Modifiers.GeometryColor.ByGeometryColor(geometry=flatten, color=byARGB)
