# Dynamo graph Topolgy Simple Testing.dyn (Dynamo 2.10.1.3976)
# packages: Topologic 1.4.0

code_block = CodeBlock { "Walls"; }
byName = Category.ByName(name=code_block)
all_elements_of_category = ElementsOfCategory(Category=byName)
geometry = Element.Geometry(element=all_elements_of_category)
byGeometry = Topologic.Topology.ByGeometry(geometry=geometry)
