# Dynamo graph Delaunay Table.dyn (Dynamo 2.10.1.3976)

code_block = CodeBlock { 20; }
code_block_2 = CodeBlock { -5; }
code_block_3 = CodeBlock { -30; }
number_slider = DoubleSlider(13.3, range=-1000..1000 step 0.1)
randomList = Math.RandomList(amount=code_block, value1=code_block_2, value2=code_block_3, seed=number_slider)
code_block_4 = CodeBlock { 20; }
code_block_5 = CodeBlock { -5; }
code_block_6 = CodeBlock { -15; }
code_block_7 = CodeBlock(x=number_slider) { x+100; }
randomList_2 = Math.RandomList(amount=code_block_4, value1=code_block_5, value2=code_block_6, seed=code_block_7)
code_block_8 = CodeBlock { 20; }
code_block_9 = CodeBlock { 0; }
code_block_10 = CodeBlock { 10; }
code_block_11 = CodeBlock(x=code_block_7) { x+100; }
randomList_3 = Math.RandomList(amount=code_block_8, value1=code_block_9, value2=code_block_10, seed=code_block_11)
byCoordinates = Point.ByCoordinates(x=randomList, y=randomList_2, z=randomList_3)
byGeometry = BoundingBox.ByGeometry(geom=byCoordinates)
toCuboid = BoundingBox.ToCuboid(boundingBox=byGeometry)
explode = Geometry.Explode(geometry=toCuboid)
perimeterCurves = Surface.PerimeterCurves(surface=explode)
startPoint = Curve.StartPoint(curve=perimeterCurves)
code_block_12 = CodeBlock { 0; }
getItemAtIndex = List.GetItemAtIndex(list=startPoint, index=code_block_12)
code_block_13 = CodeBlock { 1; }
getItemAtIndex_2 = List.GetItemAtIndex(list=startPoint, index=code_block_13)
join = List.Join(list0=byCoordinates, list1=getItemAtIndex, list2=getItemAtIndex_2)
byPoints = Tessellation.Delaunay.ByPoints(points=join)
string_from_object = FromObject()  # unwired: object
uniqueItems = List.UniqueItems(list=string_from_object)
groupByFunction = List.GroupByFunction(list=byPoints, groupFunction=uniqueItems)
firstItem = List.FirstItem(list=groupByFunction@L2)
startPoint_2 = Curve.StartPoint(curve=firstItem)
direction = Line.Direction(line=firstItem)
byOriginNormal = Plane.ByOriginNormal(origin=startPoint_2, normal=direction)
code_block_14 = CodeBlock { 0.07; }
byPlaneRadius = Circle.ByPlaneRadius(plane=byOriginNormal, radius=code_block_14)
length = Curve.Length(curve=firstItem)
extrudeAsSolid = Curve.ExtrudeAsSolid(curve=byPlaneRadius, distance=length)
origin = Plane.Origin(plane=byOriginNormal)
normal = Plane.Normal(plane=byOriginNormal)
byStartPointDirectionLength = Line.ByStartPointDirectionLength(startPoint=origin, direction=normal)
endPoint = Curve.EndPoint(curve=byStartPointDirectionLength)
startPoint_3 = Curve.StartPoint(curve=byStartPointDirectionLength)
groupByKey = List.GroupByKey(list=endPoint, keys=startPoint_3)
watch = Watch(groupByKey.groups)
string_from_object_2 = FromObject(object=watch)
groupByKey_2 = List.GroupByKey(list=byOriginNormal, keys=startPoint_3)
watch_2 = Watch(groupByKey_2.groups)
byKeysValues = DesignScript.Builtin.Dictionary.ByKeysValues(keys=string_from_object_2@L2, values=watch_2@L2)
code_block_15 = CodeBlock { 0.5; }
pruneDuplicates = Point.PruneDuplicates(points=watch@L2, tolerance=code_block_15)
string_from_object_3 = FromObject(object=pruneDuplicates)
valueAtKey = DesignScript.Builtin.Dictionary.ValueAtKey(dictionary=byKeysValues, key=string_from_object_3)
watch_3 = Watch(valueAtKey)
code_block_16 = CodeBlock { 0.75; }
byWidthLength = Rectangle.ByWidthLength(plane=watch_3, width=code_block_16, length=code_block_16)
count = List.Count(list=byWidthLength@L2)
code_block_17 = CodeBlock { 0.2; 0.7; }
number_slider_2 = DoubleSlider(67.7, range=-1000..1000 step 0.1)
randomList_4 = Math.RandomList(amount=count, value1=code_block_17.out0, value2=code_block_17.out1, seed=number_slider_2)
extrudeAsSolid_2 = Curve.ExtrudeAsSolid(curve=byWidthLength@L2, distance=randomList_4@L2)
byUnion = Solid.ByUnion(solids=extrudeAsSolid_2)
faces = Topology.Faces(topology=extrudeAsSolid_2)
edges = Face.Edges(face=faces)
flatten = List.Flatten(list=edges@L4)
code_block_18 = CodeBlock { 0.05; }
fillet = Solid.Fillet(solid=extrudeAsSolid_2, edges=flatten, radius=code_block_18)
chamfer = Solid.Chamfer(solid=extrudeAsSolid_2, edges=flatten, offset=code_block_18)
