# Dynamo graph Geom_Testing_backup.dyn (Dynamo 2.3.1.11775)
# packages: spring nodes 204.1.0, Orchid 230.0.3.7536

code_block = CodeBlock { 0; }
code_block_2 = CodeBlock { 150; }
ofRepeatedItem = List.OfRepeatedItem(item=code_block, amount=code_block_2)
code_block_3 = CodeBlock { 150; }
ofRepeatedItem_2 = List.OfRepeatedItem(item=code_block_2, amount=code_block_3)
random = Math.Random(value1=ofRepeatedItem, value2=ofRepeatedItem_2)
code_block_4 = CodeBlock { 0; }
ofRepeatedItem_3 = List.OfRepeatedItem(item=code_block_4, amount=code_block_2)
ofRepeatedItem_4 = List.OfRepeatedItem(item=code_block_2, amount=code_block_3)
random_2 = Math.Random(value1=ofRepeatedItem_3, value2=ofRepeatedItem_4)
code_block_5 = CodeBlock { 0; }
ofRepeatedItem_5 = List.OfRepeatedItem(item=code_block_5, amount=code_block_2)
ofRepeatedItem_6 = List.OfRepeatedItem(item=code_block_2, amount=code_block_3)
random_3 = Math.Random(value1=ofRepeatedItem_5, value2=ofRepeatedItem_6)
byCoordinates = Point.ByCoordinates(x=random, y=random_2, z=random_3)
byCoordinates_2 = Point.ByCoordinates(x=random, y=random_2)
ꟿ_points_convexhull2d = Custom[ꟿ Points.ConvexHull2D](points=byCoordinates_2)  # package spring nodes; Computes the XY convex hull of a given set of points based on the monotone chain algorithm.
code_block_6 = CodeBlock { true; }
byPoints = PolyCurve.ByPoints(points=ꟿ_points_convexhull2d, connectLastToFirst=code_block_6)
byPatch = Surface.ByPatch(closedCurve=byPoints)
code_block_7 = CodeBlock { 1; }
code_block_8 = CodeBlock { false; }
thicken = Surface.Thicken(surface=byPatch, thickness=code_block_7, both_sides=code_block_8)
number_slider = DoubleSlider(50, range=50..100 step 10)
byPoints_2 = Tessellation.ConvexHull.ByPoints()  # unwired: points
python_script = Python(IN[0]=byPoints_2)
# ---------- python_script.python (107 lines) ----------
import clr
#clr.AddReference('ProtoGeimetry')
#import Autodesk.DesignScript.Geometry *
# Import RevitNodes
clr.AddReference("RevitNodes")
import Revit

lines = IN[0]

#line.StartPoint
keys = []
for index, i in enumerate(lines):
    keys.append(index)
       
count = [0] * len(lines)


lines_count = dict(zip(keys, count))
line_groups = []
ids = []
for i in keys:
    ids.append(["a"])

temp_l = []
for i in lines:
    temp_l.append(1)

it = 0
it1 = 0
while True:
    it1 += 1
    for index1 in lines_count:
        it += 1
        x = False
        if lines_count.get(index1) < 4: 
            for index2 in lines_count:
                if ids[index1][0] != ids[index2][0] or ids[index1][0] == "a":
                    if x == False:
                        if index1 != index2:
                            if lines_count.get(index2) < 4:
                                line1 = lines[index1] 
                                line2 = lines[index2]                                              
                                if str(line2.EndPoint) == str(line1.StartPoint) and not str(line2.StartPoint) == str(line1.EndPoint):
                                    for index3 in lines_count:
                                        if ids[index2][0] != ids[index3][0] or ids[index2][0] == "a":
                                        
                                            if index1 != index3 and index2 != index3 and index2 != index1:
                                                if lines_count.get(index3) < 4:
                                                    line3 = lines[index3]
                                                    if str(line3.StartPoint) == str(line2.StartPoint) or str(line3.EndPoint) == str(line2.StartPoint):    
                                                        if str(line3.StartPoint) == str(line1.EndPoint) or str(line3.EndPoint) == str(line1.EndPoint):
                                                            lines_count[index1] = lines_count.get(index1) + 1
                                                            lines_count[index2] = lines_count.get(index2) + 1
                                                            lines_count[index3] = lines_count.get(index3) + 1
                                                            line_groups.append([line1, line2, line3])
                                                            x = True
                                                            ids[index1][0] = it
                                                            ids[index2][0] = it
                                                            ids[index3][0] = it 
                                                            break
    
                                              
                                                                    
                                elif str(line2.StartPoint) == str(line1.StartPoint) and not str(line2.EndPoint) == str(line1.EndPoint):
                                    for index3 in lines_count:
                                        if ids[index2][0] != ids[index3][0] or ids[index2][0] == "a":
                                            if index1 != index3 and index2 != index3 and index2 != index1:
                                                if lines_count.get(index3) < 4:
                                                    line3 = lines[index3]
                                                    if str(line3.StartPoint) == str(line2.EndPoint) or str(line3.EndPoint) == str(line2.EndPoint):
                                                        if str(line3.StartPoint) == str(line1.EndPoint) or str(line3.EndPoint) == str(line1.EndPoint):
                                                                lines_count[index1] = lines_count.get(index1) + 1
                                                                lines_count[index2] = lines_count.get(index2) + 1
                                                                lines_count[index3] = lines_count.get(index3) + 1
                                                                line_groups.append([line1, line2, line3])
                                                                x = True
                                                                ids[index1][0] = it
                                                                ids[index2][0] = it
                                                                ids[index3][0] = it    
                                                                break
         
    
                else:
                    break
       
    
    if all(value != 0 and value != 1 for value in lines_count.values()):
        break
    
    elif it1 == 4:
        break    

l = []
for i in lines_count:
    l.append([i, lines_count.get(i)])
temp_2 = []

for i in lines_count:
    if lines_count.get(i) == 0:
        temp_2.append(i)
    
temp_3 = []

for i in temp_2:
    temp_3.append(lines[i])
    
OUT = [line_groups, l, ids, all(value != 0 and value != 1 for value in lines_count.values()), temp_3]
# ----------------------------------------
code_block_9 = CodeBlock(x=python_script) { x[0]; }
sort = List.Sort(list=code_block_9@L2)
uniqueItems = List.UniqueItems(list=sort)
byJoinedCurves = PolyCurve.ByJoinedCurves(curves=uniqueItems)
clean = List.Clean(list=byJoinedCurves)
byPatch_2 = Surface.ByPatch(closedCurve=clean)
byUnion = Surface.ByUnion(surfaces=byPatch_2)
number = DoubleInput(0)
code_block_10 = CodeBlock { "Walls"; }
byName = Category.ByName()  # unwired: name
all_elements_of_category = ElementsOfCategory(Category=byName)
getLocation = Element.GetLocation(element=all_elements_of_category)
watch = Watch(getLocation)
length = Curve.Length(curve=watch)
code_block_11 = CodeBlock(x=length) { x/5; }
pointsAtEqualSegmentLength = Curve.PointsAtEqualSegmentLength(curve=watch, divisions=code_block_11)
flatten = List.Flatten(list=pointsAtEqualSegmentLength)
X = Point.X(point=flatten)
Y = Point.Y(point=flatten)
python_script_2 = Python(IN[0]=X, IN[1]=Y)
# ---------- python_script_2.python (6 lines) ----------
data1 = IN[0]
data2 = IN[1]

OUT = []
for i,j in zip(data1, data2):
    OUT.append([i, j])
# ----------------------------------------
toInteger = Orchid.Common.Number.ToInteger(number=python_script_2)
python_script_3 = Python(IN[0]=toInteger)
# ---------- python_script_3.python (18 lines) ----------
# Load the Python Standard and DesignScript Libraries
import sys
import clr
clr.AddReference('ProtoGeometry')
from Autodesk.DesignScript.Geometry import *

sys.path.append(r'C:\Users\dgoodwin\Anaconda3\envs\Dynamo211\Lib\site-packages')
from scipy.spatial import Voronoi, voronoi_plot_2d
import numpy as np
#data = IN[0]
points = np.array(IN[0])


vor = Voronoi(points)
#[[0, 0], [0, 1], [0, 2], [1, 0], [1, 1], [1, 2],
                   #[2, 0], [2, 1], [2, 2]]
#OUT = vor
OUT = [vor.vertices, vor.regions, vor.ridge_vertices, vor.ridge_points, vor.points ]
# ----------------------------------------
watch_2 = Watch(python_script_3)
code_block_12 = CodeBlock(x=watch_2) { x[0]; }
code_block_13 = CodeBlock { 0; }
getItemAtIndex = List.GetItemAtIndex(list=code_block_12@L2, index=code_block_13)
string_from_object = FromObject(object=getItemAtIndex)
toNumber = String.ToNumber(str=string_from_object)
code_block_14 = CodeBlock { 1; }
getItemAtIndex_2 = List.GetItemAtIndex(list=code_block_12@L2, index=code_block_14)
string_from_object_2 = FromObject(object=getItemAtIndex_2)
toNumber_2 = String.ToNumber(str=string_from_object_2)
byCoordinates_3 = Point.ByCoordinates(x=toNumber, y=toNumber_2)
byJoinedCurves_2 = PolyCurve.ByJoinedCurves(curves=watch)
byPatch_3 = Surface.ByPatch(closedCurve=byJoinedCurves_2)
doesIntersect = Geometry.DoesIntersect(geometry=byPatch_3, other=byCoordinates_3)
filterByBoolMask = List.FilterByBoolMask(list=byCoordinates_3, mask=doesIntersect)
list_create = List.Create(item0=filterByBoolMask.in)
flatten_2 = List.Flatten(list=list_create)
code_block_15 = CodeBlock { 2; }
pruneDuplicates = Point.PruneDuplicates(points=flatten_2, tolerance=code_block_15)
code_block_16 = CodeBlock { 1; }
byCenterPointRadius = Circle.ByCenterPointRadius(centerPoint=pruneDuplicates, radius=code_block_16)
byParametersOnSurface = Tessellation.Voronoi.ByParametersOnSurface()  # unwired: uvs, face
code_block_17 = CodeBlock { 0; }
getItemAtIndex_3 = List.GetItemAtIndex(list=pruneDuplicates, index=code_block_17)
number_slider_2 = DoubleSlider(4, range=0..20 step 1)
getItemAtIndex_4 = List.GetItemAtIndex(list=pruneDuplicates, index=number_slider_2)
python_script_4 = Python(IN[0]=getItemAtIndex_3, IN[1]=getItemAtIndex_4)
# ---------- python_script_4.python (13 lines) ----------
# Load the Python Standard and DesignScript Libraries
import sys
import clr
clr.AddReference('ProtoGeometry')
from Autodesk.DesignScript.Geometry import *

# The inputs to this node will be stored as a list in the IN variables.
dataEnteringNode = IN

# Place your code below this line

# Assign your output to the OUT variable.
OUT = Line.ByStartPointEndPoint(IN[0], IN[1])
# ----------------------------------------
code_block_18 = CodeBlock { 4; }
getItemAtIndex_5 = List.GetItemAtIndex(list=pruneDuplicates, index=code_block_18)
number_slider_3 = DoubleSlider(5, range=0..20 step 1)
getItemAtIndex_6 = List.GetItemAtIndex(list=pruneDuplicates, index=number_slider_3)
python_script_5 = Python(IN[0]=getItemAtIndex_5, IN[1]=getItemAtIndex_6)  # same code as python_script_4
code_block_19 = CodeBlock { 5; }
getItemAtIndex_7 = List.GetItemAtIndex(list=pruneDuplicates, index=code_block_19)
number_slider_4 = DoubleSlider(36, range=20..40 step 1)
getItemAtIndex_8 = List.GetItemAtIndex(list=pruneDuplicates, index=number_slider_4)
python_script_6 = Python(IN[0]=getItemAtIndex_7, IN[1]=getItemAtIndex_8)  # same code as python_script_4
byCoordinates_4 = Point.ByCoordinates()
code_block_20 = CodeBlock { -5; }
byCoordinates_5 = Point.ByCoordinates(x=code_block_20)
byStartPointEndPoint = Line.ByStartPointEndPoint(startPoint=byCoordinates_4, endPoint=byCoordinates_5)
byCoordinates_6 = Point.ByCoordinates()
code_block_21 = CodeBlock { 5; }
byCoordinates_7 = Point.ByCoordinates(x=code_block_21)
byStartPointEndPoint_2 = Line.ByStartPointEndPoint(startPoint=byCoordinates_6, endPoint=byCoordinates_7)
byCoordinates_8 = Point.ByCoordinates()
code_block_22 = CodeBlock { 5; }
number_slider_5 = DoubleSlider(1.1, range=0..100 step 0.1)
byCoordinates_9 = Point.ByCoordinates(y=code_block_22, z=number_slider_5)
byStartPointEndPoint_3 = Line.ByStartPointEndPoint(startPoint=byCoordinates_8, endPoint=byCoordinates_9)
code_block_23 = CodeBlock { 5; }
byCoordinates_10 = Point.ByCoordinates(y=code_block_23, z=number_slider_5)
code_block_24 = CodeBlock { -5; }
byCoordinates_11 = Point.ByCoordinates(x=code_block_24)
byStartPointEndPoint_4 = Line.ByStartPointEndPoint(startPoint=byCoordinates_10, endPoint=byCoordinates_11)
list_create_2 = List.Create(item0=byStartPointEndPoint, item1=byStartPointEndPoint_2, item2=byStartPointEndPoint_3, item3=byStartPointEndPoint_4)
byJoinedCurves_3 = PolyCurve.ByJoinedCurves()  # unwired: curves
code_block_25 = CodeBlock { 6; }
code_block_26 = CodeBlock { 1; }
code_block_27 = CodeBlock { true; }
buildFromLines = TSpline.TSplineSurface.BuildFromLines(maxFaceValence=code_block_25, snappingTolerance=code_block_26, inSmoothMode=code_block_27)  # unwired: lines
code_block_28 = CodeBlock { 2; }
number_slider_6 = DoubleSlider(91.6, range=0..100 step 0.1)
number_slider_7 = DoubleSlider(6, range=0..100 step 0.1)
byCoordinates_12 = Point.ByCoordinates(x=number_slider_6, y=number_slider_7)
number_slider_8 = DoubleSlider(91.6, range=0..100 step 0.1)
number_slider_9 = DoubleSlider(84.3, range=0..100 step 0.1)
byCoordinates_13 = Point.ByCoordinates(x=number_slider_8, y=number_slider_9)
code_block_29 = CodeBlock { 10; }
byCenterPointRadius_2 = Circle.ByCenterPointRadius(centerPoint=byCoordinates_13, radius=code_block_29)
byPatch_4 = Surface.ByPatch(closedCurve=byCenterPointRadius_2)
code_block_30 = CodeBlock { 5; }
thicken_2 = Surface.Thicken(surface=byPatch_4, thickness=code_block_30)
byOriginNormal = Plane.ByOriginNormal(origin=byCoordinates_13)
number_slider_10 = DoubleSlider(1.9, range=0..100 step 0.1)
number_slider_11 = DoubleSlider(3.4, range=0..100 step 0.1)
number_slider_12 = DoubleSlider(5.7, range=0..100 step 0.1)
scale = Geometry.Scale(geometry=thicken_2, plane=byOriginNormal, xamount=number_slider_10, yamount=number_slider_11, zamount=number_slider_12)
number_slider_13 = DoubleSlider(1, range=0..100 step 0.1)
number_slider_14 = DoubleSlider(43.2, range=0..100 step 0.1)
# note: Pi
# https://en.wikipedia.org/wiki/Pi
byCoordinates_14 = Point.ByCoordinates(x=number_slider_13, y=number_slider_14)
number_slider_15 = DoubleSlider(4.5, range=0..100 step 0.1)
number_slider_16 = DoubleSlider(45.5, range=0..100 step 0.1)
byCoordinates_15 = Point.ByCoordinates(x=number_slider_15, y=number_slider_16)
number_slider_17 = DoubleSlider(0, range=0..100 step 0.1)
number_slider_18 = DoubleSlider(47.6, range=0..100 step 0.1)
byCoordinates_16 = Point.ByCoordinates(x=number_slider_17, y=number_slider_18)
byThreePoints = Circle.ByThreePoints(p1=byCoordinates_14, p2=byCoordinates_15, p3=byCoordinates_16)
centerPoint = Circle.CenterPoint(circle=byThreePoints)
X_2 = Point.X(point=centerPoint)
radius = Circle.Radius(circle=byThreePoints)
code_block_31 = CodeBlock(x=X_2, x1=radius) { x - x1; }
Y_2 = Point.Y(point=centerPoint)
byCoordinates_17 = Point.ByCoordinates(x=code_block_31, y=Y_2)
list_create_3 = List.Create(item0=byCoordinates_14, item1=byCoordinates_15, item2=byCoordinates_16)
splitByPoints = Curve.SplitByPoints(curve=byThreePoints, points=list_create_3)
length_2 = Curve.Length(curve=splitByPoints)
code_block_32 = CodeBlock(x=code_block_31, x1=length_2) { x+x1[0]; }
byCoordinates_18 = Point.ByCoordinates(x=code_block_32, y=Y_2)
byStartPointEndPoint_5 = Line.ByStartPointEndPoint(startPoint=byCoordinates_17, endPoint=byCoordinates_18)
code_block_33 = CodeBlock(x=code_block_32, x1=length_2) { x+x1[1]; }
byCoordinates_19 = Point.ByCoordinates(x=code_block_33, y=Y_2)
byStartPointEndPoint_6 = Line.ByStartPointEndPoint(startPoint=byCoordinates_18, endPoint=byCoordinates_19)
code_block_34 = CodeBlock(x=code_block_33, x1=length_2) { x+x1[2]; }
byCoordinates_20 = Point.ByCoordinates(x=code_block_34, y=Y_2)
byStartPointEndPoint_7 = Line.ByStartPointEndPoint(startPoint=byCoordinates_20, endPoint=byCoordinates_19)
list_create_4 = List.Create(item0=byStartPointEndPoint_5, item1=byStartPointEndPoint_6, item2=byStartPointEndPoint_7)
byJoinedCurves_4 = PolyCurve.ByJoinedCurves(curves=list_create_4)
length_3 = Curve.Length(curve=byJoinedCurves_4)
sum = Math.Sum(values=length_2)
number_slider_19 = DoubleSlider(91.4, range=0..100 step 0.1)
number_slider_20 = DoubleSlider(20.4, range=0..100 step 0.1)
byCoordinates_21 = Point.ByCoordinates(x=number_slider_19, y=number_slider_20)
number_slider_21 = DoubleSlider(78.2, range=0..100 step 0.1)
number_slider_22 = DoubleSlider(19.8, range=0..100 step 0.1)
byCoordinates_22 = Point.ByCoordinates(x=number_slider_21, y=number_slider_22)
number_slider_23 = DoubleSlider(84.8, range=0..100 step 0.1)
number_slider_24 = DoubleSlider(12.7, range=0..100 step 0.1)
byCoordinates_23 = Point.ByCoordinates(x=number_slider_23, y=number_slider_24)
byThreePoints_2 = Circle.ByThreePoints(p1=byCoordinates_21, p2=byCoordinates_22, p3=byCoordinates_23)
code_block_35 = CodeBlock { 8; }
regularPolygon = Polygon.RegularPolygon(circle=byThreePoints_2, numberSides=code_block_35)
code_block_36 = CodeBlock(x=radius) { x*2; }
code_block_37 = CodeBlock(x=code_block_36) { x*4; }
range = Range(start=code_block_36, end=code_block_37, step=code_block_36)
byCoordinates_24 = Vector.ByCoordinates(x=range)
translate = Geometry.Translate(geometry=byThreePoints, direction=byCoordinates_24)
code_block_38 = CodeBlock(x=translate) { x[2]; }
length_4 = Curve.Length(curve=code_block_38)
number_slider_25 = DoubleSlider(100, range=0..100 step 0.1)
byCoordinates_25 = Point.ByCoordinates(x=number_slider_25)
number_slider_26 = DoubleSlider(86.1, range=0..100 step 0.1)
byCoordinates_26 = Point.ByCoordinates(x=number_slider_26)
number_slider_27 = DoubleSlider(88.1, range=0..100 step 0.1)
number_slider_28 = DoubleSlider(7.2, range=0..100 step 0.1)
byCoordinates_27 = Point.ByCoordinates(x=number_slider_27, y=number_slider_28)
number_slider_29 = DoubleSlider(90.9, range=0..100 step 0.1)
number_slider_30 = DoubleSlider(3.2, range=0..100 step 0.1)
byCoordinates_28 = Point.ByCoordinates(x=number_slider_29, y=number_slider_30)
number_slider_31 = DoubleSlider(94.8, range=0..100 step 0.1)
number_slider_32 = DoubleSlider(8.4, range=0..100 step 0.1)
byCoordinates_29 = Point.ByCoordinates(x=number_slider_31, y=number_slider_32)
list_create_5 = List.Create(item0=byCoordinates_25, item1=byCoordinates_26, item2=byCoordinates_27, item3=byCoordinates_28, item4=byCoordinates_29)
byPoints_3 = Polygon.ByPoints(points=list_create_5)
number_slider_33 = DoubleSlider(93.7, range=0..100 step 0.1)
number_slider_34 = DoubleSlider(3.2, range=0..100 step 0.1)
byCoordinates_30 = Point.ByCoordinates(x=number_slider_33, y=number_slider_34)
# note: Point in polygon:
# https://en.wikipedia.org/wiki/Point_in_polygon
# Winding number:
# https://en.wikipedia.org/wiki/Winding_number
# Even-odd rule:
# https://en.wikipedia.org/wiki/Even%E2%80%93odd_rule
# Semi-infinite:
# https://en.wikipedia.org/wiki/Semi-infinite
# Computational Geometry in Python:
# https://www.toptal.com/python/computational-geometry-in-python-from-theory-to-implementation
point_in_polygon = Custom[Point-in-Polygon](polygon=byPoints_3, point=byCoordinates_30)
containmentTest = Polygon.ContainmentTest(polygon=byPoints_3, point=byCoordinates_30)
