# Dynamo graph Voronoi Table.dyn (Dynamo 2.10.1.3976)

code_block = CodeBlock { 20; }
code_block_2 = CodeBlock { -5; }
code_block_3 = CodeBlock { -30; }
number_slider = DoubleSlider(329.6, range=-1000..1000 step 0.1)
randomList = Math.RandomList(amount=code_block, value1=code_block_2, value2=code_block_3, seed=number_slider)
code_block_4 = CodeBlock { 20; }
code_block_5 = CodeBlock { -5; }
code_block_6 = CodeBlock { -15; }
code_block_7 = CodeBlock(x=number_slider) { x+100; }
randomList_2 = Math.RandomList(amount=code_block_4, value1=code_block_5, value2=code_block_6, seed=code_block_7)
code_block_8 = CodeBlock { 20; }
code_block_9 = CodeBlock { 0; }
code_block_10 = CodeBlock { 10; }
code_block_11 = CodeBlock(x=code_block_7) { x+100; }
randomList_3 = Math.RandomList(amount=code_block_8, value1=code_block_9, value2=code_block_10, seed=code_block_11)
byCoordinates = Point.ByCoordinates(x=randomList, y=randomList_2, z=randomList_3)
byGeometry = BoundingBox.ByGeometry(geom=byCoordinates)
toCuboid = BoundingBox.ToCuboid(boundingBox=byGeometry)
explode = Geometry.Explode(geometry=toCuboid)
perimeterCurves = Surface.PerimeterCurves(surface=explode)
startPoint = Curve.StartPoint(curve=perimeterCurves)
code_block_12 = CodeBlock { 0; }
getItemAtIndex = List.GetItemAtIndex(list=startPoint, index=code_block_12)
code_block_13 = CodeBlock { 1; }
getItemAtIndex_2 = List.GetItemAtIndex(list=startPoint, index=code_block_13)
join = List.Join(list0=byCoordinates, list1=getItemAtIndex, list2=getItemAtIndex_2)
byPoints = Tessellation.ConvexHull.ByPoints(points=join)
byCenterPointRadius = Sphere.ByCenterPointRadius()
byPoints_2 = Tessellation.Delaunay.ByPoints(points=join)
startPoint_2 = Curve.StartPoint(curve=byPoints_2)
direction = Line.Direction(line=byPoints_2)
byOriginNormal = Plane.ByOriginNormal(origin=startPoint_2, normal=direction)
code_block_14 = CodeBlock { 0.25; }
byPlaneRadius = Circle.ByPlaneRadius(plane=byOriginNormal, radius=code_block_14)
length = Curve.Length(curve=byPoints_2)
extrudeAsSolid = Curve.ExtrudeAsSolid(curve=byPlaneRadius, distance=length)
uniqueItems = List.UniqueItems(list=byPoints_2)
