# Dynamo graph archimedean spiral.dyn (Dynamo 2.10.1.3976)

number_slider = DoubleSlider(10200, range=100..100000 step 100)
byCoordinates = Point.ByCoordinates(x=number_slider)
code_block = CodeBlock { 1000; }
archimedean_spiral_prime = Python(IN[0]=byCoordinates, IN[1]=code_block)  # CPython3
# ---------- archimedean_spiral_prime.python (28 lines) ----------
# Load the Python Standard and DesignScript Libraries
import sys
import clr
clr.AddReference('ProtoGeometry')
from Autodesk.DesignScript.Geometry import *

point = IN[0]
rn = IN[1]

points = []
radian = 57.2958
radius = 1
rn = list(range(1,rn,1))

def prime(num):
        for x in range(2,num):
            if num % x == 0:
                return False
        return True


for i in rn:
    if prime(i):
        a = Arc.ByCenterPointRadiusAngle(point,i,0,radian,Vector.ByCoordinates(0,0,1))
        points.append(a.EndPoint)
        radian += 57.2958
        
OUT = points
# ----------------------------------------
byPoints = NurbsCurve.ByPoints(points=archimedean_spiral_prime)
byCoordinates_2 = Point.ByCoordinates()
archimedean_spiral = Python(IN[0]=byCoordinates_2, IN[1]=code_block)  # CPython3
# ---------- archimedean_spiral.python (19 lines) ----------
# Load the Python Standard and DesignScript Libraries
import sys
import clr
clr.AddReference('ProtoGeometry')
from Autodesk.DesignScript.Geometry import *

point = IN[0]
rn = IN[1]

points = []
radian = 57.2958
rn = list(range(1,rn,1))

for i in rn:
    
    a = Arc.ByCenterPointRadiusAngle(point,i,0,radian,Vector.ByCoordinates(0,0,1))
    points.append(a.EndPoint)
    radian += 57.2958
OUT = points
# ----------------------------------------
byPoints_2 = NurbsCurve.ByPoints(points=archimedean_spiral)
code_block_2 = CodeBlock(x=byPoints_2) { [x]; }
