# Dynamo custom node Update Views _.dyn "Tool.PlaceViewsOnExistingSheets" (Dynamo 2.3.1.11775)
# category: SteamNodes.Tool
# Place the views on the sheets at the points you provide.

Sheet = Input(Sheet: var[]..[])
View = Input(View: var[]..[])
Input = Input(: var[]..[])
python_script = Python(IN[0]=Sheet, IN[1]=View, IN[2]=Input)
# ---------- python_script.python (52 lines) ----------
#python nodes in dynamo 1.2
#proposed by Julien Benoit @jbenoit44 
#http://aecuandme.wordpress.com/
import clr
clr.AddReference('ProtoGeometry')
from Autodesk.DesignScript.Geometry import *
# Import ToDSType(bool) extension method
clr.AddReference("RevitNodes")
import Revit
clr.ImportExtensions(Revit.Elements)
# Import geometry conversion extension methods
clr.ImportExtensions(Revit.GeometryConversion)
# Import DocumentManager and TransactionManager
clr.AddReference("RevitServices")
import RevitServices
from RevitServices.Persistence import DocumentManager
from RevitServices.Transactions import TransactionManager
from System.Collections.Generic import *
# Import RevitAPI
clr.AddReference("RevitAPI")
import Autodesk
from Autodesk.Revit.DB import *

doc = DocumentManager.Instance.CurrentDBDocument
uiapp = DocumentManager.Instance.CurrentUIApplication
app = uiapp.Application
uidoc=DocumentManager.Instance.CurrentUIApplication.ActiveUIDocument

sheets = []
for i in IN[0]:
	sheets.append(UnwrapElement(i))
views=[]	
for i in IN[1]:
	views.append(UnwrapElement(i))
points=[]	
for i in IN[2]:
	points.append(UnwrapElement(i).ToXyz())

# Start Transaction
TransactionManager.Instance.EnsureInTransaction(doc)
viewport=[]
for s,v,p in zip(sheets,views,points):
	try:
		a=Viewport.Create(doc, s.Id,v.Id, p)
	except:
		a="View is already placed"
	viewport.append(a)

# End Transaction
TransactionManager.Instance.TransactionTaskDone()

OUT=viewport
# ----------------------------------------
Viewport = Output(python_script)
