# Dynamo graph Update Views.dyn (Dynamo 2.3.0.5885)

add_data = Python()  # unwired: IN[0]
# ---------- add_data.python (176 lines) ----------
"""
1. Create and name a new schema
2. Set the read/write access for the schema
3. Define one or more fields of data for the schema
4. Create an entity based on the schema
5. Assign values to the fields for the entity
6. Associate the entity with a Revit element
"""
#import sys
import sys
import os
import uuid
import clr
clr.AddReference('RevitAPI')
clr.AddReference('RevitAPIUI')
from Autodesk.Revit.DB import *

clr.AddReference('RevitServices')
import RevitServices
from RevitServices.Persistence import DocumentManager
from RevitServices.Transactions import TransactionManager

#import dynamo libaries for creating a point
clr.AddReference('ProtoGeometry')
from Autodesk.DesignScript.Geometry import Point

import clr
clr.AddReference('System')
from System import Guid, Int32

doc = DocumentManager.Instance.CurrentDBDocument
uidoc=DocumentManager.Instance.CurrentUIApplication.ActiveUIDocument


elements = UnwrapElement(IN[0])

#revit 2022
#set SetUnitType was deprecated 
def createSchemaAndStoreData_2022(doc, element): 
    """
    Create a schema and store data in a view element
    """
    TransactionManager.Instance.EnsureInTransaction(doc)
    #create a new revit guid
    schemaGuid = Guid.NewGuid()
    schemaBuilder = ExtensibleStorage.SchemaBuilder(schemaGuid)
    #set read/write access
    schemaBuilder.SetReadAccessLevel(ExtensibleStorage.AccessLevel.Public)
    schemaBuilder.SetWriteAccessLevel(ExtensibleStorage.AccessLevel.Public)
    #set the schema name
    schemaBuilder.SetSchemaName("ElementLocation")
    #add a field to the schema
    fieldBuilder = schemaBuilder.AddSimpleField("Element_Location", XYZ)
    #fieldBuilder = schemaBuilder.AddSimpleField("ElementLocation", XYZ)
    fieldBuilder.SetSpec(SpecTypeId.Length)
    #set documentation
    fieldBuilder.SetDocumentation("The coordinates of the element location")

    #create the schema
    schema = schemaBuilder.Finish()
    entity = ExtensibleStorage.Entity(schema)
    #get the field from the schema
    field = schema.GetField("Element_Location")
    #set the value of the field

    #TransactionManager.Instance.EnsureInTransaction(doc)
    #set the value of the field
    entity.Set<XYZ>(field, element.GetBoxCenter(), UnitTypeId.Inch)
    element.SetEntity(entity)
    TransactionManager.Instance.TransactionTaskDone()
    #get the data back from the wall
    TransactionManager.Instance.EnsureInTransaction(doc)
    retrievedEntity = element.GetEntity(schema)
    retrievedEntity.Get<XYZ>(schema.GetField("Element_Location"))
    TransactionManager.Instance.TransactionTaskDone()
    return retrievedEntity.Get<XYZ>(schema.GetField("Element_Location"))

#revit 2020
def createSchemaAndStoreData_2020(doc, element): 
    """
    Create a schema and store data in a view element
    """
    TransactionManager.Instance.EnsureInTransaction(doc)
    #Create GUID from a string

    schemaGuid = Guid.NewGuid()
    schemaBuilder = ExtensibleStorage.SchemaBuilder(schemaGuid)
    #set read/write access
    schemaBuilder.SetReadAccessLevel(ExtensibleStorage.AccessLevel.Public)
    schemaBuilder.SetWriteAccessLevel(ExtensibleStorage.AccessLevel.Public)
    #set the schema name
    schemaBuilder.SetSchemaName("ElementLocation")
    #add a field to the schema
    fieldBuilder = schemaBuilder.AddSimpleField("Element_Location", XYZ)
    #fieldBuilder = schemaBuilder.AddSimpleField("ElementLocation", XYZ)
    fieldBuilder.SetUnitType(UnitType.UT_Length)
    #set documentation
    fieldBuilder.SetDocumentation("The coordinates of the element location")

    #create the schema
    schema = schemaBuilder.Finish()
    entity = ExtensibleStorage.Entity(schema)
    #get the field from the schema
    field = schema.GetField("Element_Location")
    #set the value of the field
	
    #TransactionManager.Instance.EnsureInTransaction(doc)
    #set the value of the field
    entity.Set(field, element.GetBoxCenter(), DisplayUnitType.DUT_DECIMAL_FEET)
    element.SetEntity(entity)

    TransactionManager.Instance.TransactionTaskDone()
    return element.GetBoxCenter()

#get schemas from the element
def getSchemasFromElement(element):
    """
    Get the schemas from the element
    """
    TransactionManager.Instance.EnsureInTransaction(doc)
    #get the schemas from the element
    schemas = element.GetEntitySchemaGuids()
    #get the schema names from the schemas
    schemaNames = [ExtensibleStorage.Schema.Lookup(schema).SchemaName for schema in schemas]

    for index,i in enumerate(schemaNames):
        if i == "ElementLocation":
            schemaGuid = schemas[index]
            schema = ExtensibleStorage.Schema.Lookup(schemaGuid)
            TransactionManager.Instance.TransactionTaskDone()
            return schema
            break
        else:
       		return None
    


#get value of element location from the schema
def getValueFromSchema(element, schema):
    """
    Get the value from the schema
    """
    if schema is not None:
        TransactionManager.Instance.EnsureInTransaction(doc)
	    #get the value from the schema
        fieldType = schema.GetField("Element_Location").GetType()
        t = schema.GetField("Element_Location")
        value = element.GetEntity(schema).Get[t.ValueType](schema.GetField("Element_Location"),DisplayUnitType.DUT_DECIMAL_FEET)
	    
	    #get the value from the schema
        TransactionManager.Instance.TransactionTaskDone()
        return value
    else:
        return "There is no schema to get the value from"
    



def deleteSchemaFromElement(element, schema):
    """
    Delete the schema from the element
    """
    if schema is not None:
        TransactionManager.Instance.EnsureInTransaction(doc)
        #delete the schema from the element
        element.DeleteEntity(schema)
        TransactionManager.Instance.TransactionTaskDone()
        return "Schema deleted"
    else:
        return "There is no schema to delete"


OUT = []
for element in elements:
	view_point = createSchemaAndStoreData_2020(doc, element)
	OUT.append(Point.ByCoordinates(view_point.X,view_point.Y,view_point.Z))
# ----------------------------------------
update_view = Python()  # unwired: IN[0]
# ---------- update_view.python (190 lines) ----------
"""
1. Create and name a new schema
2. Set the read/write access for the schema
3. Define one or more fields of data for the schema
4. Create an entity based on the schema
5. Assign values to the fields for the entity
6. Associate the entity with a Revit element
"""
#import sys
import sys
import os
import uuid
import clr
clr.AddReference('RevitAPI')
clr.AddReference('RevitAPIUI')
from Autodesk.Revit.DB import *

clr.AddReference("RevitNodes")
import Revit
from Revit.Elements import *
clr.ImportExtensions(Revit.Elements)


clr.AddReference('RevitServices')
import RevitServices
from RevitServices.Persistence import DocumentManager
from RevitServices.Transactions import TransactionManager

#import dynamo libaries for creating a point
clr.AddReference('ProtoGeometry')
from Autodesk.DesignScript.Geometry import Point, Vector

import clr
clr.AddReference('System')
from System import Guid, Int32

doc = DocumentManager.Instance.CurrentDBDocument
uidoc=DocumentManager.Instance.CurrentUIApplication.ActiveUIDocument


elements = UnwrapElement(IN[0])

#revit 2022
#set SetUnitType was deprecated 
def createSchemaAndStoreData_2022(doc, element): 
    """
    Create a schema and store data in a view element
    """
    TransactionManager.Instance.EnsureInTransaction(doc)
    #create a new revit guid
    schemaGuid = Guid.NewGuid()
    schemaBuilder = ExtensibleStorage.SchemaBuilder(schemaGuid)
    #set read/write access
    schemaBuilder.SetReadAccessLevel(ExtensibleStorage.AccessLevel.Public)
    schemaBuilder.SetWriteAccessLevel(ExtensibleStorage.AccessLevel.Public)
    #set the schema name
    schemaBuilder.SetSchemaName("ElementLocation")
    #add a field to the schema
    fieldBuilder = schemaBuilder.AddSimpleField("Element_Location", XYZ)
    #fieldBuilder = schemaBuilder.AddSimpleField("ElementLocation", XYZ)
    fieldBuilder.SetSpec(SpecTypeId.Length)
    #set documentation
    fieldBuilder.SetDocumentation("The coordinates of the element location")

    #create the schema
    schema = schemaBuilder.Finish()
    entity = ExtensibleStorage.Entity(schema)
    #get the field from the schema
    field = schema.GetField("Element_Location")
    #set the value of the field

    #TransactionManager.Instance.EnsureInTransaction(doc)
    #set the value of the field
    entity.Set<XYZ>(field, element.GetBoxCenter(), UnitTypeId.Inch)
    element.SetEntity(entity)
    TransactionManager.Instance.TransactionTaskDone()
    #get the data back from the wall
    TransactionManager.Instance.EnsureInTransaction(doc)
    retrievedEntity = element.GetEntity(schema)
    retrievedEntity.Get<XYZ>(schema.GetField("Element_Location"))
    TransactionManager.Instance.TransactionTaskDone()
    return retrievedEntity.Get<XYZ>(schema.GetField("Element_Location"))

#revit 2020
def createSchemaAndStoreData_2020(doc, element): 
    """
    Create a schema and store data in a view element
    """
    TransactionManager.Instance.EnsureInTransaction(doc)
    #Create GUID from a string

    schemaGuid = Guid.NewGuid()
    schemaBuilder = ExtensibleStorage.SchemaBuilder(schemaGuid)
    #set read/write access
    schemaBuilder.SetReadAccessLevel(ExtensibleStorage.AccessLevel.Public)
    schemaBuilder.SetWriteAccessLevel(ExtensibleStorage.AccessLevel.Public)
    #set the schema name
    schemaBuilder.SetSchemaName("ElementLocation")
    #add a field to the schema
    fieldBuilder = schemaBuilder.AddSimpleField("Element_Location", XYZ)
    #fieldBuilder = schemaBuilder.AddSimpleField("ElementLocation", XYZ)
    fieldBuilder.SetUnitType(UnitType.UT_Length)
    #set documentation
    fieldBuilder.SetDocumentation("The coordinates of the element location")

    #create the schema
    schema = schemaBuilder.Finish()
    entity = ExtensibleStorage.Entity(schema)
    #get the field from the schema
    field = schema.GetField("Element_Location")
    #set the value of the field
	
    #TransactionManager.Instance.EnsureInTransaction(doc)
    #set the value of the field
    entity.Set(field, element.GetBoxCenter(), DisplayUnitType.DUT_DECIMAL_FEET)
    element.SetEntity(entity)

    TransactionManager.Instance.TransactionTaskDone()
    return element.GetBoxCenter()

#get schemas from the element
def getSchemasFromElement(element):
    """
    Get the schemas from the element
    """
    TransactionManager.Instance.EnsureInTransaction(doc)
    #get the schemas from the element
    schemas = element.GetEntitySchemaGuids()
    #get the schema names from the schemas
    schemaNames = [ExtensibleStorage.Schema.Lookup(schema).SchemaName for schema in schemas]

    for index,i in enumerate(schemaNames):
        if i == "ElementLocation":
            schemaGuid = schemas[index]
            schema = ExtensibleStorage.Schema.Lookup(schemaGuid)
            TransactionManager.Instance.TransactionTaskDone()
            return schema
            break
        else:
       		return None
    


#get value of element location from the schema
def getValueFromSchema(element, schema):
    """
    Get the value from the schema
    """
    if schema is not None:
        TransactionManager.Instance.EnsureInTransaction(doc)
	    #get the value from the schema
        fieldType = schema.GetField("Element_Location").GetType()
        t = schema.GetField("Element_Location")
        value = element.GetEntity(schema).Get[t.ValueType](schema.GetField("Element_Location"),DisplayUnitType.DUT_DECIMAL_FEET)
	    
	    #get the value from the schema
        TransactionManager.Instance.TransactionTaskDone()
        return value
    else:
        return "There is no schema to get the value from"
    



def deleteSchemaFromElement(element, schema):
    """
    Delete the schema from the element
    """
    if schema is not None:
        TransactionManager.Instance.EnsureInTransaction(doc)
        #delete the schema from the element
        element.DeleteEntity(schema)
        TransactionManager.Instance.TransactionTaskDone()
        return "Schema deleted"
    else:
        return "There is no schema to delete"
OUT = []
for element in elements:
	schema = getSchemasFromElement(element)
	end_XYZ = getValueFromSchema(element, schema)
	start_XYZ = element.GetBoxCenter()
	
	end_point = Point.ByCoordinates(end_XYZ.X, end_XYZ.Y, end_XYZ.Z)
	
	sheet = doc.GetElement(element.SheetId)
	view = doc.GetElement(element.ViewId)
	
	viewport=[]
	doc.Delete(element.Id)
	OUT.append(Viewport.Create(doc, sheet.Id,view.Id, end_XYZ))
# ----------------------------------------
code_block = CodeBlock { "Viewports"; }
byName = Category.ByName(name=code_block)
all_elements_of_category = ElementsOfCategory(Category=byName)
