# Dynamo graph Copying Views for the sake of copying them 3.0.3.dyn (Dynamo 3.0.3.7597)

views = Views("L2")
integer_slider = IntegerSlider(100, range=1..100 step 1)
python_script = Python(IN[0]=views, IN[1]=integer_slider)  # CPython3
# ---------- python_script.python (23 lines) ----------
import clr

clr.AddReference('RevitAPI')
from Autodesk.Revit.DB import ViewDuplicateOption

clr.AddReference('RevitServices')
from RevitServices.Persistence import DocumentManager
from RevitServices.Transactions import TransactionManager

doc = DocumentManager.Instance.CurrentDBDocument
views = UnwrapElement(IN[0])
count = IN[1]
if not isinstance(views, list):
        views = [views]      
OUT = []
for view in views:
     if view.CanViewBeDuplicated(ViewDuplicateOption.Duplicate):
         while count:
            count -= 1
            TransactionManager.Instance.EnsureInTransaction(doc)
            OUT.append(doc.GetElement(view.Duplicate(ViewDuplicateOption.Duplicate)))
            TransactionManager.Instance.TransactionTaskDone()
                    
# ----------------------------------------
