# Dynamo graph Unpin Those Things 3.0.3.dyn (Dynamo 3.0.3.7597)

# group: This code block codes stuff
code_block = CodeBlock { ["RVT Links", "Levels"]; }

# group: This gets category things
byName = Category.ByName(name=code_block)

# group: This gets things based on other things
all_elements_of_category = ElementsOfCategory(Category=byName)

code_block_2 = CodeBlock { 0; }

# group: pins stuff
setPinnedStatus = Element.SetPinnedStatus(element=all_elements_of_category, pinned=code_block_2)

isPinned = Element.IsPinned(element=setPinnedStatus)
